# Dynamo graph HML_Audit_AutomatedAudit_script.dyn (Dynamo 2.6.1.8786)

# group: Revit Version
revit_version = Python()
# ---------- revit_version.python (12 lines) ----------
import clr
clr.AddReference("RevitServices")
import RevitServices
from RevitServices.Persistence import DocumentManager

doc = DocumentManager.Instance.CurrentDBDocument
uiapp = DocumentManager.Instance.CurrentUIApplication
app = uiapp.Application
if int(app.VersionNumber) > 2017: fullVersion = app.SubVersionNumber
else: fullVersion = str(app.VersionNumber)

OUT = int(app.VersionNumber)
# ----------------------------------------
code_block = CodeBlock(version=revit_version) { DSCore.List.Flatten(["Revit Version",version,"N/A"]); }

# group: DWG Imports
string_from_object = FromObject()  # unwired: obj
code_block_2 = CodeBlock(t0=string_from_object)
# ---------- code_block_2.designscript (5 lines) ----------
t1 = DSCore.String.Split(t0<1L>, [" : "]<1L>);
t2=DSCore.List.Reverse(t1@@L2<2L>);
t3=DSCore.List.RemoveItemAtIndex(t2@@L2<2L>,1);
t4=DSCore.List.Flatten(t3<1L>,1);
t5=DSCore.List.DropItems(t4<1L>,1);
# ----------------------------------------

code_block_3 = CodeBlock()
# ---------- code_block_3.designscript (22 lines) ----------
//determine server from splashscreen
t0 = ElementQueries.OfCategory(Category.ByName("Title Blocks"));
t1=t0+""=="HML_SheetProjectInformation";
t2=DSCore.List.FilterByBoolMask(t0,t1);
t3=DesignScript.Dictionary.ValueAtKey(t2,"in");
t4=Revit.Elements.Element.GetParameterValueByName(t3,"LondonOffice")==1;
t5=t4?"lprojects":"gprojects";
//Projectlocation
a1=ElementQueries.OfCategory(Category.ByName("OST_ProjectInformation"));
a2 = Revit.Elements.Element.GetParameterValueByName(a1, "Project Number");
a3 = String.Substring(a2, 0, 2)+"00\\";
x1="\\\\hm\\filestore\\"+t5+"\\"+a3+a2+"\\1-Cad\\BIM\\";
//filelocation
b1 = Revit.Document.FilePath(Revit.Document.Current);
b2=DSCore.String.Split(b1,"\\")[-1];
b3=DSCore.String.Split(b2,"_")[0];
b4=x1+"01-WIP\\BIM_Models\\"+b3;
//ResultsFolder
c1=x1+"07-Audit\\AutomatedAudit\\Results\\";
//filename
withoutfilestorestuff=DSCore.String.Split(b3,".")[0];
withfilestorestuff=DSCore.String.Split(b2,".")[0];
# ----------------------------------------
code_block_4 = CodeBlock { ["ElementNaming.csv","StandardsNaming.csv"]; }

# group: File Locations
string = StringInput("1-Cad\BIM\07-Audit\AutomatedAudit\Rulesets\")
code_block_5 = CodeBlock(t3=code_block_3.b4, t2=string, t4=code_block_4) { t1 = DSCore.String.Substring(t3, 0, 35); a0=DSCore.List.Flatten(t1+t2+t4<1L>); }

file_from_path = FileObject(path=code_block_5.a0)
string_2 = StringInput("\\hm\filestore\Resource\Revit\HM Audit\AutomatedAudit\Office\Rulesets\")
code_block_6 = CodeBlock(a=string_2, b=code_block_4) { T1=a+b; }
code_block_7 = CodeBlock(t1=file_from_path, x=code_block_6, t4=code_block_5.a0) { t2 = FileSystem.ReadText(t1); t3=t2[0]==null; y4=DSCore.List.Flatten(t3?x:t4); }
code_block_8 = CodeBlock { false; }
importCSV = Data.ImportCSV(filePath=code_block_7.y4, transpose=code_block_8, lacing=Longest)
code_block_9 = CodeBlock(x=importCSV) { DSCore.List.Transpose(x<1L>); }

# group: Modify element sheet
expand_tables = CodeBlock(data=code_block_9)
# ---------- expand_tables.designscript (15 lines) ----------
x=data[0];
t0=DSCore.List.DropItems(x,1);
x1=DSCore.List.Transpose(t0);
t1=x1[0];
x2=x1[1];
t2=DSCore.List.Count(t0<1L>);
t3=DSCore.List.OfRepeatedItem(t1<1L>,t2<1L>);
x3=DSCore.List.OfRepeatedItem(x2<1L>,t2<1L>);
t4=DSCore.List.Count(t0);
t5=DSCore.List.OfRepeatedItem(x[0],t4);
t6=DSCore.List.Flatten(t0);
t7=DSCore.List.Flatten(t3);
t8=DSCore.List.Flatten(t5);
t9=DSCore.List.Flatten(x3);
t11=[t7,t9,t8,t6];
# ----------------------------------------

code_block_10 = CodeBlock(t11=expand_tables.t11, t8=expand_tables.t8)
# ---------- code_block_10.designscript (15 lines) ----------
t11;
t12=DSCore.List.Transpose(t11);
x1=t8=="Category"||t8=="Type Name Identifier";
x2=DSCore.List.FilterByBoolMask(t12,x1);
x3=DesignScript.Dictionary.ValueAtKey(x2,"out");
x4=DSCore.List.Transpose(x3)[3];
t13=DSCore.List.Contains(x4<1L>,"Not Applicable");
t14=DSCore.List.FilterByBoolMask(x3,t13);
t15=DesignScript.Dictionary.ValueAtKey(t14,"out");
t16=DSCore.List.Transpose(t15);
x5=t16[2];
t17=DSCore.String.Contains(x5,"Type|");
t18=DSCore.List.FilterByBoolMask(t15,t17);
t19=DesignScript.Dictionary.ValueAtKey(t18,"in");
t20=DesignScript.Dictionary.ValueAtKey(t18,"out");
# ----------------------------------------

# group (continued): Modify element sheet
code_block_11 = CodeBlock(list=code_block_10.t16)
# ---------- code_block_11.designscript (8 lines) ----------
t0=list[0];
t1=DSCore.List.UniqueItems(t0);
t2=Category.ByName(t1);
elements=ElementQueries.OfCategory(t2);
t3 = Revit.Elements.Element.GetParameterValueByName(elements, "Type");
types = DSCore.List.UniqueItems(t3<1L>);
dictionary1 = DesignScript.Dictionary.ByKeysValues(t1, elements);
dictionary2 = DesignScript.Dictionary.ByKeysValues(t1, types);
# ----------------------------------------

# group: Instance Parameters
match_elements_and_filter = CodeBlock(parameters=code_block_10.t20, dictionary1=code_block_11.dictionary1)  # "Match elements and filter empties"
# ---------- match_elements_and_filter.designscript (23 lines) ----------
//Instances
parameters;
t1=DSCore.List.Transpose(parameters);
t2=t1[0];
t3= DesignScript.ValueAtKey(dictionary1, t2);
t4= DSCore.List.IsEmpty(t3<1L>);
t5=DSCore.List.FilterByBoolMask(parameters,t4);
t6=DesignScript.Dictionary.ValueAtKey(t5,"out");
t7=DSCore.List.FilterByBoolMask(t3,t4);
t8=DesignScript.Dictionary.ValueAtKey(t7,"out");
strings=Revit.Elements.Element.Name(t8<1L>);
t9=DSCore.List.Transpose(t6);
t10=t9[1];
t11=DSCore.String.Contains(strings,t10);
t12=t10=="All";
t13=t11||t12;
t14=DSCore.List.FilterByBoolMask(t8,t13);
t15=DesignScript.Dictionary.ValueAtKey(t14,"in");
t16=DSCore.List.IsEmpty(t15<1L>);
t17=DSCore.List.FilterByBoolMask(t15,t16);
t18=DesignScript.Dictionary.ValueAtKey(t17,"out");
t19=DSCore.List.FilterByBoolMask(t6,t16);
t20=DesignScript.Dictionary.ValueAtKey(t19,"out");
# ----------------------------------------
worksets = Python(IN[0]=code_block_15.x1)
# ---------- worksets.python (22 lines) ----------
import clr

clr.AddReference('RevitAPI')
from Autodesk.Revit.DB import *

clr.AddReference('RevitServices')
import RevitServices
from RevitServices.Persistence import DocumentManager

doc = DocumentManager.Instance.CurrentDBDocument
elements = UnwrapElement(IN[0])

WorksetIDList = list()
WorksetNameList = list()

for e in elements:
	WorksetIDList.append(doc.GetWorksetTable().GetWorkset(e.WorksetId))
	
for ws in WorksetIDList:
	WorksetNameList.append(ws.Name)

OUT = WorksetNameList
# ----------------------------------------
creator = Python(IN[0]=code_block_15.x1)
# ---------- creator.python (21 lines) ----------
import clr
clr.AddReference('RevitAPI')
from Autodesk.Revit.DB import *

clr.AddReference("RevitServices")
import RevitServices
from RevitServices.Persistence import DocumentManager

doc = DocumentManager.Instance.CurrentDBDocument
faminsts = UnwrapElement(IN[0])
elementlist = list()
creatorlist = list()
for item in faminsts:
	try:
#		elementlist.append(doc.GetWorksetTable().GetWorkset(item.WorksetId).Name)
		creatorlist.append(WorksharingUtils.GetWorksharingTooltipInfo(doc,item.Id).Creator)
	except:
#		elementlist.append(list())
		creatorlist.append(list())
# OUT = elementlist, creatorlist
OUT = creatorlist
# ----------------------------------------
code_block_12 = CodeBlock(x=match_elements_and_filter.t18) { t1=DSCore.List.Flatten(x); t2=DSCore.List.Count(x<1L>); }
python_script = Python(IN[0]=code_block_12.t1)
# ---------- python_script.python (13 lines) ----------
import clr
clr.AddReference('RevitAPI')
from Autodesk.Revit.DB import *

def GetPhases(item):
	if hasattr(item, "CreatedPhaseId"):
		return item.Document.GetElement(item.CreatedPhaseId), item.Document.GetElement(item.DemolishedPhaseId)
	else: return None, None

items = UnwrapElement(IN[0])

if isinstance(IN[0], list): OUT = map(list, zip(*[GetPhases(x) for x in items]))
else: OUT = GetPhases(items)
# ----------------------------------------
code_block_13 = CodeBlock(x=python_script, y=code_block_12.t2)
# ---------- code_block_13.designscript (3 lines) ----------
t1=DSCore.List.Chop(x[0],y);
t2 = Revit.Elements.Element.GetParameterValueByName(t1, "Name");
t3=DSCore.List.Flatten(t2);
# ----------------------------------------

code_block_14 = CodeBlock(t1=code_block_3.b2, x=worksets) { a1 = !DSCore.String.Contains(t1,"Central",true); a2 = DSCore.String.Replace(x,"Workset1","Revit LT User"); a3=a1?a2:x; }

# group (continued): Instance Parameters
code_block_15 = CodeBlock(parameters=match_elements_and_filter.t20, elements=match_elements_and_filter.t18, worksetnames=code_block_14.a3, creatornames=creator)
# ---------- code_block_15.designscript (17 lines) ----------
parameters;
t1=DSCore.List.Transpose(parameters);
t2=t1[2];
t3=DSCore.String.Replace(t2,"Instance|","");
results = (Revit.Elements.Element.GetParameterValueByName(elements, t3))+"";
//Workset swap
x1=DSCore.List.Flatten(elements);
x2=DSCore.List.Count(elements<1L>);
worksets=DSCore.List.Chop(worksetnames,x2);
creators=DSCore.List.Chop(creatornames,x2);
t5=t3=="Workset"?worksets:results;
t6=t1[3]+"";
t7 = Revit.Elements.Element.Id(elements);
t8=DSCore.List.OfRepeatedItem(t3<1L>,x2<1L>);
t9=DSCore.List.OfRepeatedItem(t1[0]<1L>,x2<1L>);
t10=DSCore.List.OfRepeatedItem(t1[1]<1L>,x2<1L>);
t11=Revit.Elements.Element.Name(x1);
# ----------------------------------------
string_from_object_2 = FromObject(obj=code_block_15.t5)
test_list_against_regex = Python(IN[0]=string_from_object_2, IN[1]=code_block_15.t6)
# ---------- test_list_against_regex.python (18 lines) ----------
import clr
import re

items = IN[0]


regexstrings = IN[1]

def StartsWithRegex(regex, str):
	if re.search(regex,str): return "Pass"
	else: return "Fail"
	
watch = []
for item,regexstring in zip(items,regexstrings):
	watch.append([StartsWithRegex(regexstring,i) for i in item])
	

OUT = watch
# ----------------------------------------
code_block_16 = CodeBlock(category=code_block_15.t9, filter=code_block_15.t10, Elementnames=code_block_15.t11, elementid=code_block_15.t7, Creatornames=code_block_15.creators, tests=code_block_15.t8, results=string_from_object_2, regex=test_list_against_regex, phase=code_block_13.t3)
# ---------- code_block_16.designscript (9 lines) ----------
categories=DSCore.List.Flatten(category);
filters=DSCore.List.Flatten(filter);
ElementName=Elementnames;
Elementids=DSCore.List.Flatten(elementid);
creators=DSCore.List.Flatten(Creatornames);
test=DSCore.List.Flatten(tests);
values=DSCore.List.Flatten(results);
passfail=DSCore.List.Flatten(regex);
phase;
# ----------------------------------------
list_create = List.Create(item0=code_block_16.categories, item1=code_block_16.filters, item2=code_block_16.ElementName, item3=code_block_16.Elementids, item4=code_block_16.creators, item5=code_block_16.test, item6=code_block_16.values, item7=code_block_16.passfail, item8=code_block_16.phase)

# group: Type Parameters
string_from_object_3 = FromObject(obj=match_elements_and_filter_2.names)
match_elements_and_filter_2 = CodeBlock(parameters=code_block_10.t19, dictionary1=code_block_11.dictionary2, strings=string_from_object_3)  # "Match elements and filter empties"
# ---------- match_elements_and_filter_2.designscript (24 lines) ----------
//Instances
parameters;
t1=DSCore.List.Transpose(parameters);
t2=t1[0];
t3= DesignScript.ValueAtKey(dictionary1, t2);
t4= DSCore.List.IsEmpty(t3<1L>);
t5=DSCore.List.FilterByBoolMask(parameters,t4);
t6=DesignScript.Dictionary.ValueAtKey(t5,"out");
t7=DSCore.List.FilterByBoolMask(t3,t4);
t8=DesignScript.Dictionary.ValueAtKey(t7,"out");
names=Revit.Elements.Element.GetParameterValueByName(t8<1L>,"Type Name");
strings;
t9=DSCore.List.Transpose(t6);
t10=t9[1];
t11=DSCore.String.Contains(strings,t10);
t12=t10=="All";
t13=t11||t12;
t14=DSCore.List.FilterByBoolMask(t8,t13);
t15=DesignScript.Dictionary.ValueAtKey(t14,"in");
t16=DSCore.List.IsEmpty(t15<1L>);
t17=DSCore.List.FilterByBoolMask(t15,t16);
t18=DesignScript.Dictionary.ValueAtKey(t17,"out");
t19=DSCore.List.FilterByBoolMask(t6,t16);
t20=DesignScript.Dictionary.ValueAtKey(t19,"out");
# ----------------------------------------
creator_2 = Python(IN[0]=code_block_17.x1)  # same code as creator
code_block_17 = CodeBlock(parameters=match_elements_and_filter_2.t20, elements=match_elements_and_filter_2.t18, creatornames=creator_2)
# ---------- code_block_17.designscript (15 lines) ----------
parameters;
t1=DSCore.List.Transpose(parameters);
t2=t1[2];
t3=DSCore.String.Replace(t2,"Type|","");
results = (Revit.Elements.Element.GetParameterValueByName(elements, t3))+"";
//Workset swap
x1=DSCore.List.Flatten(elements);
x2=DSCore.List.Count(elements<1L>);
creators=DSCore.List.Chop(creatornames,x2);
t6=t1[3]+"";
t7 = Revit.Elements.Element.Id(elements);
t8=DSCore.List.OfRepeatedItem(t3<1L>,x2<1L>);
t9=DSCore.List.OfRepeatedItem(t1[0]<1L>,x2<1L>);
t10=DSCore.List.OfRepeatedItem(t1[1]<1L>,x2<1L>);
typename=Revit.Elements.Element.GetParameterValueByName(x1,"Type Name");
# ----------------------------------------
string_from_object_4 = FromObject(obj=code_block_17.results)
test_list_against_regex_2 = Python(IN[0]=string_from_object_4, IN[1]=code_block_17.t6)  # same code as test_list_against_regex
code_block_18 = CodeBlock(category=code_block_17.t9, filter=code_block_17.t10, typename=code_block_17.typename, elementid=code_block_17.t7, Creatornames=code_block_17.creators, tests=code_block_17.t8, results=string_from_object_4, regex=test_list_against_regex_2)
# ---------- code_block_18.designscript (8 lines) ----------
categories=DSCore.List.Flatten(category);
filters=DSCore.List.Flatten(filter);
typenames=typename;
Elementids=DSCore.List.Flatten(elementid);
creators=DSCore.List.Flatten(Creatornames);
test=DSCore.List.Flatten(tests);
values=DSCore.List.Flatten(results);
passfail=DSCore.List.Flatten(regex);
# ----------------------------------------
list_create_2 = List.Create(item0=code_block_18.categories, item1=code_block_18.filters, item2=code_block_18.typenames, item3=code_block_18.Elementids, item4=code_block_18.creators, item5=code_block_18.test, item6=code_block_18.values, item7=code_block_18.passfail)

# group: Collate Element Results
code_block_19 = CodeBlock(x=list_create) { DSCore.List.Transpose(x); }
code_block_20 = CodeBlock(x=list_create_2) { DSCore.List.Transpose(x); }
code_block_21 = CodeBlock(a=code_block_19, b=code_block_20) { t1=DSCore.List.Flatten([a,b],1); t2=t1; }

code_block_22 = CodeBlock(data=code_block_21.t2) { str1 = DSCore.String.Replace(data+"", ",", " "); str1==null?data+"":str1+""; }

# group: Warnings
document_warnings = Python()
# ---------- document_warnings.python (64 lines) ----------
# 2019 Dynamik
# Mikael Santrolli
# mikael.santrolli@gmail.com

# Enable Python support and load DesignScript library

import clr
import sys

clr.AddReference('IronPython')
sys.path.append(r'C:\\Program Files (x86)\\IronPython 2.7\\Lib')

clr.AddReference('ProtoGeometry')
from Autodesk.DesignScript.Geometry import *

clr.AddReference('RevitAPI')
from Autodesk.Revit.DB import *

clr.AddReference("System")
from System.Collections.Generic import List

clr.AddReference('RevitNodes')
import Revit
clr.ImportExtensions(Revit.GeometryConversion)

clr.AddReference('RevitServices')
import RevitServices
from RevitServices.Persistence import DocumentManager
from RevitServices.Transactions import TransactionManager

from System.Collections.Generic import *
from collections import defaultdict


# Place your code below this line

doc = DocumentManager.Instance.CurrentDBDocument

warn = doc.GetWarnings()
elemId = []
elem = []
warndesc = []

for w in warn:

	warndesc.append(w.GetDescriptionText())
	elemId.append(w.GetFailingElements())
	
for e in elemId:
	el = []
	for i in e:
		el.append(doc.GetElement(i))
	elem.append(el)			
	
lst=zip(warndesc,elem)

d = defaultdict(list)
for k, v in lst:
	d[k].append(v)
	
errors = list(d.keys())
elgroups = list(d.values()) 

OUT = errors, elgroups
# ----------------------------------------
code_block_23 = CodeBlock(t4=document_warnings)
# ---------- code_block_23.designscript (13 lines) ----------
x = t4;
t1 = Get.ValueAtIndex(x, 0);
t2 = Get.ValueAtIndex(x, 1);
t5 = DSCore.List.IsEmpty(t2@L2<1L>);
t6 = DSCore.List.FilterByBoolMask(t1, t5);
t7 = DesignScript.ValueAtKey(t6, "in");
t8 = DesignScript.ValueAtKey(t6, "out");
t9 = DSCore.List.FilterByBoolMask(t2, t5);
t10 = DesignScript.ValueAtKey(t9, "in");
t11 = DesignScript.ValueAtKey(t9, "out");
a = t8;
b = t11;
t3 = [a, b];
# ----------------------------------------
string_from_object_5 = FromObject(obj=code_block_24.t8)
code_block_24 = CodeBlock(x=code_block_23.t3, strings=string_from_object_5)
# ---------- code_block_24.designscript (24 lines) ----------
t0=DSCore.List.Chop(x[0],1);
//Elements
t1=DSCore.List.DropItems(x,1);
t2=DSCore.List.Flatten(t1,1);
//duplicate warning names
t3=DSCore.List.Count(t2@@L2<2L>);
t4=DSCore.List.OfRepeatedItem(t0<1L>,t3<1L>);
t5=DSCore.List.Flatten(t4,1);
t6=DSCore.List.Flatten(t5<1L>,1);
//create warning numbers
t7=DSCore.List.Count(t6);
t8=1..t7;
strings;
//duplicate warning numbers
t9 = DSCore.String.PadLeft(strings, 4, "0");
t10 = DSCore.String.Insert(t9, 0, "Warning ");
t11=DSCore.List.Count(t6<1L>);
t11a=t11==0?1:t11;
t12=DSCore.List.OfRepeatedItem(t10<1L>,t11a<1L>);
//Flatten results
warningnumbers=DSCore.List.Flatten(t12);
Warningnames=DSCore.List.Flatten(t6);
elements=DSCore.List.Flatten(t2);
elementids=Revit.Elements.Element.Id(elements);
# ----------------------------------------
python_script_2 = Python(IN[0]=code_block_24.elements)
# ---------- python_script_2.python (19 lines) ----------
import clr
clr.AddReference('RevitAPI')
from Autodesk.Revit.DB import *

faminsts = IN[0]
elementlist = list()
for item in faminsts:
	try:
		n = UnwrapElement(item).Name
	except:
		n = None
	# Use a built-in property of (wrapped) Dynamo elements for family symbols instead
	if n == None:
		try:
			n = item.Name
		except:
			n = []
	elementlist.append(n)
OUT = elementlist
# ----------------------------------------
python_script_3 = Python(IN[0]=code_block_24.elements)  # same code as creator
code_block_25 = CodeBlock(a=code_block_24.warningnumbers, b=code_block_24.Warningnames, c=python_script_2, d=code_block_24.elementids, e=python_script_3) { t1=[a,b,c,d,e]; t2=DSCore.List.Transpose(t1); }

string_3 = StringInput("\n ")
code_block_26 = CodeBlock(data=code_block_25.t2, a=string_3)
# ---------- code_block_26.designscript (3 lines) ----------
str1 = DSCore.String.Replace(data+"", ",", " ");
str2 =DSCore.String.Replace(str1+"", a, " ");
str2==null?data+"":str1+"";
# ----------------------------------------
code_block_27 = CodeBlock(x=code_block_9) { t1=x[1]; t2=DSCore.List.Transpose(t1); t3=t2[0]; t4=t2[1]; dictionary1 = DesignScript.ByKeysValues(t3, t4); }
web_request = WebRequest(url=code_block_31.out0)
string_4 = StringInput("\"")

# group: Location
code_block_28 = CodeBlock(dictionary1=code_block_27.dictionary1) { t2 = DesignScript.ValueAtKey(dictionary1, "epsg.io Reference")+""; }
code_block_29 = CodeBlock { null; }
get_project_origin_basepoint_and = Python(IN[0]=code_block_29)  # "Get Project Origin, BasePoint and SurveyPoint"
# ---------- get_project_origin_basepoint_and.python (66 lines) ----------
#Alban de Chasteigner 2018
#twitter : @geniusloci_bim
#geniusloci.bim@gmail.com
#https://github.com/albandechasteigner/GeniusLociForDynamo

import clr
import math
clr.AddReference("RevitServices")
import RevitServices 
from RevitServices.Persistence import DocumentManager
uiapp = DocumentManager.Instance.CurrentUIApplication
app = uiapp.Application
version=int(app.VersionNumber)

clr.AddReference("RevitNodes")
import Revit
clr.ImportExtensions(Revit.GeometryConversion)

clr.AddReference("RevitAPI")
import Autodesk
from Autodesk.Revit.DB import *

inputdoc = UnwrapElement(IN[0]) if isinstance(IN[0],list) else [UnwrapElement(IN[0])]

#Inputdoc : Part of script by Andreas Dieckmann
if inputdoc[0] == None:
    doc = DocumentManager.Instance.CurrentDBDocument
elif isinstance(inputdoc[0],Document):
    doc = inputdoc[0]
elif isinstance(inputdoc[0],RevitLinkInstance):
    doc = inputdoc[0].GetLinkDocument()
else: doc = DocumentManager.Instance.CurrentDBDocument

angleUnit = Document.GetUnits(doc).GetFormatOptions(UnitType.UT_Angle).DisplayUnits

outProjBasePt, outProjSurvPt, outProjLoc = [],[],[]

pbp = FilteredElementCollector(doc).OfCategory(BuiltInCategory.OST_ProjectBasePoint).ToElements()
sbp = FilteredElementCollector(doc).OfCategory(BuiltInCategory.OST_SharedBasePoint).ToElements()

if version < 2018:
	projPos = doc.ActiveProjectLocation.get_ProjectPosition(XYZ(0,0,0))
else :
	projPos = doc.ActiveProjectLocation.GetProjectPosition(XYZ(0,0,0))
	
if version > 2019 and inputdoc != None :
	outProjBasePt = [pbp[0].SharedPosition.ToPoint(),abs(round(Autodesk.Revit.DB.UnitUtils.ConvertFromInternalUnits(projPos.Angle,angleUnit),6))]
	outProjSurvPt = sbp[0].SharedPosition.ToPoint()
else :
	pbpEW = pbp[0].get_Parameter(BuiltInParameter.BASEPOINT_EASTWEST_PARAM).AsDouble()
	pbpNS = pbp[0].get_Parameter(BuiltInParameter.BASEPOINT_NORTHSOUTH_PARAM).AsDouble()
	pbpElev = pbp[0].get_Parameter(BuiltInParameter.BASEPOINT_ELEVATION_PARAM).AsDouble()
	pbpAngle = pbp[0].get_Parameter(BuiltInParameter.BASEPOINT_ANGLETON_PARAM).AsDouble()*180/math.pi    
	outProjBasePt=[(XYZ(pbpEW,pbpNS,pbpElev)).ToPoint(),round(pbpAngle,6)]

	pspEW = sbp[0].get_Parameter(BuiltInParameter.BASEPOINT_EASTWEST_PARAM).AsDouble()
	pspNS = sbp[0].get_Parameter(BuiltInParameter.BASEPOINT_NORTHSOUTH_PARAM).AsDouble()
	pspElev = sbp[0].get_Parameter(BuiltInParameter.BASEPOINT_ELEVATION_PARAM).AsDouble()
	outProjSurvPt = XYZ(pspEW,pspNS,pspElev).ToPoint()
    	
if projPos == None:
	outProjLoc.append("No Project Position at origin point")
else:
	outProjLoc = XYZ(projPos.EastWest,projPos.NorthSouth,0).ToPoint()
	
OUT = outProjLoc, outProjBasePt, outProjSurvPt, doc.ActiveProjectLocation.Name
# ----------------------------------------
code_block_30 = CodeBlock(x=get_project_origin_basepoint_and)
# ---------- code_block_30.designscript (5 lines) ----------
t1=DSCore.List.Transpose([[x[0]],x[1],[x[2]]])[0];
t2=([DesignScript.Geometry.Point.X(t1),DesignScript.Geometry.Point.Y(t1),DesignScript.Geometry.Point.Z(t1)]);
x1=DSCore.List.Chop(t2[0]/1000+"",1);
y1=DSCore.List.Chop(t2[1]/1000+"",1);
z1=DSCore.List.Chop(t2[2]/1000+"",1);
# ----------------------------------------
code_block_31 = CodeBlock(A=code_block_28, x=code_block_30.x1, y=code_block_30.y1, web=web_request, split=string_4)
# ---------- code_block_31.designscript (5 lines) ----------
DSCore.String.Concat("http://epsg.io/trans?"+"&s_srs="+A+"&t_srs="+"4326"+"&x="+x+"&y="+y+"&format=json&trans=1&callback=jsonpFunction");
a1 = DSCore.String.Split(web, [split]);
a2=DSCore.List.Transpose(a1);
a3=["Revit Origin","Project Base Point","Survey Point"];
a4=DSCore.List.Flatten(DSCore.List.Transpose([a3,a2[3],a2[7],DSCore.String.ToNumber(x)*1000,DSCore.String.ToNumber(y)*1000])<1L>,1);
# ----------------------------------------
code_block_32 = CodeBlock()
# ---------- code_block_32.designscript (4 lines) ----------
b1=Revit.Elements.Category.ByName("Site - Project Base Point");
b2=Revit.Elements.Category.ByName("Site - Survey Point");
b3=[b1,b2];
elements=ElementQueries.OfCategory(b3);
# ----------------------------------------
code_block_33 = CodeBlock(x=code_block_32.elements) { Revit.Elements.Element.GetParameterValueByName(x<1L>,["Angle to True North"]<1L>); }
code_block_34 = CodeBlock(x=code_block_33) { x[0]; }
surveyPoint = Coordinates.SurveyPoint()
code_block_35 = CodeBlock(x=code_block_32.elements) { Revit.Elements.Element.GetParameterValueByName(x<1L>,["Elev"]<1L>); }
code_block_36 = CodeBlock(x=code_block_35) { x[1]; }
code_block_37 = CodeBlock(point1=surveyPoint, a=code_block_36) { z = DesignScript.Geometry.Point.Z(point1); a-z; }

# group: Sheet Naming
test_list_against_regex_3 = Python(IN[0]=[code_block_53.t5, code_block_53.t5], IN[1]=[code_block_53.t4, code_block_53.t4])
# ---------- test_list_against_regex_3.python (20 lines) ----------
import clr
import re

items = IN[0]
rep = ""
elementlist = list()
for item in items:
	if item is None: 
		item = rep
	elementlist.append(item)


regexstring = re.compile(IN[1])

def StartsWithRegex(regex, str):
	if regex.match(str): return "Pass"
	else: return "Fail"

if isinstance(elementlist, list): OUT = [StartsWithRegex(regexstring, x) for x in elementlist]
else: OUT = StartsWithRegex(regexsting, elementlist)
# ----------------------------------------

test_list_against_regex_4 = Python(IN[0]=code_block_53.A1, IN[1]=code_block_53.a2)  # same code as test_list_against_regex_3
code_block_38 = CodeBlock(elements=code_block_53.elements)
# ---------- code_block_38.designscript (2 lines) ----------
t0=Revit.Elements.Element.GetParameterValueByName(elements, "Sheet WIP Watermark")==1?"Yes":"No";
t1=t0=="Yes"?"Pass":"Fail";
# ----------------------------------------

# group: Rooms
creator_3 = Python(IN[0]=code_block_39.elements)  # same code as creator
worksets_2 = Python(IN[0]=code_block_39.elements)  # same code as worksets
string_from_object_6 = FromObject(obj=[code_block_39.c1, code_block_39.c1])
test_list_against_regex_5 = Python(IN[0]=string_from_object_6, IN[1]=[code_block_39.regex, code_block_39.regex, code_block_39.regex, code_block_39.regex])  # same code as test_list_against_regex
code_block_39 = CodeBlock(dictionary1=code_block_27.dictionary1, creator=creator_3, worksets=worksets_2, regexresults=test_list_against_regex_5)
# ---------- code_block_39.designscript (37 lines) ----------
//Get validation info from excel
regex =
[DesignScript.ValueAtKey(dictionary1, "Room Number"),
DesignScript.ValueAtKey(dictionary1, "Room Name"),
DesignScript.ValueAtKey(dictionary1, "Room Workset")];
t1=Category.ByName("Rooms");
elements=ElementQueries.OfCategory(t1);
t2= Revit.Elements.Element.Id(elements);
creator;
//Get Other Parameters
t3=["Number","Name","Area","Workset","Department"];
t4 = Revit.Elements.Element.GetParameterValueByName(elements<1>, t3<2>);
t5=DSCore.List.Transpose(t4);
//Number of checks
t6=4;
//Duplicate row Info
//parameters
t9=DSCore.List.Count(elements);
t10=DSCore.List.Flatten(DSCore.List.OfRepeatedItem(["Number","Name","Area","Workset"],t9));
//line info
repeatid=DSCore.List.Flatten(DSCore.List.Transpose(DSCore.List.OfRepeatedItem(t2,t6)));
repeatnumber=DSCore.List.Flatten(DSCore.List.Transpose(DSCore.List.OfRepeatedItem(t5[0],t6)));
repeatcreator=DSCore.List.Flatten(DSCore.List.Transpose(DSCore.List.OfRepeatedItem(creator,t6)));
repeatdepartment=DSCore.List.Flatten(DSCore.List.Transpose(DSCore.List.OfRepeatedItem(t5[4],t6)));
//Modify results
//Area
geometry1 = Revit.Elements.Element.GetLocation(elements);
b1=geometry1==null?"Not Placed":t5[2];
b2=b1=="";
b3=b2?"Not Enclosed":b1;
b4=DSCore.List.Flatten(DSCore.List.Transpose([t5[0],t5[1],b3,worksets]));
b5=b2?"Fail":"Pass";
//Data for Regex
c1=[t5[0],t5[1],worksets];
//merge tables
results=DSCore.List.Flatten(DSCore.List.Transpose([regexresults[0],regexresults[1],b5,regexresults[2]]));
results1=DSCore.List.Transpose([repeatnumber,repeatid,repeatcreator,repeatdepartment,t10,b4,results]);
# ----------------------------------------

code_block_40 = CodeBlock(data=code_block_39.results1) { str1 = DSCore.String.Replace(data+"", ",", " "); str1==null?data+"":str1+""; }

# group: Workset Naming
python_script_4 = Python()
# ---------- python_script_4.python (37 lines) ----------
# 2019 Dynamik
# Mikael Santrolli
# mikael.santrolli@gmail.com

# Enable Python support and load DesignScript library
import clr
clr.AddReference('ProtoGeometry')
from Autodesk.DesignScript.Geometry import *

clr.AddReference('RevitAPI')
from Autodesk.Revit.DB import *

clr.AddReference('RevitServices')
import RevitServices
from RevitServices.Persistence import DocumentManager
from RevitServices.Transactions import TransactionManager

# The inputs to this node will be stored as a list in the IN variables.
dataEnteringNode = IN

# Place your code below this line

doc = DocumentManager.Instance.CurrentDBDocument

collector = FilteredWorksetCollector(doc)
collector.OfKind(WorksetKind.UserWorkset)
worksets = collector.ToWorksets()

wnames = []

for w in worksets:
	wnames.append(w.Name)



# Assign your output to the OUT variable.
OUT = wnames
# ----------------------------------------
test_list_against_regex_6 = Python(IN[0]=code_block_41.a, IN[1]=code_block_41.t0)  # same code as test_list_against_regex_3
code_block_41 = CodeBlock(dictionary1=code_block_27.dictionary1, worksets=python_script_4, regex=test_list_against_regex_6)
# ---------- code_block_41.designscript (8 lines) ----------
t0=DesignScript.ValueAtKey(dictionary1, "Workset Naming");
a=worksets;
t1=a=="Shared Levels and Grids";
t2=a=="Workset1";
t4=a=="";
t3=t1||t2||t4;
t5=t3?"Pass":regex;
t6=DSCore.List.Transpose([worksets,t5]);
# ----------------------------------------

code_block_42 = CodeBlock(data=code_block_41.t6) { str1 = DSCore.String.Replace(data+"", ",", " "); str1==null?data+"":str1+""; }
code_block_43 = CodeBlock(dictionary1=code_block_27.dictionary1)
# ---------- code_block_43.designscript (6 lines) ----------
//ModelSuitability
t0=DesignScript.ValueAtKey(dictionary1, "Model Suitability");
//project Status
t1=DesignScript.ValueAtKey(dictionary1, "Project Status");
//copyright
t2=DesignScript.ValueAtKey(dictionary1, "Copyright");
# ----------------------------------------
code_block_44 = CodeBlock(a=revit_version) { a+""; }

# group: SplashScreen Parameters
code_block_45 = CodeBlock { t1=Category.ByName("OST_ProjectInformation"); ElementQueries.OfCategory(t1); }
code_block_46 = CodeBlock(t1=code_block_45.out1)
# ---------- code_block_46.designscript (11 lines) ----------
t2=["Project Name",
"Client Name",
"Project Address",
"Model Task Information Manager",
"Model Task Team Manager",
"Model Information Originator",
"Project Number"];
t3 = Revit.Elements.Element.GetParameterValueByName(t1<1L>, t2<1L>);
t4=["Project Status",
"Model Authoring Software Version","Model Copyright","Model Suitability"];
t5=Revit.Elements.Element.GetParameterValueByName(t1<1L>, t4<1L>);
# ----------------------------------------
string_5 = StringInput("""Address Line 1
Address Line 2
PostCode""")
code_block_47 = CodeBlock(address=string_5)
# ---------- code_block_47.designscript (6 lines) ----------
["Project Title (As US)",
"Client Name",
address,
"Director",
"Architect",
"Resources","3541"," "];
# ----------------------------------------
file_name_match_splashscreen = CodeBlock(t1=code_block_45.out1, t7=code_block_3.withoutfilestorestuff)  # "File Name Match splashscreen name"
# ---------- file_name_match_splashscreen.designscript (13 lines) ----------
t2=["Unique Project Code",
"Model Originator",
"Model Volume/System",
"Model Level",
"Model Type",
"Model Role",
"Model Number"];
t3 = Revit.Elements.Element.GetParameterValueByName(t1<1L>, t2<1L>);
t4 = DSCore.String.Join("-", [t3]);
t6 = DSCore.String.Split(t7, "_");
filename = Get.ValueAtIndex(DSCore.List.Flatten(t6), 0);
t5=t4==filename?"Pass":"Fail";
DSCore.List.Flatten(["Splashscreen Model Name Matches File Name",t4,t5]);
# ----------------------------------------

code_block_48 = CodeBlock(t1=code_block_3.c1, x=code_block_46.t3, y=code_block_3.withoutfilestorestuff) { t2 = DSCore.DateTime.Today; t3 = DSCore.DateTime.Format(t2, "yyMMdd"); t4 = "_"; t5=t1+t3+t4+x[6]+t4+y; }
code_block_49 = CodeBlock(a=code_block_48.t5) { a+"_ElementResults.csv"; }
exportCSV = Data.ExportCSV(filePath=code_block_49, data=code_block_22.out1)
code_block_50 = CodeBlock(a=code_block_48.t5) { a+"_Warnings.csv"; }
exportCSV_2 = Data.ExportCSV(filePath=code_block_50, data=code_block_26.out2)
code_block_51 = CodeBlock(a=code_block_48.t5) { a+"_Location.csv"; }
exportCSV_3 = Data.ExportCSV(filePath=code_block_51, data=code_block_31.a4)
code_block_52 = CodeBlock(a=code_block_48.t5) { a+"_Sheets.csv"; }
file_name_match_splashscreen_2 = CodeBlock(t1=code_block_45.out1, element1=[code_block_53.elements, code_block_53.elements], a=[code_block_53.t3, code_block_53.t3])  # "File Name Match splashscreen name"
# ---------- file_name_match_splashscreen_2.designscript (9 lines) ----------
t2=["Unique Project Code",
"Model Originator",
"Model Volume/System",
"Model Role"];
t3 = Revit.Elements.Element.GetParameterValueByName(t1<1L>, t2<1L>);
t4=t3[0]+"-"+t3[1]+"-"+t3[2]+"-";
t5=["Sheet Level","Sheet Drawing Type"];
t6=DSCore.List.Transpose(Revit.Elements.Element.GetParameterValueByName(element1<1>, t5<2>));
t7=t4+t6[0]+"-"+t6[1]+"-"+t3[3]+"-"+a;
# ----------------------------------------

# group (continued): Sheet Naming
test_list_against_regex_7 = Python(IN[0]=file_name_match_splashscreen_2.t7, IN[1]=code_block_53.t1)  # same code as test_list_against_regex_3
code_block_53 = CodeBlock(dictionary1=code_block_27.dictionary1, x=file_name_match_splashscreen_2.t7, numbercheck=test_list_against_regex_7, statuscheck=test_list_against_regex_3, POICheck=test_list_against_regex_4, wip=code_block_38.t0, wipcheck=code_block_38.t1)
# ---------- code_block_53.designscript (22 lines) ----------
a="Sheets";
b="Sheet Status";
c ="Purpose of Issue";
//Naming
t1= DesignScript.ValueAtKey(dictionary1, a);
t2=Category.ByName(a);
elements=ElementQueries.OfCategory(t2);
t3=Elements.Sheet.SheetNumber(elements);
//Status
t4=DesignScript.ValueAtKey(dictionary1, b);
t5=Revit.Elements.Element.GetParameterValueByName(elements, "Status");
a2=DesignScript.ValueAtKey(dictionary1, c);
A1=Revit.Elements.Element.GetParameterValueByName(elements, "Purpose of Issue");
//Revision
t6=Revit.Elements.Element.GetParameterValueByName(elements, "Current Revision");
t7=Revit.Elements.Element.GetParameterValueByName(elements, "Sheet Name");
t8=Revit.Elements.Element.GetParameterValueByName(elements, "Current Revision Issued By");
t9=Revit.Elements.Element.GetParameterValueByName(elements, "Current Revision Issued To");
t10=DSCore.List.Transpose([x,t7,t6,t5,A1,t8,t9,numbercheck,statuscheck,POICheck,wip,wipcheck]);
t11=DSCore.String.Contains(DSCore.List.Transpose(t10)[0],"-00000",0);
t12=DSCore.List.FilterByBoolMask(t10,t11);
t13=DesignScript.ValueAtKey(t12,"out");
# ----------------------------------------

code_block_54 = CodeBlock(data=code_block_53.t13) { str1 = DSCore.String.Replace(data+"", ",", " "); str1==null?data+"":str1+""; }
exportCSV_4 = Data.ExportCSV(filePath=code_block_52, data=code_block_54.out1)
code_block_55 = CodeBlock(a=code_block_48.t5) { a+"_Rooms.csv"; }
exportCSV_5 = Data.ExportCSV(filePath=code_block_55, data=code_block_40.out1)
code_block_56 = CodeBlock(a=code_block_48.t5) { a+"_Worksets.csv"; }
exportCSV_6 = Data.ExportCSV(filePath=code_block_56, data=code_block_42.out1)
code_block_57 = CodeBlock(a=code_block_48.t5) { a+"_Splashscreen.csv"; }
string_6 = StringInput("\n")
code_block_58 = CodeBlock { ""; }
replace = String.Replace(str=code_block_46.t3, searchFor=string_6, replaceWith=code_block_58)

# group (continued): SplashScreen Parameters
code_block_59 = CodeBlock(a=code_block_46.t3, b=code_block_47, y=code_block_46.t5, ps=code_block_43.t1, ms=code_block_43.t0, vs=code_block_44, cr=code_block_43.t2, z=code_block_46.t4, x=code_block_46.t2, a1=replace)
# ---------- code_block_59.designscript (11 lines) ----------
t1=a!=b;
t2=a!="";
t3=t1&&t2;
t4=t3?"Pass":"Fail";
projectstatus=y[0]==ps?"Pass":"Fail";
ModelSuit=y[3]==ms?"Pass":"Fail";
modelversion=y[1]==vs?"Pass":"Fail";
copyr=y[2]==cr?"Pass":"Fail";
t5=[DSCore.List.Transpose([z,y,[projectstatus,modelversion,copyr,projectstatus]]),
DSCore.List.Transpose([x,a1,t4])];
t6=DSCore.List.Flatten(t5,1);
# ----------------------------------------

model_revision = CodeBlock(a=code_block_53.t3, sheets=code_block_53.elements)
# ---------- model_revision.designscript (6 lines) ----------
t1=a=="00000";
t2=DSCore.List.FilterByBoolMask(sheets,t1);
t3=DesignScript.Dictionary.ValueAtKey(t2,"in");
t4=Revit.Elements.Element.GetParameterValueByName(t3,"Current Revision");
t5=t4!=""?"Pass":"Fail";
DSCore.List.Flatten(["Model Revision",t4,t5]);
# ----------------------------------------
python_script_5 = Python(IN[0]=code_block_3.b1)
# ---------- python_script_5.python (55 lines) ----------
import clr
clr.AddReference('ProtoGeometry')
from Autodesk.DesignScript.Geometry import *

# Import RevitAPI
clr.AddReference("RevitAPI")
import Autodesk
from Autodesk.Revit.DB import *

clr.AddReference("RevitServices")
import RevitServices
from RevitServices.Persistence import DocumentManager
from RevitServices.Transactions import TransactionManager

from System.Collections.Generic import *

clr.AddReference('RevitNodes')
import Revit
clr.ImportExtensions(Revit.Elements)
clr.ImportExtensions(Revit.GeometryConversion)

from System import Guid
import System
from System.IO import Directory, Path

import sys
pyt_path = r'C:\Program Files (x86)\IronPython 2.7\Lib'
sys.path.append(pyt_path)

import os
import datetime

doc = DocumentManager.Instance.CurrentDBDocument
uiapp = DocumentManager.Instance.CurrentUIApplication
app = uiapp.Application

if isinstance(IN[0],list):
	toggle = 0
	element = UnwrapElement(IN[0])
else:
	toggle = 1
	element = [UnwrapElement(IN[0])]

listout = []	
for x in element:
	try:
		edocuments = Path.GetFileName(ModelPathUtils.ConvertModelPathToUserVisiblePath(doc.GetWorksharingCentralModelPath()))
		listout.append(edocuments)
	except:
		listout.append(None)
#Assign your output to the OUT variable.
if toggle:
	OUT = edocuments
else:
	OUT = listout
# ----------------------------------------
centralFileSwap = CodeBlock(a=python_script_5, b=code_block_3.withfilestorestuff) { DSCore.List.IsEmpty(a)||a==""?DSCore.String.Replace(DSCore.String.Replace(b,".rvt",""),"_detached",""):DSCore.String.Replace(a,".rvt",""); }
code_block_60 = CodeBlock(x=centralFileSwap) { [[x]]; }
code_block_61 = CodeBlock(x=code_block_62.t0) { [x]; }
test_list_against_regex_8 = Python(IN[0]=code_block_60, IN[1]=code_block_61)  # same code as test_list_against_regex

# group: File Naming
code_block_62 = CodeBlock(dictionary1=code_block_27.dictionary1, filename=centralFileSwap, result=test_list_against_regex_8) { t0=DesignScript.ValueAtKey(dictionary1, "FileName"); t1=DSCore.List.Flatten(["File Name",filename,result]); }

combinePath = FileSystem.CombinePath(path0=code_block_3.b4)

# group: File Size
python_script_6 = Python(IN[0]=combinePath)
# ---------- python_script_6.python (24 lines) ----------
# Copyright(c) 2017, Dimitar Venkov
# @5devene, dimitar.ven@gmail.com
# www.badmonkeys.net

from System.IO import FileInfo

def tolist(x):
	if hasattr(x,'__iter__'): return x
	else : return [x]

def output(x):
	if len(x) == 1: return x[0]
	else : return x

paths = tolist(IN[0])
mb = 1048576.0
def getSize(p, mb=mb):
	sb = FileInfo(p).Length
	if sb < mb:
		return '%.3f' % (sb / mb)
	else:
		return '%.3f' % (sb / mb)

OUT = output(map(getSize, paths) )
# ----------------------------------------
code_block_63 = CodeBlock(dictionary1=code_block_27.dictionary1, python=python_script_6)
# ---------- code_block_63.designscript (5 lines) ----------
t0=DesignScript.ValueAtKey(dictionary1, "FileSize")+"";
t1=DSCore.String.ToNumber(t0);
t2=DSCore.String.ToNumber(python);
t3=t2<t1?"Pass":"Fail";
t4=["File Size",python,t3];
# ----------------------------------------

code_block_64 = CodeBlock(a=code_block_59.t6, b=model_revision.out5, e=code_block_62.t1, f=code_block_63.t4, g=file_name_match_splashscreen.out6) { t1=DSCore.List.Flatten([a,[b,e,f,g]],1); }
code_block_65 = CodeBlock(data=code_block_64) { str1 = DSCore.String.Replace(data+"", ",", " "); str1==null?data+"":str1+""; }
exportCSV_7 = Data.ExportCSV(filePath=code_block_57, data=code_block_65.out1)
code_block_66 = CodeBlock(a=code_block_48.t5) { a+"_DWGS.csv"; }
code_block_67 = CodeBlock { true; }
CADLinks = Python(IN[0]=code_block_67)
# ---------- CADLinks.python (64 lines) ----------
##Written By Thed Hogan

import clr

# Import RevitAPI
clr.AddReference("RevitAPI")
import Autodesk
from Autodesk.Revit.DB import *

# Import DocumentManager and TransactionManager
clr.AddReference("RevitServices")
import RevitServices
from RevitServices.Persistence import DocumentManager
from RevitServices.Transactions import TransactionManager

doc =  DocumentManager.Instance.CurrentDBDocument
app =  DocumentManager.Instance.CurrentUIApplication.Application

toggle = IN[0]

output = list()

outElement = list()
outName = list()
islink = list()



workset = list()
worksetID = list()
Status = list()
view = list()
viewspecific = list()
filelocation =list()
modellocation = list()

collector = FilteredElementCollector(doc).OfClass(CADLinkType)

if toggle == True:
	for i in sorted(collector, key = lambda object: Element.Name.GetValue(object)):
		if i.IsExternalFileReference():
			outName.append(Element.Name.GetValue(i))
			outElement.append(i)
			workset.append(doc.GetWorksetTable().GetWorkset(i.WorksetId).Name)
			worksetID.append(i.WorksetId)
			islink.append("True")
			Status.append("Check in Development")
			view.append("Check in Development")
			viewspecific.append("Check in Development")
			filelocation.append("Check in Development")
			modellocation.append("Check in Development")
			

output.append(outName)
output.append(islink)
output.append(Status)
output.append(viewspecific)
output.append(view)
output.append(workset)
output.append(filelocation)
output.append(modellocation)

#Assign your output to the OUT variable.
OUT = output
# ----------------------------------------
code_block_68 = CodeBlock(x=CADLinks) { DSCore.List.Transpose(x); }
CADImports = Python(IN[0]=code_block_67)
# ---------- CADImports.python (69 lines) ----------
##Written By Thed Hogan

import clr

# Import RevitAPI
clr.AddReference("RevitAPI")
import Autodesk
from Autodesk.Revit.DB import *

# Import DocumentManager and TransactionManager
clr.AddReference("RevitServices")
import RevitServices
from RevitServices.Persistence import DocumentManager
from RevitServices.Transactions import TransactionManager

doc =  DocumentManager.Instance.CurrentDBDocument
app =  DocumentManager.Instance.CurrentUIApplication.Application

toggle = IN[0]

output = list()

outElement = list()
outName = list()
outID = list()
creator = list()
editor = list()
workset = list()
worksetID = list()
Status = list()
islink = list()
view = list()
viewspecific = list()
filelocation =list()
modellocation = list()

collector = FilteredElementCollector(doc).OfClass(CADLinkType)

if toggle == True:
	for i in sorted(collector, key = lambda object: Element.Name.GetValue(object)):
		if i.IsExternalFileReference():
			continue
		else:
			outName.append(Element.Name.GetValue(i))
			outID.append(i.Id)
			outElement.append(i)
			creator.append(WorksharingUtils.GetWorksharingTooltipInfo(doc, UnwrapElement(i).Id).Creator)
			editor.append(WorksharingUtils.GetWorksharingTooltipInfo(doc, UnwrapElement(i).Id).LastChangedBy)
			workset.append(doc.GetWorksetTable().GetWorkset(i.WorksetId).Name)
			worksetID.append(i.WorksetId)
			islink.append("False")
			Status.append("Not a Link")
			view.append("Check in Development")
			viewspecific.append("Check in Development")
			filelocation.append("Not a Link")
			modellocation.append("Check in Development")

output.append(outName)
output.append(islink)
output.append(Status)
output.append(viewspecific)
output.append(view)
output.append(workset)
output.append(filelocation)
output.append(modellocation)


#Assign your output to the OUT variable.
OUT = output
# ----------------------------------------
code_block_69 = CodeBlock(x=CADImports) { DSCore.List.Transpose(x); }
code_block_70 = CodeBlock(a=code_block_68, b=code_block_69) { DSCore.List.Flatten([a,b],1); }
code_block_71 = CodeBlock(data=code_block_70) { str1 = DSCore.String.Replace(data+"", ",", " "); str1==null?data+"":str1+""; }
exportCSV_8 = Data.ExportCSV(filePath=code_block_66, data=code_block_71.out1)
code_block_72 = CodeBlock(a=code_block_48.t5) { a+"_Views.csv"; }

# group: Views
string_from_object_7 = FromObject(obj=code_block_73.views)
creator_4 = Python(IN[0]=code_block_73.t4)  # same code as creator
code_block_73 = CodeBlock(strings=string_from_object_7, creator=creator_4)
# ---------- code_block_73.designscript (42 lines) ----------
//intro
z0=Category.ByName("Views");
elements=ElementQueries.OfCategory(z0);
z1=DSCore.List.FilterByBoolMask(elements,elements==null);
views=DesignScript.Dictionary.ValueAtKey(z1,"out");
//Filter Out Legends
legends = DSCore.String.Contains(strings,"legend(",true)?true:false;
nonviews=Revit.Elements.Element.GetParameterValueByName(views,"View Name");
nonviewsfilter=nonviews=="";
filterboth= legends||nonviewsfilter;
t3=DSCore.List.FilterByBoolMask(views,filterboth);
t4 = DesignScript.Dictionary.ValueAtKey(t3, "out");
//Get Test Parameters
instanceparameters=["View Name","Sheet Name","Dependency","Type","Sheet Number"];
t5 = Revit.Elements.Element.GetParameterValueByName(t4<1L>,instanceparameters);
t6=DSCore.List.Transpose(t5);
t7=Revit.Elements.Element.Id(t4);
//Name Contains Copy
a0=DSCore.String.Contains(t6[0],"copy",true);
a1=a0?"Fail":"Pass";
//ZZ views on sheets
b0=Revit.Elements.Element.GetParameterValueByName(t6[3],"Type Name");
b1=DSCore.String.Contains(b0,"ZZ",true);
b2=t6[1]!="";
b3=b1&&b2?"Fail":"Pass";
//non master views on sheets
c0=t6[2];
c1=c0!="Primary";
c2=c1&&!b2&&!b1?"Fail":"Pass";
//Combine Sheet info
x1 = DSCore.String.Join("-", DSCore.List.Transpose([t6[4], t6[1]]));
//Order results
d1=DSCore.List.Flatten(DSCore.List.Transpose([a1,b3,c2]));
d2=["Name Contains Copy","ZZ Views on sheets","Non ZZ Views not on Sheets"];
d3=DSCore.List.Count(t4);
d4=DSCore.List.Flatten(DSCore.List.OfRepeatedItem(d2,d3));
d5=DSCore.List.Flatten(DSCore.List.Transpose(DSCore.List.OfRepeatedItem(t6[0],3)));
d6=DSCore.List.Flatten(DSCore.List.Transpose(DSCore.List.OfRepeatedItem(b0,3)));
d7=DSCore.List.Flatten(DSCore.List.Transpose(DSCore.List.OfRepeatedItem(creator,3)));
d8=DSCore.List.Flatten(DSCore.List.Transpose(DSCore.List.OfRepeatedItem(x1,3)));
d9=DSCore.List.Flatten(DSCore.List.Transpose(DSCore.List.OfRepeatedItem(t7,3)));
d10=DSCore.List.Transpose([d5,d9,d6,d7,d8,d4,d1]);
# ----------------------------------------

code_block_74 = CodeBlock(data=code_block_73.d10) { str1 = DSCore.String.Replace(data+"", ",", " "); str1==null?data+"":str1+""; }
exportCSV_9 = Data.ExportCSV(filePath=code_block_72, data=code_block_74.out1)
code_block_75 = CodeBlock(a=code_block_48.t5) { a+"_UnusedElements.csv"; }

# group: Line Styles and Patterns
python_script_7 = Python()
# ---------- python_script_7.python (13 lines) ----------
import clr
clr.AddReference('RevitAPI')
from Autodesk.Revit.DB import *
import Autodesk
clr.AddReference('RevitNodes')
import Revit
clr.ImportExtensions(Revit.Elements)
import System.Reflection
import System.AppDomain

rAssembly = [x for x in System.AppDomain.CurrentDomain.GetAssemblies() if x.GetName().Name == 'RevitAPI'][0]
rElement = [x for x in rAssembly.GetTypes() if x.Name == 'Element' and x.Namespace == 'Autodesk.Revit.DB'][0]
OUT = [x for x in rAssembly.GetTypes() if x.IsClass and x.Namespace == 'Autodesk.Revit.DB' and x.IsSubclassOf(rElement)]
# ----------------------------------------
line_style = Python()
# ---------- line_style.python (42 lines) ----------
#Copyright(c) 2015, Konrad Sobon
# @arch_laboratory, http://archi-lab.net

import clr
clr.AddReference('ProtoGeometry')
from Autodesk.DesignScript.Geometry import *

# Import DocumentManager and TransactionManager
clr.AddReference("RevitServices")
import RevitServices
from RevitServices.Persistence import DocumentManager

# Import RevitAPI
clr.AddReference("RevitAPI")
import Autodesk
from Autodesk.Revit.DB import *

doc = DocumentManager.Instance.CurrentDBDocument

import sys
pyt_path = r'C:\Program Files (x86)\IronPython 2.7\Lib'
sys.path.append(pyt_path)

#The inputs to this node will be stored as a list in the IN variable.
dataEnteringNode = IN

try:
	errorReport = None
	cat = Category.GetCategory(doc, BuiltInCategory.OST_Lines)
	gs = cat.GetGraphicsStyle(GraphicsStyleType.Projection)
	gsCat = gs.GraphicsStyleCategory.SubCategories
	dataOut = [i.GetGraphicsStyle(GraphicsStyleType.Projection) for i in gsCat]
except:
	# if error accurs anywhere in the process catch it
	import traceback
	errorReport = traceback.format_exc()

#Assign your output to the OUT variable
if errorReport == None:
	OUT = dataOut
else:
	OUT = errorReport
# ----------------------------------------
test_list_against_regex_9 = Python(IN[0]=code_block_76.a1, IN[1]=code_block_76.a0)  # same code as test_list_against_regex_3
all_elements_of_type = ElementsOfType(element_type=code_block_76.b2)
test_list_against_regex_10 = Python(IN[0]=code_block_76.b3, IN[1]=code_block_76.bx)  # same code as test_list_against_regex_3
code_block_76 = CodeBlock(dictionary1=code_block_27.dictionary1, linestyles=line_style, lnregex=test_list_against_regex_9, x=python_script_7, patternelements=all_elements_of_type, ptregex=test_list_against_regex_10)
# ---------- code_block_76.designscript (16 lines) ----------
//linestyles
a0=DesignScript.ValueAtKey(dictionary1, "LineStyles");
a1=Revit.Elements.Element.Name(linestyles);
a2=DSCore.List.Flatten(DSCore.List.OfRepeatedItem("Line Styles",DSCore.List.Count(linestyles)));
a3=DSCore.List.Transpose([a2,a1,lnregex]);
//linepatterns
bx=DesignScript.ValueAtKey(dictionary1, "LinePatterns");
b0=DSCore.String.Contains((x+""),"LinePatternElement");
b1=DSCore.List.FilterByBoolMask(x,b0);
b2=DesignScript.Dictionary.ValueAtKey(b1,"in");
ba=DSCore.List.Flatten(patternelements);
b3=Revit.Elements.Element.Name(ba);
b4=DSCore.List.Flatten(DSCore.List.OfRepeatedItem("Line Patterns",DSCore.List.Count(ba)));
b5=DSCore.List.Transpose([b4,b3,ptregex]);
//combine results;
c0=DSCore.List.Flatten([a3,b5],1);
# ----------------------------------------

# group: Unused Types
code_block_77 = CodeBlock(x=python_script_7)
# ---------- code_block_77.designscript (3 lines) ----------
filter=DSCore.String.Contains((x+""),"FamilyInstance");
t1=DSCore.List.FilterByBoolMask(x,filter);
DesignScript.Dictionary.ValueAtKey(t1,"in");
# ----------------------------------------
all_elements_of_type_2 = ElementsOfType(element_type=code_block_77.out2)
python_script_8 = Python()  # unwired: IN[0]
# ---------- python_script_8.python (20 lines) ----------
#Made by Marc Tavenier @marctavenier
import clr
clr.AddReference('RevitAPI')
from Autodesk.Revit.DB import *

clr.AddReference('RevitServices')
import RevitServices
from RevitServices.Persistence import DocumentManager

#The inputs to this node will be stored as a list in the IN variable.
dataEnteringNode = IN

elementlist = []
doc = DocumentManager.Instance.CurrentDBDocument

collector = FilteredElementCollector(doc).OfClass(Family)
elementlist = collector.ToElements()

#Assign your output to the OUT variable
OUT = elementlist
# ----------------------------------------
creator_5 = Python(IN[0]=code_block_78.t5)  # same code as creator
code_block_78 = CodeBlock(x=all_elements_of_type_2, y=python_script_8, creator=creator_5)
# ---------- code_block_78.designscript (8 lines) ----------
t2=DSCore.List.UniqueItems(DSCore.List.Flatten(x));
t3= DSCore.List.Flatten(Revit.Elements.Element.ElementType(t2));
t4= DSCore.List.Flatten(Family.Types(y));
t5 = DSCore.List.SetDifference(t4, t3);
t6 = Revit.Elements.Element.GetParameterValueByName(t5, "Type Name");
t7=Revit.Elements.Element.Id(t5);
x1=Revit.Elements.Element.GetCategory(t5);
t8=DSCore.List.Transpose([t6,x1,creator,t7]);
# ----------------------------------------

code_block_79 = CodeBlock(data=code_block_78.t8) { str1 = DSCore.String.Replace(data+"", ",", " "); str1==null?data+"":str1+""; }
exportCSV_10 = Data.ExportCSV(filePath=code_block_75, data=code_block_79.out1)
code_block_80 = CodeBlock(a=code_block_48.t5) { a+"_SharedParameters.csv"; }

# group: Shared Parameters
code_block_81 = CodeBlock(dictionary1=code_block_27.dictionary1) { DesignScript.ValueAtKey(dictionary1, "SharedParameters"); true; null; }
python_script_9 = Python(IN[0]=code_block_81.out1, IN[1]=code_block_81.out2)
# ---------- python_script_9.python (59 lines) ----------
import clr
clr.AddReference('RevitAPI')
from Autodesk.Revit.DB import *
import Autodesk

clr.AddReference("RevitNodes")
import Revit
clr.ImportExtensions(Revit.Elements)

clr.AddReference("RevitServices")
import RevitServices
from RevitServices.Persistence import DocumentManager

inputdoc = UnwrapElement(IN[1])
if inputdoc == None:
	doc = DocumentManager.Instance.CurrentDBDocument
elif inputdoc.GetType().ToString() == "Autodesk.Revit.DB.RevitLinkInstance":
	doc = inputdoc.GetLinkDocument()
elif inputdoc.GetType().ToString() == "Autodesk.Revit.DB.Document":
	doc = inputdoc
else: doc = None

names = []
cats = []
vag = []
pgs = []
pts = []
uts = []
isvis = []
elems = []
guids = []
isinst = []
iterator = doc.ParameterBindings.ForwardIterator()
while iterator.MoveNext():
	vag.append(iterator.Key.VariesAcrossGroups)
	names.append(iterator.Key.Name)
	pgs.append(iterator.Key.ParameterGroup)
	pts.append(iterator.Key.ParameterType)
	uts.append(iterator.Key.UnitType)
	isvis.append(iterator.Key.Visible)
	elem = doc.GetElement(iterator.Key.Id)
	elems.append(elem)
	if elem.GetType().ToString() == 'Autodesk.Revit.DB.SharedParameterElement':
		guids.append(elem.GuidValue)
	else: guids.append(None)
	if iterator.Current.GetType().ToString() == 'Autodesk.Revit.DB.InstanceBinding':
		isinst.append(True)
	else:
		isinst.append(False)
	thesecats = []
	for cat in iterator.Current.Categories:
		try:
			thesecats.append(Revit.Elements.Category.ById(cat.Id.IntegerValue))
		except:
			# Return null if category is not supported by Dynamo
			# This way the user knows there are unsupported categories assigned
			thesecats.append(None)
	cats.append(thesecats)
OUT = (names,cats,vag, pgs, pts, uts, isvis, elems, guids, isinst)
# ----------------------------------------
code_block_82 = CodeBlock(x=python_script_9) { x[8]; }
string_from_object_8 = FromObject(obj=code_block_82)
file_from_path_2 = FileObject(path=code_block_81.out0)
code_block_83 = CodeBlock(t1=string_from_object_8, x=python_script_9, t4=file_from_path_2)
# ---------- code_block_83.designscript (10 lines) ----------
t1;
t2 = DSCore.String.Contains(x[0]<1L>, "SR ", false);
t3 = DSCore.List.FilterByBoolMask(x[0], t2);
t5 = DesignScript.Dictionary.ValueAtKey(t3, "out");
t6 = DSCore.List.FilterByBoolMask(t1, t2);
t7 = DesignScript.Dictionary.ValueAtKey(t6, "out");
t8 = FileSystem.ReadText(t4);
t9 = DSCore.String.Contains(t8<1L>, t7<1L>, false);
t10=t9?"Pass":"Fail";
list=DSCore.List.Transpose([t5,t7,t10]);
# ----------------------------------------

code_block_84 = CodeBlock(data=code_block_83.list) { str1 = DSCore.String.Replace(data+"", ",", " "); str1==null?data+"":str1+""; }
exportCSV_11 = Data.ExportCSV(filePath=code_block_80, data=code_block_84.out1)
code_block_85 = CodeBlock(a=code_block_48.t5) { a+"_LineStyles.csv"; }
code_block_86 = CodeBlock(data=code_block_76.c0) { str1 = DSCore.String.Replace(data+"", ",", " "); str1==null?data+"":str1+""; }
exportCSV_12 = Data.ExportCSV(filePath=code_block_85, data=code_block_86.out1)
code_block_87 = CodeBlock(a=code_block_48.t5) { a+"_Material.csv"; }

# group: Materials
code_block_88 = CodeBlock()
# ---------- code_block_88.designscript (10 lines) ----------
["Analytical Floor Surface",
"Analytical Slab Surface",
"Analytical Wall Surface",
"Default",
"Default Light Source",
"Default Roof",
"Default Wall",
"Dynamo",
"Dynamo Error",
"Poche"];
# ----------------------------------------
test_list_against_regex_11 = Python(IN[0]=code_block_89.c1, IN[1]=code_block_89.xx)  # same code as test_list_against_regex_3
code_block_89 = CodeBlock(dictionary1=code_block_27.dictionary1, element1=code_block_11.elements, strings=code_block_88, regex=test_list_against_regex_11)
# ---------- code_block_89.designscript (23 lines) ----------
//material name regex
xx=DesignScript.ValueAtKey(dictionary1, "Material Naming");
//Materials of placed objects
t0=DSCore.List.Flatten(Revit.Elements.Element.GetMaterials(element1, false));
t1=DSCore.List.UniqueItems(t0);
t2=Material.Name(t1);
//all materials
a0=Category.ByName("Materials");
a1=ElementQueries.OfCategory(a0);
a2=Material.Name(a1);
//filter default materials
c0=DSCore.List.IndexOf(a2,strings);
c1=DSCore.List.RemoveItemAtIndex(a2,c0);
//Material Used
b0=DSCore.List.IndexOf(t2,c1);
b1=b0==-1?"Fail":"Pass";
//Repeat Parameters
d0=DSCore.List.Flatten(DSCore.List.OfRepeatedItem(["Is Used","Naming"],DSCore.List.Count(c1)));
d1=DSCore.List.Flatten(DSCore.List.Transpose(DSCore.List.OfRepeatedItem(c1,2)));
//Combine results
e0=DSCore.List.Flatten(DSCore.List.Transpose([b1,regex]));
//creat list
f0=DSCore.List.Transpose([d1,d0,e0]);
# ----------------------------------------

code_block_90 = CodeBlock(data=code_block_89.f0) { str1 = DSCore.String.Replace(data+"", ",", " "); str1==null?data+"":str1+""; }
exportCSV_13 = Data.ExportCSV(filePath=code_block_87, data=code_block_90.out1)
code_block_91 = CodeBlock { InputName: string = ""; }
code_block_92 = CodeBlock(element=code_block_22.out1, warning=code_block_26.out2, location=code_block_31.a4, sheet=code_block_54.out1, room=code_block_40.out1, workset=code_block_42.out1, splashscreen=code_block_65.out1, dwg=code_block_71.out1, views=code_block_74.out1, uelements=code_block_79.out1, parameter=code_block_84.out1, line=code_block_86.out1, material=code_block_90.out1)
# ---------- code_block_92.designscript (14 lines) ----------
["Exported " + DSCore.List.Count(element)+ " Element rows",
"Exported " + DSCore.List.Count(warning)+" Warning rows",
"Exported " + DSCore.List.Count(location)+" Location rows",
"Exported " + DSCore.List.Count(sheet)+" Sheet rows",
"Exported " + DSCore.List.Count(room)+" Room rows",
"Exported " + DSCore.List.Count(workset)+" Workset rows",
"Exported " + DSCore.List.Count(splashscreen)+" Splashscreem rows",
"Exported " + DSCore.List.Count(dwg)+" DWG rows",
"Exported " + DSCore.List.Count(views)+" view rows",
"Exported " + DSCore.List.Count(uelements)+" Unused Element rows",
"Exported " + DSCore.List.Count(parameter)+" Parameter rows",
"Exported " + DSCore.List.Count(line)+" Line rows",
"Exported " + DSCore.List.Count(material)+" Material rows"
];
# ----------------------------------------
code_block_93 = CodeBlock(x=code_block_92) { 0..DSCore.List.Count(x); }
code_block_94 = CodeBlock { Height_optionnal: int = 200; }
code_block_95 = CodeBlock()
# ---------- code_block_95.designscript (2 lines) ----------
/* If set to true, clicking elements of the listview will highlight them in a view like Dynamo's watch node*/
HilightInView_optionnal: bool = false;
# ----------------------------------------
code_block_96 = CodeBlock { true; }
code_block_97 = CodeBlock()
# ---------- code_block_97.designscript (2 lines) ----------
/* Will display the number of elements underneath the input name*/
ShowElementCount_optionnal: bool = false;
# ----------------------------------------
code_block_98 = CodeBlock { DefaultValueIndices_optionnal: int[] = DSCore.List.Empty; }
code_block_99 = CodeBlock()
# ---------- code_block_99.designscript (2 lines) ----------
/* Determines wether the ListView items are sorted or not*/
SortItems_optionnal: bool = true;
# ----------------------------------------
code_block_100 = CodeBlock()
# ---------- code_block_100.designscript (2 lines) ----------
/* Warning: disabling this will cause the listview input creation to fail in case there are elements with the same name*/
ShowId_optionnal: bool = true;
# ----------------------------------------
python_script_10 = Python(IN[0]=code_block_91, IN[1]=code_block_92, IN[2]=code_block_93, IN[3]=code_block_94, IN[4]=code_block_95, IN[5]=code_block_96, IN[6]=code_block_97, IN[7]=code_block_98, IN[8]=code_block_99, IN[9]=code_block_100)
# ---------- python_script_10.python (74 lines) ----------
#Copyright (c) mostafa el ayoubi ,  2016
#Data-Shapes www.data-shapes.net , elayoubi.mostafa@gmail.com

class listview():

    def __init__(self,inputname,height,highlight,display_mode,element_count,default_values,sorted,showId):
        self.inputname = inputname
        self.height = height
        self.highlight = highlight
        self.display_mode = display_mode
        self.element_count = element_count
        self.default_values = default_values
        self.sorted = sorted
        self.showId = showId

    def __setitem__(self, key, item):
        self.__dict__[key] = item

    def __getitem__(self, key):
        return self.__dict__[key]

    def __iter__(self):
        return iter(self.__dict__)

    def values(self):
        return self.__dict__.values()

    def keys(self):
        return self.__dict__.keys()

    def __repr__(self):
        return 'UI.ListView input'

if isinstance(IN[1],list):
	in1 = IN[1]
else:
	in1 = [IN[1]]

if isinstance(IN[2],list):
	in2 = IN[2]
else:
	in2 = [IN[2]]

if IN[6]:
	element_count = len(in1)
else:
	element_count = 0

x = listview(IN[0],IN[3],IN[4],IN[5],element_count,IN[7],IN[8],IN[9])

for k,v in zip(in1,in2):
	if x.showId :
		try:
			try:
				x[str(k)+ '  -  id: ' + str(v.Id)] = v
			except:
				x[k.encode('utf-8').decode('utf-8') + '  -  id: ' + str(v.Id)] = v
		except:
			try:
				x[str(k)] = v
			except:
				x[k.encode('utf-8').decode('utf-8')] = v
	else:
		try:
			try:
				x[str(k)] = v
			except:
				x[k.encode('utf-8').decode('utf-8')] = v
		except:
			try:
				x[str(k)] = v
			except:
				x[k.encode('utf-8').decode('utf-8')] = v
OUT = x
# ----------------------------------------
end = Revit.Transaction.Transaction.End(input=python_script_10)
start = Revit.Transaction.Transaction.Start(input=end)
code_block_101 = CodeBlock { "Finish"; }
boolean = BoolSelector(true)
code_block_102 = CodeBlock { Description_optional: string = "Once Finshed, Please open the dashboard and click refresh"; }
string_7 = StringInput("\\hm\filestore\Reference\Internal\ReferenceGraphics\HM Branding 2019\HM Master Assets\LOGO\HM_Logos\SCREEN\SOLID\HM_Logo_Colour_03.png")
code_block_103 = CodeBlock(t3=code_block_3.c1) { t1 = DSCore.String.Substring(t3, 0, 69); }
directory_from_path = DirectoryObject(path=code_block_103)
getDirectoryContents = FileSystem.GetDirectoryContents(directory=directory_from_path)
code_block_104 = CodeBlock { ".pbix"; }
contains = String.Contains(str=getDirectoryContents.files, searchFor=code_block_104)
filterByBoolMask = List.FilterByBoolMask(list=getDirectoryContents.files, mask=contains)
code_block_105 = CodeBlock(x=filterByBoolMask.in) { x[0][0]; }
string_8 = StringInput("\\hm\filestore\Resource\Revit\HM Audit\AutomatedAudit\Project\3541_RevitAudit.pbit")
code_block_106 = CodeBlock(a=code_block_105, b=string_8) { a==null?b+"":a+""; }
code_block_107 = CodeBlock()
# ---------- code_block_107.designscript (2 lines) ----------
/* Cancel button will only be displayed if a label text is entered here*/
CancelButtonText_optional: string = null;
# ----------------------------------------
code_block_108 = CodeBlock { MaxHeight_optional: int = 0; }
code_block_109 = CodeBlock { Width_optional: int = 0; }
code_block_110 = CodeBlock { LabelWidth_optional: int = 0; }
python_script_11 = Python(IN[0]=start, IN[1]=code_block_101, IN[2]=boolean, IN[3]=code_block_102, IN[4]=string_7, IN[5]=code_block_106, IN[6]=code_block_107, IN[7]=code_block_108, IN[8]=code_block_109, IN[9]=code_block_110)
# ---------- python_script_11.python (2730 lines) ----------
#Copyright (c) Data Shapes,  2020
#Data-Shapes www.data-shapes.io , elayoubi.mostafa@data-shapes.io @data_shapes
	
import clr
import sys
pyt_path = r'C:\Program Files (x86)\IronPython 2.7\Lib'
sys.path.append(pyt_path)
import os
import webbrowser
import unicodedata
import io
import tempfile
import System
	
try:
	clr.AddReference('System.Windows.Forms')
	clr.AddReference('System.Drawing')
	clr.AddReference('System.Windows.Forms.DataVisualization')
	
	from System.Drawing import Point , Size , Graphics, Bitmap, Image, Font, FontStyle, Icon, Color, Region , Rectangle , ContentAlignment , SystemFonts, FontFamily
	from System.Windows.Forms import Application, DockStyle, Button, Form, Label, TrackBar , ToolTip, ColumnHeader, TextBox, CheckBox, FolderBrowserDialog, OpenFileDialog, DialogResult, ComboBox, FormBorderStyle, FormStartPosition, ListView, ListViewItem , SortOrder, Panel, ImageLayout, GroupBox, RadioButton, BorderStyle, PictureBox, PictureBoxSizeMode, LinkLabel, CheckState, ColumnHeaderStyle , ImageList, VScrollBar, DataGridView, DataGridViewSelectionMode, DataGridViewAutoSizeColumnsMode , DataGridViewClipboardCopyMode , TreeView , TreeNode , TreeNodeCollection , AutoScaleMode , Screen, Padding
	from System.Windows.Forms.DataVisualization.Charting import *#Chart , SeriesChartType
	from System.Collections.Generic import *
	from System.Collections.Generic import List as iList
	from System.Windows.Forms import View as vi
	clr.AddReference('System')
	from System import IntPtr , Char
	from System import Type as SType, IO
	from System import Array
	from System.ComponentModel import Container
	clr.AddReference('System.Data')
	from System.Data import DataTable , DataView

	try: #try to import All Revit dependencies
		clr.AddReference('RevitAPIUI')
		from  Autodesk.Revit.UI import Selection , TaskDialog 
		from  Autodesk.Revit.UI.Selection import ISelectionFilter
		clr.AddReference('RevitNodes')
		import Revit
		clr.ImportExtensions(Revit.Elements)
		clr.ImportExtensions(Revit.GeometryConversion)
		
		clr.AddReference('RevitServices')
		from RevitServices.Persistence import DocumentManager
		doc = DocumentManager.Instance.CurrentDBDocument
		uidoc = DocumentManager.Instance.CurrentUIApplication.ActiveUIDocument
	
		clr.AddReference('RevitAPI')
		try:
			from Autodesk.Revit.DB import ImageImportOptions	
		except:
			from Autodesk.Revit.DB import ImageTypeOptions , ImageType, ImagePlacementOptions , ImageInstance
		from Autodesk.Revit.DB import FilteredElementCollector , Transaction, View , ViewType , ViewFamily, ViewDrafting, ViewFamilyType, Element, ElementId , FamilyInstance , Document , XYZ, BoxPlacement, UnitUtils
		
		try:
			from Autodesk.Revit.DB import  UnitType
		except:
			from Autodesk.Revit.DB import SpecTypeId

		dbviews = [v for v in FilteredElementCollector(doc).OfClass(View).ToElements() if (v.ViewType == ViewType.FloorPlan or v.ViewType == ViewType.CeilingPlan or v.ViewType == ViewType.Section or v.ViewType == ViewType.Elevation or v.ViewType == ViewType.ThreeD)]
		viewindex = 0
		try:
			UIunit = Document.GetUnits(doc).GetFormatOptions(UnitType.UT_Length).DisplayUnits
		except:
			UIunit = Document.GetUnits(doc).GetFormatOptions(SpecTypeId.Length).GetUnitTypeId()
			
		class selectionfilter(ISelectionFilter):
			def __init__(self,category):
				self.category = category
			def AllowElement(self,element):
				if element.Category.Name in [c.Name for c in self.category]:
					return True
				else:
					return False
			def AllowReference(reference,point):
				return False


			
	except: #in case we are in the Sandbox, Formit or Civil 3D environment
		pass
	
	importcolorselection = 0
	
	try:
		from  Autodesk.Revit.UI import ColorSelectionDialog
	except:
		importcolorselection = 1
	

	
	clr.AddReference('ProtoGeometry')
	from Autodesk.DesignScript.Geometry import Point as dsPoint

	from System.Reflection import Assembly
	import xml.etree.ElementTree as et
	

	
	import re	
	def regexEndNum(input):
		try:
			return 	re.search('(\d+)$', input).group(0)
		except:
			return ""

	def iterateThroughNodes(collection,li):
		if hasattr(collection,'Nodes'):
			ntest = collection.Nodes
			if len(ntest) > 0:
				for i in ntest:
					iterateThroughNodes(i,li)
			else:
				if collection.Checked:
					li.append(collection.Tag)
		return li
		

	
	class MultiTextBoxForm(Form):
		
	    def __init__(self):
	        self.Text = 'HM Audit Tool'
	        self.output = []
	        self.values = []
	        self.cancelled = False
	
	    def setclose(self, sender, event):
	    	cbindexread = 0
	    	if sender.Name != "Cancel":
	    		for f in self.output:
	    			if f.GetType() == myTextBox:
	    				if f._isNum :
	    					val = float(f.Text)
	    				else:
	    					val = f.Text
	    				self.values.append(val)
	    			if f.GetType() == CheckBox:
	    				self.values.append(f.Checked)
	    			if f.GetType() == Button:
	    				if isinstance(f.Tag ,list):
	    					try:
	    						self.values.append([e for e in f.Tag if e.__class__.__name__ != "Category"])	    					
	    					except:
	    						self.values.append(f.Tag)	    					
	    				else:
	    					try:	    				
	    						if f.Tag.__class__.__name__ != "Category":
	    							self.values.append(f.Tag)
	    						else:
    								self.values.append([])
	    					except:
	    						self.values.append(f.Tag)	
	    			if f.GetType() == ComboBox:
	    				try:
	    					key = f.Text
	    					self.values.append(f.Tag[key])
	    				except:
	    					self.values.append(None)
	    			if f.GetType() == mylistview:
	    				self.values.append([f.Values[i.Text] for i in f.CheckedItems])
	    			if f.GetType() == mytrackbar:
	    				self.values.append(f.startval+f.Value*f.step)
	    			if f.GetType() == mygroupbox:
	    				try:
	    					key = [j.Text for j in f.Controls if j.Checked == True][0]
	    					self.values.append(f.Tag[key])
	    				except:
	    					self.values.append(None)
	    			if f.GetType() == myDataGridView:
	    				f.EndEdit()
	    				dsrc = f.DataSource
	    				out = []
	    				colcount = f.ColumnCount
	    				rowcount = f.RowCount - 1
	    				if f.Tag:
		    				l = []
	    					for i in range(colcount):	    						
	    						l.append(dsrc.Columns[i].ColumnName)
	    					out.append(l)	    						
		    				for r in range(rowcount):
		    					l = []
		    					for i in range(colcount):
		    						l.append(dsrc.DefaultView[r].Row[i])
		    					out.append(l)
	    				else: 
		    				for r in range(rowcount):
		    					l = []
		    					for i in range(colcount):
		    						l.append(dsrc.DefaultView[r].Row[i])
		    					out.append(l)
	    				self.values.append(out)
	    			if f.GetType() == TreeView:
	    				ls = []
	    				nds = f.Nodes[0]
	    				iterateThroughNodes(nds,ls)
	    				self.values.append(ls)
	    			if f.GetType() == GroupBox:
	    				rb = [c for c in f.Controls if c.GetType() == RadioButton and c.Checked][0]
	    				self.values.append(rb.Text)
	    				f.Controls.Remove(rb)
	    	else:
	    		self.values = None
	    		self.cancelled = True
	    	self.Close()
	
	    def reset(self, sender, event):
			pass
	
	    def openfile(self, sender, event):
			ofd = OpenFileDialog()
			dr = ofd.ShowDialog()
			if dr == DialogResult.OK:
				sender.Text = ofd.FileName
				sender.Tag = ofd.FileName

	    def exportToExcel(self, sender, event):
	    	#importing Excel IronPython libraries
	    	clr.AddReferenceByName('Microsoft.Office.Interop.Excel, Version=11.0.0.0, Culture=neutral, PublicKeyToken=71e9bce111e9429c')
	    	from Microsoft.Office.Interop import Excel
	    	ex = Excel.ApplicationClass()
	    	ex.Visible = sender.Tag[1]
	    	ex.DisplayAlerts = False
	    	fbd = FolderBrowserDialog()
	    	fbd.SelectedPath = sender.Text
	    	parent = sender.Parent
	    	fptextbox = parent.GetChildAtPoint(Point(parent.Location.X,sender.Location.Y+5*yRatio))
	    	dataGrid = parent.GetChildAtPoint(Point(parent.Location.X,parent.Location.Y+23*xRatio))
	    	dataTable = dataGrid.DataSource
	    	fptext = fptextbox.Text
	    	titletext = parent.GetChildAtPoint(Point(0,0)).Text
	    	dr = fbd.ShowDialog()
	    	frstRwTtle = sender.Tag[0]
	    	if frstRwTtle:
	    		_header = Excel.XlYesNoGuess.xlYes
	    	else:
	    		_header = Excel.XlYesNoGuess.xlNo
	    	if dr == DialogResult.OK:
	    		workbk = ex.Workbooks.Add()
	    		worksheet = workbk.Worksheets.Add()
	    		#Writing title and doc info
	    		if sender.Tag[2]:
		    		titleCell = worksheet.Cells[1,1]
		    		worksheet.Cells[2,1].Value2 = sender.Tag[3]
		    		titleCell.Value2 = titletext
		    		titleCell.Font.Size = 18
		    		titleCell.Font.Bold = True
		    		startR = 3
		    		endR = 3
		    	else:
		    		startR = 1
		    		endR = 0	
		    	if frstRwTtle:
		    		for j in range(0,dataTable.Columns.Count):
		    			worksheet.Cells[startR,j+1] = dataTable.Columns[j].ColumnName		    	
		    		for i in range(0,dataTable.Rows.Count):
		    			for j in range(0,dataTable.Columns.Count):
			    			worksheet.Cells[i+startR+1,j+1] = dataTable.DefaultView[i].Row[j].ToString()
		    		xlrange = ex.get_Range(worksheet.Cells[startR,1],worksheet.Cells[dataTable.Rows.Count+endR+1,dataTable.Columns.Count])			    			
		    	else :
		    		for i in range(0,dataTable.Rows.Count):
		    			for j in range(0,dataTable.Columns.Count):
			    			worksheet.Cells[i+startR,j+1] = dataTable.DefaultView[i].Row[j].ToString()		    	
		    		xlrange = ex.get_Range(worksheet.Cells[startR,1],worksheet.Cells[dataTable.Rows.Count+endR,dataTable.Columns.Count])
		    	xlrange.Columns.AutoFit()
		    	worksheet.ListObjects.Add(Excel.XlListObjectSourceType.xlSrcRange, xlrange, SType.Missing, _header, SType.Missing).Name = "DataShapesTable"
		    	worksheet.ListObjects["DataShapesTable"].TableStyle =  "TableStyleMedium16"
	    		workbk.SaveAs(fbd.SelectedPath + "\\" + fptext)
	    		if not sender.Tag[1]:
	    			workbk.Close()
	    			ex.Quit()

	    def startCell(self, sender, event ):
			sender.startcell["X"] = event.ColumnIndex
			sender.startcell["Y"] = event.RowIndex	

	    def endCell(self, sender, event ):
	    	try:
				sender.endcell["X"] = event.ColumnIndex
				sender.endcell["Y"] = event.RowIndex 
				startval = sender.Rows[sender.startcell["Y"]].Cells[sender.startcell["X"]].Value
				endNum = regexEndNum(startval)
				if endNum != "":
					if sender.endcell["Y"] == sender.startcell["Y"]:
						for e,i in enumerate(range(sender.startcell["X"],sender.endcell["X"] + 1)):
							sender.Rows[sender.startcell["Y"]].Cells[i].Value = startval[:-len(endNum)] + str(int(endNum) + e)
					elif sender.endcell["X"] == sender.startcell["X"]:
						for e,i in enumerate(range(sender.startcell["Y"],sender.endcell["Y"] + 1)):
							sender.Rows[i].Cells[sender.endcell["X"]].Value = startval[:-len(endNum)] + str(int(endNum) + e)
				else:				
					if sender.endcell["Y"] == sender.startcell["Y"]:
						for i in range(sender.startcell["X"],sender.endcell["X"] + 1):
							sender.Rows[sender.startcell["Y"]].Cells[i].Value = startval
					elif sender.endcell["X"] == sender.startcell["X"]:
						for i in range(sender.startcell["Y"],sender.endcell["Y"] + 1):
							sender.Rows[i].Cells[sender.endcell["X"]].Value = startval
	    	except:
	    		pass
	    		    	
	    def startRowDrag(self, sender, event ):
	    	shmak
			
	    def opendirectory(self, sender, event):
			fbd = FolderBrowserDialog()
			fbd.SelectedPath = sender.Text
			dr = fbd.ShowDialog()
			if dr == DialogResult.OK:
				sender.Text = fbd.SelectedPath
				sender.Tag = fbd.SelectedPath
	
	    def pickobjects(self, sender, event):   
			for c in self.Controls:
				c.Enabled = False
			try:
				sel = uidoc.Selection.PickObjects(Selection.ObjectType.Element,'')
				selelem = [doc.GetElement(s.ElementId) for s in sel]
				sender.Tag = (selelem)
			except:
				pass
			for c in self.Controls:
				c.Enabled = True
		#THIS METHOD IS FOR CIVIL 3D EVIRONMENT
	    def pickautocadobjects(self, sender, event):   
			selelem = []	
			for c in self.Controls:
				c.Enabled = False
			try:
				acadDoc = System.Runtime.InteropServices.Marshal.GetActiveObject("Autocad.Application").ActiveDocument
				acadDoc.Activate()
				acadUser = acadDoc.GetVariable("users5")	
				acadDoc.SendCommand("(and(princ\042"+ sender.Text + "\042)(setq ss(ssget))(setvar\042users5\042\042LinkDWGUIOK\042)(command\042_.Select\042ss\042\042)) ")
				selection_ = acadDoc.ActiveSelectionSet
				acadDoc.SendCommand("(setq ss nil) ")
				if acadDoc.GetVariable("users5") == "LinkDWGUIOK" and selection_ != None:
					for sel in selection_:				
						selelem.append(sel)		
					acadDoc.SetVariable("users5", acadUser)
				sender.Tag = list(selelem)		
			except:
				pass
			for c in self.Controls:
				c.Enabled = True	

	    def pickautocadobject(self, sender, event):   
			selelem = None	
			for c in self.Controls:
				c.Enabled = False
			try:
				acadDoc = System.Runtime.InteropServices.Marshal.GetActiveObject("Autocad.Application").ActiveDocument
				acadUser = acadDoc.GetVariable("users5")
				acadPickBox = acadDoc.GetVariable("pickbox")
				acadDoc.SetVariable("pickbox", 5)
				acadDoc.Activate()
				acadDoc.SendCommand("(setq obj(car(entsel\042" + sender.Text + "\042))) ")
				acadDoc.SendCommand("(and obj(setvar\042users5\042(cdr(assoc 5(entget obj))))(setq obj nil)) ")		
				selection_ = acadDoc.GetVariable("users5")
				acadDoc.SetVariable("pickbox", acadPickBox)
				acadDoc.SetVariable("users5", acadUser)
				selelem = acadDoc.HandleToObject(selection_)
				sender.Tag = selelem		
			except:
				pass
			for c in self.Controls:
				c.Enabled = True	

	    def pickobjectsordered(self, sender, event):
			for c in self.Controls:
				c.Enabled = False
			output = []
			test = True
			TaskDialog.Show("Data|Shapes", 'Pick elements in order, then hit ESC to exit.')
			while test:
				try:
					sel = doc.GetElement(uidoc.Selection.PickObject(Selection.ObjectType.Element, 'Pick elements in order').ElementId)
					output.append(sel.ToDSType(True))
				except : 
					test = False
				sender.Tag = output
			for c in self.Controls:
				c.Enabled = True
	    
	    def pickobjectsofcatordered(self, sender, event):
			for c in self.Controls:
				c.Enabled = False
			output = []
			test = True
			if isinstance(sender.Tag,list):			
				category = UnwrapElement(sender.Tag)
			else:
				category = [UnwrapElement(sender.Tag)]
			TaskDialog.Show("Data|Shapes", 'Select %s in order, then press ESC to exit.' %(', '.join([c.Name for c in category])))
			while test:
				try:
					selfilt = selectionfilter(category)
					sel = doc.GetElement(uidoc.Selection.PickObject(Selection.ObjectType.Element,selfilt, 'Select %s' %(', '.join([c.Name for c in category]))).ElementId)				
					output.append(sel.ToDSType(True))
				except : 
					test = False
				sender.Tag = (output)
			for c in self.Controls:
				c.Enabled = True
			
	    def picklinkedobjects(self, sender, event):
			#This part was made easier by Dimitar Venkov's work
			for c in self.Controls:
				c.Enabled = False
			try:
				linkref = uidoc.Selection.PickObject(Selection.ObjectType.Element,'Select the link instance.')
				link = doc.GetElement(linkref.ElementId).GetLinkDocument()
				td = TaskDialog.Show('Data-Shapes','Select the linked elements and press Finish.')
				sel = uidoc.Selection.PickObjects(Selection.ObjectType.LinkedElement,'Select the linked elements and press Finish.')
				selelem = [link.GetElement(s.LinkedElementId) for s in sel]
				sender.Tag = (selelem)
			except:
				pass
			for c in self.Controls:
				c.Enabled = True		

	    def pickobject(self, sender, event):
			for c in self.Controls:
				c.Enabled = False
			try:
				sel = uidoc.Selection.PickObject(Selection.ObjectType.Element,'')
				selelem = doc.GetElement(sel.ElementId) 
				sender.Tag = (selelem)
			except:
				pass
			for c in self.Controls:
				c.Enabled = True
			
	    def picklinkedobject(self, sender, event):
			#This part was made easier by Dimitar Venkov's work
			for c in self.Controls:
				c.Enabled = False
			try:
				linkref = uidoc.Selection.PickObject(Selection.ObjectType.Element,'Select the link instance.')
				link = doc.GetElement(linkref.ElementId).GetLinkDocument()
				td = TaskDialog.Show('Data-Shapes','Select the linked element.')
				sel = uidoc.Selection.PickObject(Selection.ObjectType.LinkedElement,'Select the linked element.')
				selelem = link.GetElement(sel.LinkedElementId)
				sender.Tag = (selelem)
			except:
				pass				
			for c in self.Controls:
				c.Enabled = True
			
	    def pickobjectsofcat(self, sender, event):
			for c in self.Controls:
				c.Enabled = False
			if isinstance(sender.Tag,list):	    
				category = UnwrapElement(sender.Tag)
			else:
				category = [UnwrapElement(sender.Tag)]
			try:
				selfilt = selectionfilter(category)
				sel = uidoc.Selection.PickObjects(Selection.ObjectType.Element,selfilt,'Select %s' %(', '.join([c.Name for c in category])))
				selelem = [doc.GetElement(s.ElementId) for s in sel]
				sender.Tag = (selelem)
			except:
				pass
			for c in self.Controls:
				c.Enabled = True

	    def pickobjectofcat(self, sender, event):
			for c in self.Controls:
				c.Enabled = False
			if isinstance(sender.Tag,list):	    
				category = UnwrapElement(sender.Tag)
			else:
				category = [UnwrapElement(sender.Tag)]
			try:
				selfilt = selectionfilter(category)
				sel = uidoc.Selection.PickObject(Selection.ObjectType.Element,selfilt,'Select %s' %(', '.join([c.Name for c in category])))
				selelem = doc.GetElement(sel.ElementId) 
				sender.Tag = (selelem)
			except:
				pass
			for c in self.Controls:
				c.Enabled = True
			
	    def pickfaces(self, sender, event):
			faces = []	    	
			for c in self.Controls:
				c.Enabled = False
			try:
				selface = uidoc.Selection.PickObjects(Selection.ObjectType.Face,'')
				for s in selface:
					f = uidoc.Document.GetElement(s).GetGeometryObjectFromReference(s).ToProtoType(True)
					[i.Tags.AddTag("RevitFaceReference", s) for i in f]
					faces.append(f)
				sender.Tag = [i for j in faces for i in j]
			except:
				pass
			for c in self.Controls:
				c.Enabled = True
				
	    def pickpointsonface(self, sender, event):
			faces = []	    	
			for c in self.Controls:
				c.Enabled = False
			selpoints = uidoc.Selection.PickObjects(Selection.ObjectType.PointOnElement,'')
			points = []
			for s in selpoints:
				pt = s.GlobalPoint
				points.append(dsPoint.ByCoordinates(UnitUtils.ConvertFromInternalUnits(pt.X,UIunit),UnitUtils.ConvertFromInternalUnits(pt.Y,UIunit),UnitUtils.ConvertFromInternalUnits(pt.Z,UIunit)))
			sender.Tag = points
			for c in self.Controls:
				c.Enabled = True
				
	    def pickedges(self, sender, event):
			edges = []
			for c in self.Controls:
				c.Enabled = False	
			try:				
				seledge = uidoc.Selection.PickObjects(Selection.ObjectType.Edge,'')
				for s in seledge:
					e = uidoc.Document.GetElement(s).GetGeometryObjectFromReference(s).AsCurve().ToProtoType(True)
					e.Tags.AddTag("RevitFaceReference", s)
					edges.append(e)
				sender.Tag = edges
			except:
				pass
			for c in self.Controls:
				c.Enabled = True

	    def colorpicker(self, sender, event):
			dialog = ColorSelectionDialog()
			selection = ColorSelectionDialog.Show(dialog)
			selected = dialog.SelectedColor
			sender.Tag = selected
			sender.BackColor = Color.FromArgb(selected.Red,selected.Green,selected.Blue)
			sender.ForeColor = Color.FromArgb(selected.Red,selected.Green,selected.Blue)
	
	    def topmost(self):
			self.TopMost = True
	
	    def lvadd(self, sender, event):
			sender.Tag = [i for i in sender.CheckedItems]
			
	    def scroll(self, sender, event):
			parent = sender.Parent
			child = parent.GetChildAtPoint(Point(0,5*yRatio))
			child.Text = str(sender.startval+sender.Value*sender.step)

	    def openurl(self, sender, event):
			webbrowser.open(sender.Tag)
	
	    def selectall(self, sender, event):
			if sender.Checked:
				parent = sender.Parent
				listview = parent.GetChildAtPoint(Point(0,0))
				for i in listview.Items:
					i.Checked = True
			else:
				pass
				
	    def selectnone(self, sender, event):
			if sender.Checked:
				parent = sender.Parent
				listview = parent.GetChildAtPoint(Point(0,0))
				for i in listview.Items:
					i.Checked = False
			else:
				pass		

	    def updateallnone(self, sender, event):
	    	try:
	    		parent = sender.Parent
	    		rball = parent.GetChildAtPoint(Point(0,sender.Height + 5*yRatio))
	    		rbnone = parent.GetChildAtPoint(Point(80 * xRatio,sender.Height + 5*yRatio))
	    		if sender.CheckedItems.Count == 0 and event.NewValue == CheckState.Unchecked:
	    			rbnone.Checked = False
	    			rball.Checked = False
	    		elif sender.CheckedItems.Count == sender.Items.Count and event.NewValue == CheckState.Unchecked:
	    			rball.Checked = False
	    			rbnone.Checked = False
	    		elif sender.CheckedItems.Count == sender.Items.Count-1 and event.NewValue == CheckState.Checked:
	    			rball.Checked = True
	    			rbnone.Checked = False
	    		elif sender.CheckedItems.Count == 1 and event.NewValue == CheckState.Unchecked:
	    			rball.Checked = False
	    			rbnone.Checked = True	    	
	    		else :
	    			rball.Checked = False
	    			rbnone.Checked = False
	    	except:
	    		pass

	    def zoomcenter(self, sender, event ):
			if event.X > 15:	    
				try:
					element = doc.GetElement(uidoc.Selection.GetElementIds()[0])
					uidoc.ShowElements(element)
				except:
					pass
			else:
				pass
				
			
	    def setviewforelement(self, sender, event ):    
			if event.X > 15*xRatio:	    		
				try:
					item = sender.GetItemAt(event.X,event.Y).Text
					element = UnwrapElement(sender.Values[item])
					try:
						viewsforelement = [v for v in dbviews if (not v.IsTemplate) and (element.Id in [e.Id for e in FilteredElementCollector(doc,v.Id).OfClass(element.__class__).ToElements()])]
					except:
						viewsforelement = [v for v in dbviews if (not v.IsTemplate) and (element.Id in [e.Id for e in FilteredElementCollector(doc,v.Id).OfClass(FamilyInstance).ToElements()])]
					global viewindex
					dbView = viewsforelement[viewindex]
					id = [element.Id]
					icollection = iList[ElementId](id)
					uidoc.Selection.SetElementIds(icollection)
				except:
					pass
			else:	    
				pass


	    def CheckChildren(self, sender, event ):
			evNode = event.Node	    
			checkState = evNode.Checked	
			for n in event.Node.Nodes:	   	
				n.Checked = checkState			
				
	    def ActivateOption(self, sender, event ):
	    	parent = sender.Parent
	    	associatedControls = [p for p in parent.Controls if p.Name == sender.Text and p.GetType() == Panel][0]
	    	restofcontrols = [p for p in parent.Controls if p.Name != sender.Text and p.GetType() == Panel]
	    	if sender.Checked:
	    		associatedControls.Enabled = True
	    		for c in restofcontrols:
	    			c.Enabled = False
	    		parent.Tag = sender.Text
	    		
	    def showtooltip(self, sender, event ):
	    	ttp = ToolTip()
	    	ttp.AutoPopDelay = 10000
	    	ttp.SetToolTip(sender , sender.Tag)	

	    def numsOnly(self, sender, event ):
	    	if Char.IsDigit(event.KeyChar)==False and event.KeyChar != "." and Char.IsControl(event.KeyChar)==False:
	    		event.Handled = True
	    
	    def chart_showLabels(self, sender, event):
			cb = sender
			panelcht = sender.Parent
			chart1 = panelcht.GetChildAtPoint(Point(0,0))
			for s in chart1.Series:
				if s.ChartType == SeriesChartType.Pie:
					if cb.Checked:
						s["PieLabelStyle"] = "Inside"
					else:
						s["PieLabelStyle"] = "Disabled"
				else:
					if cb.Checked:
						s.IsValueShownAsLabel = True
					else:
						s.IsValueShownAsLabel = False
	    		
	    def imageexport(self, sender, event):
	    	import datetime
	    	from datetime import datetime
	    	from RevitServices.Transactions import TransactionManager
	    	#Modify resolution before the render
	    	fontFam = FontFamily("Segoe UI Symbol")
	    	originalFont = Font(fontFam,8)
	    	panelcht = sender.Parent
	    	chart1 = panelcht.GetChildAtPoint(Point(0,0))
	    	originalTitleFont = chart1.Titles[0].Font
	    	originalWidth = chart1.Width
	    	originalHeight = chart1.Height
	    	chart1.Visible = False
	    	chart1.Dock = DockStyle.None
	    	chart1.Width = 2100 * 0.8
	    	chart1.Height = 1500 * 0.8
	    	chart1.ChartAreas[0].AxisX.LabelAutoFitStyle = LabelAutoFitStyles.None
	    	chart1.ChartAreas[0].AxisY.LabelAutoFitStyle = LabelAutoFitStyles.None
	    	chart1.ChartAreas[0].AxisX.LabelStyle.Font = Font(fontFam, 30)
	    	chart1.ChartAreas[0].AxisY.LabelStyle.Font = Font(fontFam, 30)
	    	chart1.ChartAreas[0].AxisX.TitleFont = Font(fontFam, 30)
	    	chart1.ChartAreas[0].AxisY.TitleFont = Font(fontFam, 30)
	    	chart1.TextAntiAliasingQuality = TextAntiAliasingQuality.High
	    	chart1.BackColor = Color.White
	    	chart1.Titles[0].Font = Font(fontFam, 32, FontStyle.Bold)
	    	chart1.ChartAreas[0].BackColor = Color.White
	    	for serie in chart1.Series:
	    		serie.Font = Font(fontFam, 30)
		    	for p in serie.Points:
		    		p.Font = Font(fontFam, 30)
		    		p.MarkerSize = 15
	    	for legend in chart1.Legends:
	    		legend.Font = Font(fontFam, 30)
	    		legend.BackColor = Color.White
	    	chart1.Invalidate()
	    	chart1.SaveImage(tempfile.gettempdir() + "\\chartImage.bmp", ChartImageFormat.Bmp)
	    	#Get back to original settings
	    	chart1.Width = originalWidth
	    	chart1.Height = originalHeight
	    	chart1.BackColor = Color.Transparent
	    	chart1.ChartAreas[0].BackColor = Color.Transparent
	    	chart1.ChartAreas[0].AxisX.LabelStyle.Font = originalFont
	    	chart1.ChartAreas[0].AxisY.LabelStyle.Font = originalFont
	    	chart1.ChartAreas[0].AxisX.TitleFont = originalFont
	    	chart1.ChartAreas[0].AxisY.TitleFont = originalFont
	    	chart1.Titles[0].Font = originalTitleFont
	    	for serie in chart1.Series:
	    		serie.Font = originalFont
	    		for p in serie.Points:
	    			p.Font = originalFont
		    		p.MarkerSize = 8
	    	for legend in chart1.Legends:
	    		legend.Font = originalFont
	    		legend.BackColor = Color.Transparent
	    	chart1.Invalidate()
	    	chart1.Visible = True
	    	#Import the picture in a Drafting View
	    	#Import the picture in a Drafting View // The try catch if for handling the fact that ImageImportOptions was deprecated in 2020 and is obsolete in 2021	    	
	    	try:
	    		importOptions = ImageImportOptions()	
	    		importOptions.Resolution = 72
	    		importOptions.Placement = BoxPlacement.TopLeft	    		
	    	except:
	    		imageTypeOption = ImageTypeOptions()	
	    		imageTypeOption.Resolution = 72

	    	collector = FilteredElementCollector(doc).OfClass(ViewFamilyType)
	    	viewFamilyTypes = []
	    	for c in collector:
	    		if c.ViewFamily == ViewFamily.Drafting:
	    			viewFamilyTypes.append(c)
	    	viewFamilyType = viewFamilyTypes[0]
	    	TransactionManager.Instance.EnsureInTransaction(doc)
	    	draftView = ViewDrafting.Create(doc,viewFamilyType.Id)
	    	draftView.Name = chart1.Titles[0].Text + datetime.now().strftime(" (%m/%d/%Y, %H.%M.%S)")
	    	imagePath = tempfile.gettempdir() + "\\chartImage.bmp"
	    	newElement = clr.StrongBox[Element]()
	    	try:
	    		doc.Import(imagePath,importOptions,draftView,newElement)	    	
	    	except:
	    		imageTypeOption.SetPath(imagePath)
	    		imageType = ImageType.Create(doc,imageTypeOption)
	    		placementOptions = ImagePlacementOptions(XYZ(0,0,0),BoxPlacement.TopLeft)
	    		ImageInstance.Create(doc,draftView,imageType.Id,placementOptions)	    		
	    	TransactionManager.Instance.TransactionTaskDone()
	    		    	
	    def chart_showLegend(self, sender, event ):
	    	cb = sender
	    	panelcht = sender.Parent
	    	chart1 = panelcht.GetChildAtPoint(Point(0,0))
	    	if len(chart1.Legends) <= 1:
	    		for legend in chart1.Legends:
	    			if cb.Checked:
	    				legend.Enabled = True
	    			else:
	    				legend.Enabled = False
	    	else:
	    		if cb.Checked:
	    			chart1.Legends[1].Enabled = True
	    		else:
	    			chart1.Legends[1].Enabled = False
		    		

	class mylistview(ListView):
	
		def __init__(self):
			self.Values = []

	class mytrackbar(TrackBar):
	
		def __init__(self,startval,step):
			self.startval = startval
			self.step = step

	class myDataGridView(DataGridView):
	
		def __init__(self):
			self.startcell = {}
			self.endcell = {}
			
	class mygroupbox(GroupBox):
	
		def __init__(self):
			self.Values = []
			
	class myTextBox(TextBox):
	
		def __init__(self):
			self._isNum = False
	
			
	#Form initialization
	
	form = MultiTextBoxForm()
	xRatio = Screen.PrimaryScreen.Bounds.Width/1920
	if xRatio == 0:
		xRatio = 1
	yRatio = Screen.PrimaryScreen.Bounds.Height/1080
	if yRatio == 0:
		yRatio = 1
	form.topmost()	
	form.ControlBox = True
	xlabel = 25 * xRatio
	xinput = 150 * xRatio
	formy = 10 * yRatio
	if IN[8] * xRatio > (350 * xRatio):	formwidth = IN[8] * xRatio
	else: formwidth = 350 * xRatio
	fields = []
	error = 0
	
	#Description 
	
	if IN[3] != "":
		des = Label()
		des.Location = Point(xlabel,formy)
		des.Font = Font("Arial", 15,FontStyle.Bold)		
		des.AutoSize = True
		des.MaximumSize = Size(formwidth - (2 * xlabel)*xRatio,0)
		des.Text = IN[3]
		form.Controls.Add(des)
		formy = des.Bottom + (15*xRatio)
	formheaderheight = formy
	
	#Input form
	
	# Create a container panel for all inputs
	body = Panel()
	body.Location = Point(0,formy)
	body.Width = formwidth - 15*xRatio
	
	
	# Process form inputs
	if isinstance(IN[0],list):
		inputtypes = IN[0]
	else:
		inputtypes = [IN[0]]
	# This definition is to handle the sorting of special characters
	def remove_accents(input_str):
	    nfkd_form = unicodedata.normalize('NFKD', input_str)
	    only_ascii = nfkd_form.encode('ASCII', 'ignore')
	    return only_ascii	

	#Adding Logo 
	#default logo in case no input	
	def getImageByName(ImName):
		dynamo = Assembly.Load('DynamoCore')
		version = str(dynamo.GetName().Version)[:3]		
		dynPath = os.getenv('APPDATA')+"\\Dynamo\Dynamo Revit\\" + version 
		root = et.parse(dynPath + "\DynamoSettings.xml").getroot()
		logopaths = []
		for child in root:
			if child.tag == "CustomPackageFolders":
				for path in child:
					logopaths.append(path.text + "\packages\Data-Shapes\extra\\" + ImName)
					logopaths.append(path.text + "\Data-Shapes\extra\\" + ImName)
		deflogopath = ""
		for path in logopaths:
			if deflogopath == "":
				if os.path.isfile(path):
					deflogopath = path
					try:
						ima = Image.FromFile(deflogopath)
						bmp = Bitmap.FromFile(deflogopath)
						return ima,bmp
					except: 
						pass
						
	try:
		if IN[4] != '':
			try:
				ima = Image.FromFile(IN[4])
				bmp = Bitmap.FromFile(IN[4])
			except:
				ima = IN[4]
				bmp = IN[4]

		else :
			_ims = getImageByName("a.png")
			ima = _ims[0]
			bmp = _ims[1]
			
		logo = Panel()
		if IN[6] == None:
			xlogo = 20 * xRatio
			ylogo = formy+ 10*yRatio
		else:
			xlogo = 30 * xRatio
			ylogo = formy
		size = 110 * xRatio
		logo = PictureBox()
		ratio = (ima.Height)/(ima.Width)
		h = float(ima.Height)
		w = float(ima.Width)
		ratio = h/w
		logo.Size = Size(size,size*ratio)
		scaledimage = Bitmap(size,size*ratio)
		gr = Graphics.FromImage(scaledimage)
		gr.DrawImage(ima,0,0,size,size*ratio)
		logo.Image = ima
		logo.SizeMode = PictureBoxSizeMode.Zoom
		form.Controls.Add(logo)
		logo.Location = Point(xlogo,ylogo)
		
		
		#Setting icon 
		thumb = bmp.GetThumbnailImage(64, 64, bmp.GetThumbnailImageAbort,IntPtr.Zero)
		thumb.MakeTransparent();
		icon = Icon.FromHandle(thumb.GetHicon())
		form.Icon = icon

	except :
		logo = Panel()
		logo.Width = 110 * xRatio
		logo.Height = 110 * yRatio
	
	def addinput(formbody,inputs,starty,xinput,rightmargin,labelsize,importcolorselection):
		y = starty
		for j in inputs:
			label = Label()
			label.Location = Point(xlabel,y+4*yRatio)
			label.AutoSize = True
			label.MaximumSize = Size(labelsize,0)
			if j.__class__.__name__ == 'listview' and j.element_count > 0:
				label.Text = j.inputname + '\n(' + str(j.element_count) + ' element' + ("s" if j.element_count > 1 else "") + ')'
			else:
				try:
					label.Text = j.inputname
				except:
					pass
			formbody.Controls.Add(label)
	
			if j.__class__.__name__ == 'dropdown':
				cb = ComboBox()
				if j.inputname != "":
					cb.Width = formwidth - rightmargin - xinput
					cb.Location = Point(xinput,y)
				else:
					cb.Width = formwidth - rightmargin - xlabel
					cb.Location = Point(xlabel,y)
				cb.Sorted = j._sorted
				[cb.Items.Add(i) for i in j.keys() if not (i == 'inputname' or i == 'height' or i == 'defaultvalue' or i == 'highlight' or i == '_sorted' )]
				cb.Tag = j
				if j.defaultvalue != None:
					defindex = [i for i in cb.Items].index([i for i in j.keys() if not (i == 'inputname' or i == 'height' or i == 'defaultvalue' or i == 'highlight' or i == '_sorted' )][j.defaultvalue])
					cb.SelectedIndex = defindex
				formbody.Controls.Add(cb)
				form.output.append(cb)
				y = label.Bottom + 25 * yRatio
			#CHARTS 
			if j.__class__.__name__ == 'uipiechart':					
				labels = j.xseries
				inputcolors = j.inputcolors
				pyList = []
				xseries = [j.xseries]
				yseries = [j.yseries]
				nbOfSeries = 1
				if inputcolors is not None:
					colorBool = True
					for color in inputcolors:
						pyList.append(Color.FromArgb(color.Red,color.Green,color.Blue))
					wfColor = Array[Color](pyList)
				else:
					colorBool = False
				#Set a global Font code
				fontFam = FontFamily("Segoe UI Symbol")
				originalFont = Font(fontFam,8)
				#Chart created and Panel to host the chart
				chart1 = Chart()
				panelChart = Panel()
				panelChart.Name = "panelChart"
				#Panels colors
				chart1.BackColor = formbody.BackColor
				panelChart.BackColor = Color.Transparent
				#PanelChart location
				panelChart.Width = formwidth  - rightmargin - xlabel
				panelChart.Location = Point(xlabel,y + 30)
				#Chart colors palette
				chart1.Palette =  ChartColorPalette.None
				if colorBool:
					chart1.PaletteCustomColors = wfColor
				else:
					chart1.Palette =  ChartColorPalette.None
				chart1.Series.Clear()
				#Series created
				label = SmartLabelStyle()
				def createSeries(seriesName,_keys,_values):
					srs = Series()
					srs["PieLabelStyle"] = "Inside"
					srs.Name = seriesName
					srs.ChartType = SeriesChartType.Pie
					srs.ToolTip = "Percent: #PERCENT"
					srs.IsValueShownAsLabel = True
					for i,j in zip(_keys,_values):
						srs.Points.AddXY(i,j)
					return srs
				#Create series
				series = []
				for i in range(0,len(xseries)):
					series.append(createSeries(labels[i],xseries[i],yseries[i]))
				#Add series to chart
				for s in series:
					chart1.Series.Add(s)
				#Legend text of the points
				for s in series:
					for p in s.Points: 
						p.Font = originalFont
				#Refresh the Chart
				chart1.Invalidate()
				#Create a ChartArea and add it to the chart
				chartArea1 = ChartArea()
				chartArea1.BackColor = formbody.BackColor
				chartArea1.Name = "ChartArea1"
				chart1.ChartAreas.Add(chartArea1)				
				#Create a Legend and add it to the chart
				legend1 = Legend()
				legend1.BackColor = formbody.BackColor
				legend1.Font = originalFont
				legend1.Name = "Legend1"
				legend1.IsTextAutoFit = True
				legend1.LegendStyle = LegendStyle.Column
				chart1.Legends.Add(legend1)
				#Initialize the chart and its properties
				chart1.BeginInit()
				chart1.Size = Size(panelChart.Width,panelChart.Width)
				chart1.AntiAliasing = AntiAliasingStyles.All
				fontFam = FontFamily("Segoe UI Symbol")
				titleFont = Font(fontFam,10,FontStyle.Bold)
				title = Title()
				title.Text = j.chartname
				title.Alignment = ContentAlignment.TopLeft
				title.Font = titleFont
				chart1.Titles.Add(title)
				#Add a button to push on view
				bt = Button()
				bt.Tag = "Push the chart on a view in Revit"
				bt.Text = "Push on a draft view"
				bt.Height = 20 * yRatio
				bt.Width = 140 * yRatio				
				panelChart.Controls.Add(bt)
				bt.BringToFront()
				bt.Font = originalFont
				bt.Click += form.imageexport
				#Add a checkBox to show/hide legend
				checkBox1 = CheckBox()
				checkBox1.AutoCheck = True
				checkBox1.Name = "checkBox1"
				checkBox1.Text = "Legend"
				panelChart.Controls.Add(checkBox1)
				checkBox1.BringToFront()
				checkBox1.Checked = True
				checkBox1.Font = originalFont
				checkBox1.AutoSize = True
				checkBox1.Click += form.chart_showLegend
				#Add a checkBox to show/hide labels
				checkBox2 = CheckBox()
				checkBox2.AutoCheck = True
				checkBox2.Name = "checkBox2"
				checkBox2.Text = "Labels"
				panelChart.Controls.Add(checkBox2)
				checkBox2.BringToFront()
				checkBox2.Checked = True
				checkBox2.Font = originalFont
				checkBox2.AutoSize = True
				checkBox2.Click += form.chart_showLabels
				
				panelChart.Size = Size(panelChart.Width, panelChart.Width + checkBox2.Height + 30)
				#Add chart to panel
				panelChart.Controls.Add(chart1)
				chart1.Location = Point(0,0)
				bt.Location = Point(panelChart.Width - bt.Width, panelChart.Width + 15)
				checkBox1.Location = Point(panelChart.Width - bt.Width - 80, panelChart.Width + 15)
				checkBox2.Location = Point(panelChart.Width - bt.Width - 160, panelChart.Width + 15)
				formbody.Controls.Add(panelChart)
				
				y = panelChart.Bottom + 25 * yRatio
				
			elif j.__class__.__name__ == 'uibarchart':
				if isinstance(j.labels,list):
					labels = j.labels
				else:
					labels = [j.labels]
				inputcolors = j.inputcolors
				horizont = j.ishorizontal
				pyList = []
				if isinstance(j.xseries[0],list) and isinstance(j.yseries[0],list):
					nbOfSeries = len(j.xseries)
					xseries = j.xseries
					yseries = j.yseries
				elif isinstance(j.xseries[0],list) == False and isinstance(j.yseries[0],list):
					nbOfSeries = len(j.yseries)
					xseries = []
					i = 1
					while i <= nbOfSeries:
						xseries.append(j.xseries)
						i = i + 1
					yseries = j.yseries
				elif isinstance(j.yseries[0],list) == False and isinstance(j.xseries[0],list):
					nbOfSeries = len(j.xseries)
					yseries = []
					i = 1
					while i <= nbOfSeries:
						yseries.append(j.yseries)
						i = i + 1
					xseries = j.xseries
				else:
					xseries = [j.xseries]
					yseries = [j.yseries]
					nbOfSeries = 1
				if inputcolors is not None:
					colorBool = True
					for color in inputcolors:
						pyList.append(Color.FromArgb(color.Red,color.Green,color.Blue))
					wfColor = Array[Color](pyList)
				else:
					colorBool = False
				#Set a global Font code
				fontFam = FontFamily("Segoe UI Symbol")
				originalFont = Font(fontFam,8)
				#Chart created and Panel to host the chart
				chart1 = Chart()
				panelChart = Panel()
				panelChart.Name = "panelChart"
				#Panels colors
				chart1.BackColor = formbody.BackColor
				panelChart.BackColor = Color.Transparent
				#PanelChart location
				panelChart.Width = formwidth  - rightmargin - xlabel
				panelChart.Location = Point(xlabel,y + 30)				
				#Chart colors palette
				chart1.Palette =  ChartColorPalette.None
				if colorBool:
					chart1.PaletteCustomColors = wfColor
				else:
					chart1.Palette =  ChartColorPalette.None
				chart1.Series.Clear()
				#Series created
				def createSeries(seriesName,_keys,_values,_horizont):
					srs = Series()
					srs.Name = seriesName
					if _horizont:
						srs.ChartType = SeriesChartType.Bar
					else:
						srs.ChartType = SeriesChartType.Column
					srs.ToolTip = "Percent: #PERCENT"
					srs.IsValueShownAsLabel = True
					srs.Font = originalFont
					for i,j in zip(_keys,_values):
						srs.Points.AddXY(i,j)
					return srs
				#Create series
				series = []
				for i in range(0,nbOfSeries):
					series.append(createSeries(labels[i],xseries[i],yseries[i],horizont))
				#Add series to chart
				for s in series:
					chart1.Series.Add(s)
				#Refresh the Chart
				chart1.Invalidate()
				#Create a ChartArea and add it to the chart
				chartArea1 = ChartArea()
				chartArea1.BackColor = formbody.BackColor
				chartArea1.Name = "ChartArea1"
				chartArea1.AxisX.Title = j.xaxislabel
				chartArea1.AxisY.Title = j.yaxislabel
				chart1.ChartAreas.Add(chartArea1)
				#Create a Legend and add it to the chart
				legend1 = Legend()
				legend1.BackColor = formbody.BackColor
				legend1.Font = originalFont
				legend1.Name = "Legend1"
				legend1.Docking = Docking.Right
				chart1.Legends.Add(legend1) 
				#Initialize the chart and its properties
				chart1.BeginInit()
				chart1.Size = Size(panelChart.Width,panelChart.Width)
				chart1.AntiAliasing = AntiAliasingStyles.All
				fontFam = FontFamily("Segoe UI Symbol")
				titleFont = Font(fontFam,10,FontStyle.Bold)
				title = Title()
				title.Text = j.chartname
				title.Alignment = ContentAlignment.TopLeft
				title.Font = titleFont
				chart1.Titles.Add(title)
				#Add a button to push on view
				bt = Button()
				bt.Tag = "Push the chart on a view in Revit"
				bt.Text = "Push on a draft view"
				bt.Height = 20 * yRatio
				bt.Width = 140 * yRatio			
				panelChart.Controls.Add(bt)
				bt.BringToFront()
				bt.Click += form.imageexport
				#Add a checkBox to show/hide legend
				checkBox1 = CheckBox()
				checkBox1.AutoCheck = True
				checkBox1.Name = "checkBox1"
				checkBox1.Text = "Legend"
				panelChart.Controls.Add(checkBox1)
				checkBox1.BringToFront()
				checkBox1.Checked = True
				checkBox1.Font = originalFont
				checkBox1.AutoSize = True
				checkBox1.Click += form.chart_showLegend
				#Add a checkBox to show/hide labels
				checkBox2 = CheckBox()
				checkBox2.AutoCheck = True
				checkBox2.Name = "checkBox2"
				checkBox2.Text = "Labels"
				panelChart.Controls.Add(checkBox2)
				checkBox2.BringToFront()
				checkBox2.Checked = True
				checkBox2.Font = originalFont
				checkBox2.AutoSize = True
				checkBox2.Click += form.chart_showLabels
				
				panelChart.Size = Size(panelChart.Width, panelChart.Width + checkBox2.Height + 20)
				#Add chart to panel
				panelChart.Controls.Add(chart1)
				chart1.Location = Point(0,0)
				bt.Location = Point(panelChart.Width - bt.Width, panelChart.Width + 15)
				checkBox1.Location = Point(panelChart.Width - bt.Width - 80, panelChart.Width + 15)
				checkBox2.Location = Point(panelChart.Width - bt.Width - 160, panelChart.Width + 15)
				formbody.Controls.Add(panelChart)
				
				y = panelChart.Bottom + 25 * yRatio
				
			elif j.__class__.__name__ == 'uiradarchart':
				if isinstance(j.labels,list):
					labels = j.labels
				else:
					labels = [j.labels]
				inputcolors = j.inputcolors
				pyList = []
				if isinstance(j.xseries[0],list) and isinstance(j.yseries[0],list):
					nbOfSeries = len(j.xseries)
					xseries = j.xseries
					yseries = j.yseries
				elif isinstance(j.xseries[0],list) == False and isinstance(j.yseries[0],list):
					nbOfSeries = len(j.yseries)
					xseries = []
					i = 1
					while i <= nbOfSeries:
						xseries.append(j.xseries)
						i = i + 1
					yseries = j.yseries
				elif isinstance(j.yseries[0],list) == False and isinstance(j.xseries[0],list):
					nbOfSeries = len(j.xseries)
					yseries = []
					i = 1
					while i <= nbOfSeries:
						yseries.append(j.yseries)
						i = i + 1
					xseries = j.xseries
				else:
					xseries = [j.xseries]
					yseries = [j.yseries]
					nbOfSeries = 1
				if inputcolors is not None:
					colorBool = True
					for color in inputcolors:
						pyList.append(Color.FromArgb(color.Red,color.Green,color.Blue))
					wfColor = Array[Color](pyList)
				else:
					colorBool = False
				#Set a global Font code
				fontFam = FontFamily("Segoe UI Symbol")
				originalFont = Font(fontFam,8)
				#Chart created and Panel to host the chart
				chart1 = Chart()
				panelChart = Panel()
				panelChart.Name = "panelChart"
				#Create a panel for buttons
				panelCtrls = Panel()
				#Panels colors
				chart1.BackColor = formbody.BackColor
				panelChart.BackColor = Color.Transparent
				panelCtrls.BackColor = Color.Transparent
				#PanelChart location
				panelChart.Width = formwidth  - rightmargin - xlabel
				panelChart.Location = Point(xlabel,y + 30)				
				autoheight = 250 * yRatio			
				panelChart.Height = autoheight + 73 * yRatio
				ratio = (panelChart.Height)/(panelChart.Width)
				h = float(panelChart.Height)
				w = float(panelChart.Width)
				ratio = h/w
				chart_maxsize = formwidth - xlabel - rightmargin
				panelChart.Size = Size(chart_maxsize,chart_maxsize*ratio)				
				#Chart colors palette
				chart1.Palette =  ChartColorPalette.None
				if colorBool:
					chart1.PaletteCustomColors = wfColor
				else:
					chart1.Palette =  ChartColorPalette.None
				chart1.Series.Clear()
				#Series created
				def createSeries(seriesName,_keys,_values):
					srs = Series()
					srs.Name = seriesName
					srs.ChartType = SeriesChartType.Radar
					srs.ToolTip = "Percent: #PERCENT"
					srs.IsValueShownAsLabel = True
					srs.Font = originalFont
					srs.BorderWidth = 4
					for i,j in zip(_keys,_values):
						srs.Points.AddXY(i,j)
					return srs
				#Create series
				series = []
				for i in range(0,nbOfSeries):
					series.append(createSeries(labels[i],xseries[i],yseries[i]))
				#Add series to chart
				for s in series:
					chart1.Series.Add(s)
				#Refresh the Chart
				chart1.Invalidate()
				#Create a ChartArea and add it to the chart
				chartArea1 = ChartArea()
				chartArea1.BackColor = formbody.BackColor
				chartArea1.Name = "ChartArea1"
				chartArea1.AxisX.Title = j.xaxislabel
				chartArea1.AxisY.Title = j.yaxislabel
				chart1.ChartAreas.Add(chartArea1)
				#Create a Legend and add it to the chart
				legend1 = Legend()
				legend1.BackColor = formbody.BackColor
				legend1.Font = originalFont
				legend1.Name = "Legend1"
				chart1.Legends.Add(legend1) 
				#Initialize the chart and its properties
				chart1.BeginInit()
				chart1.Dock = DockStyle.Fill
				chart1.AntiAliasing = AntiAliasingStyles.All
				fontFam = FontFamily("Segoe UI Symbol")
				titleFont = Font(fontFam,10,FontStyle.Bold)
				title = Title()
				title.Text = j.chartname
				title.Alignment = ContentAlignment.TopLeft
				title.Font = titleFont
				chart1.Titles.Add(title)
				#Add a button to push on view
				bt = Button()
				bt.Tag = "Push the chart on a view in Revit"
				bt.Text = "Push on a draft view"
				bt.Height = 20 * yRatio
				bt.Width = 140 * yRatio				
				panelCtrls.Controls.Add(bt)
				bt.BringToFront()
				bt.Click += form.imageexport
				#Add a checkBox to show/hide legend
				checkBox1 = CheckBox()
				checkBox1.AutoCheck = True
				checkBox1.Name = "checkBox1"
				checkBox1.Text = "Show/Hide legend"
				panelCtrls.Controls.Add(checkBox1)
				checkBox1.BringToFront()
				checkBox1.Checked = True
				checkBox1.AutoSize = True
				checkBox1.Click += form.chart_showLegend
				
				#Add a checkBox to show/hide labels
				checkBox2 = CheckBox()
				checkBox2.AutoCheck = True
				checkBox2.Name = "checkBox2"
				checkBox2.Text = "Show/Hide labels"
				panelCtrls.Controls.Add(checkBox2)
				checkBox2.BringToFront()
				checkBox2.Checked = True
				checkBox2.Font = originalFont
				checkBox2.AutoSize = True
				checkBox2.Click += form.chart_showLabels
				
				panelChart.Size = Size(panelChart.Width, panelChart.Width + checkBox2.Height + 20)
				#Add chart to panel
				panelChart.Controls.Add(chart1)
				chart1.Location = Point(0,0)
				bt.Location = Point(panelChart.Width - bt.Width, panelChart.Width + 15)
				checkBox1.Location = Point(panelChart.Width - bt.Width - 80, panelChart.Width + 15)
				checkBox2.Location = Point(panelChart.Width - bt.Width - 160, panelChart.Width + 15)
				formbody.Controls.Add(panelChart)
				
				y = panelChart.Bottom + 25 * yRatio
				
			elif j.__class__.__name__ == 'uipointchart':
				if isinstance(j.labels,list):
					labels = j.labels
				else:
					labels = [j.labels]
				inputcolors = j.inputcolors
				pyList = []
				if isinstance(j.xseries[0],list) and isinstance(j.yseries[0],list):
					nbOfSeries = len(j.xseries)
					xseries = j.xseries
					yseries = j.yseries
				elif isinstance(j.xseries[0],list) == False and isinstance(j.yseries[0],list):
					nbOfSeries = len(j.yseries)
					xseries = []
					i = 1
					while i <= nbOfSeries:
						xseries.append(j.xseries)
						i = i + 1
					yseries = j.yseries
				elif isinstance(j.yseries[0],list) == False and isinstance(j.xseries[0],list):
					nbOfSeries = len(j.xseries)
					yseries = []
					i = 1
					while i <= nbOfSeries:
						yseries.append(j.yseries)
						i = i + 1
					xseries = j.xseries
				else:
					xseries = [j.xseries]
					yseries = [j.yseries]
					nbOfSeries = 1
				if inputcolors is not None:
					colorBool = True
					for color in inputcolors:
						pyList.append(Color.FromArgb(color.Red,color.Green,color.Blue))
					wfColor = Array[Color](pyList)
				else:
					colorBool = False
				#Set a global Font code
				fontFam = FontFamily("Segoe UI Symbol")
				originalFont = Font(fontFam,8)
				#Chart created and Panel to host the chart
				chart1 = Chart()
				panelChart = Panel()
				panelChart.Name = "panelChart"
				#Panels colors
				chart1.BackColor = formbody.BackColor
				panelChart.BackColor = Color.Transparent
				#PanelChart location
				panelChart.Width = formwidth  - rightmargin - xlabel
				panelChart.Location = Point(xlabel,y + 30)				
				#Chart colors palette
				chart1.Palette =  ChartColorPalette.None
				if colorBool:
					chart1.PaletteCustomColors = wfColor
				else:
					chart1.Palette =  ChartColorPalette.None
				chart1.Series.Clear()
				#Series created
				def createSeries(seriesName,_keys,_values):
					srs = Series()
					srs.Name = seriesName
					srs.ChartType = SeriesChartType.Point
					srs.ToolTip = "Percent: #PERCENT"
					srs.IsValueShownAsLabel = True
					srs.Font = originalFont
					for i,j in zip(_keys,_values):
						srs.Points.AddXY(i,j)
					return srs
				#Create series
				series = []
				for i in range(0,nbOfSeries):
					series.append(createSeries(labels[i],xseries[i],yseries[i]))
				#Add series to chart
				for s in series:
					chart1.Series.Add(s)
				#Change marker size
				originalMarkerSize = 8
				for s in series:
					for p in s.Points:
						p.MarkerSize = originalMarkerSize
				#Refresh the Chart
				chart1.Invalidate()
				#Create a ChartArea and add it to the chart
				chartArea1 = ChartArea()
				chartArea1.BackColor = formbody.BackColor
				chartArea1.Name = "ChartArea1"
				chartArea1.AxisX.Title = j.xaxislabel
				chartArea1.AxisY.Title = j.yaxislabel
				chart1.ChartAreas.Add(chartArea1)
				chartArea1 = chart1.ChartAreas[0]
				#Create a Legend and add it to the chart
				legend1 = Legend()
				legend2 = Legend()
				#Add legends to charts
				chart1.Legends.Add(legend1)
				chart1.Legends.Add(legend2)
				#Create Custom legend
				customevent = CustomizeLegendEventArgs(legend2.CustomItems)
				for s in series:
					legend2.CustomItems.Add(LegendItem(s.Name.ToString(),s.Color,""))					
				def chart_CustomizeLegend(sender, customevent ):
					chart1 = sender
					#legend1.Enabled = False
					legend2.Name = "Legend2"
					for s,it in zip(series,legend2.CustomItems):
						it.ImageStyle = LegendImageStyle.Marker
						it.MarkerStyle = s.MarkerStyle
						it.MarkerColor = s.Color
						it.BorderColor = Color.Transparent
						it.MarkerSize *= 1.3
				legend1.Enabled = False
				legend2.Font = originalFont
				legend2.IsTextAutoFit = True
				legend2.BackColor = formbody.BackColor			
				chart1.CustomizeLegend += chart_CustomizeLegend
				#Initialize the chart and its properties
				chart1.BeginInit()
				chart1.Size = Size(panelChart.Width,panelChart.Width)
				chart1.AntiAliasing = AntiAliasingStyles.All
				fontFam = FontFamily("Segoe UI Symbol")
				titleFont = Font(fontFam,10,FontStyle.Bold)
				title = Title()
				title.Text = j.chartname
				title.Alignment = ContentAlignment.TopLeft
				title.Font = titleFont
				chart1.Titles.Add(title)
				#Add a button to push on view
				bt = Button()
				bt.Tag = "Push the chart on a view in Revit"
				bt.Text = "Push on a draft view"
				bt.Height = 20 * yRatio
				bt.Width = 140 * yRatio				
				panelChart.Controls.Add(bt)
				bt.BringToFront()
				bt.Click += form.imageexport
				#Add a checkBox to show/hide legend
				checkBox1 = CheckBox()
				checkBox1.AutoCheck = True
				checkBox1.Name = "checkBox1"
				checkBox1.Text = "Legend"
				panelChart.Controls.Add(checkBox1)
				checkBox1.BringToFront()
				checkBox1.Checked = True
				checkBox1.AutoSize = True
				checkBox1.Click += form.chart_showLegend
				
				#Add a checkBox to show/hide labels
				checkBox2 = CheckBox()
				checkBox2.AutoCheck = True
				checkBox2.Name = "checkBox2"
				checkBox2.Text = "Labels"
				panelChart.Controls.Add(checkBox2)
				checkBox2.BringToFront()
				checkBox2.Checked = True
				checkBox2.Font = originalFont
				checkBox2.AutoSize = True
				checkBox2.Click += form.chart_showLabels
				
				panelChart.Size = Size(panelChart.Width, panelChart.Width + checkBox2.Height + 20)
				#Add chart to panel
				panelChart.Controls.Add(chart1)
				chart1.Location = Point(0,0)
				bt.Location = Point(panelChart.Width - bt.Width, panelChart.Width + 15)
				checkBox1.Location = Point(panelChart.Width - bt.Width - 80, panelChart.Width + 15)
				checkBox2.Location = Point(panelChart.Width - bt.Width - 160, panelChart.Width + 15)
				formbody.Controls.Add(panelChart)
				
				y = panelChart.Bottom + 25 * yRatio
								
			elif j.__class__.__name__ == 'uilinechart':
				if isinstance(j.labels,list):
					labels = j.labels
				else:
					labels = [j.labels]
				inputcolors = j.inputcolors
				pyList = []
				if isinstance(j.xseries[0],list) and isinstance(j.yseries[0],list):
					nbOfSeries = len(j.xseries)
					xseries = j.xseries
					yseries = j.yseries
				elif isinstance(j.xseries[0],list) == False and isinstance(j.yseries[0],list):
					nbOfSeries = len(j.yseries)
					xseries = []
					i = 1
					while i <= nbOfSeries:
						xseries.append(j.xseries)
						i = i + 1
					yseries = j.yseries
				elif isinstance(j.yseries[0],list) == False and isinstance(j.xseries[0],list):
					nbOfSeries = len(j.xseries)
					yseries = []
					i = 1
					while i <= nbOfSeries:
						yseries.append(j.yseries)
						i = i + 1
					xseries = j.xseries
				else:
					xseries = [j.xseries]
					yseries = [j.yseries]
					nbOfSeries = 1
				if inputcolors is not None:
					colorBool = True
					for color in inputcolors:
						pyList.append(Color.FromArgb(color.Red,color.Green,color.Blue))
					wfColor = Array[Color](pyList)
				else:
					colorBool = False
				#Set a global Font code
				fontFam = FontFamily("Segoe UI Symbol")
				originalFont = Font(fontFam,8)
				#Chart created and Panel to host the chart
				chart1 = Chart()
				panelChart = Panel()
				panelChart.Name = "panelChart"
				#Panels colors
				chart1.BackColor = formbody.BackColor
				panelChart.BackColor = Color.Transparent
				#PanelChart location
				panelChart.Width = formwidth  - rightmargin - xlabel
				panelChart.Location = Point(xlabel,y + 30)				
				#Chart colors palette
				chart1.Palette =  ChartColorPalette.None
				if colorBool:
					chart1.PaletteCustomColors = wfColor
				else:
					chart1.Palette =  ChartColorPalette.None
				chart1.Series.Clear()
				#Series created
				def createSeries(seriesName,_keys,_values):
					srs = Series()
					srs.Name = seriesName
					srs.ChartType = SeriesChartType.Line
					srs.ToolTip = "Percent: #PERCENT"
					srs.IsValueShownAsLabel = True
					srs.Font = originalFont
					srs.BorderWidth = 4
					for i,j in zip(_keys,_values):
						srs.Points.AddXY(i,j)
					return srs
				#Create series
				series = []
				for i in range(0,nbOfSeries):
					series.append(createSeries(labels[i],xseries[i],yseries[i]))
				#Add series to chart
				for s in series:
					chart1.Series.Add(s)
				#Refresh the Chart
				chart1.Invalidate()
				#Create a ChartArea and add it to the chart
				chartArea1 = ChartArea()
				chartArea1.BackColor = formbody.BackColor
				chartArea1.Name = "ChartArea1"
				chartArea1.AxisX.Title = j.xaxislabel
				chartArea1.AxisY.Title = j.yaxislabel
				chart1.ChartAreas.Add(chartArea1)
				#Create a Legend and add it to the chart
				legend1 = Legend()
				legend1.BackColor = formbody.BackColor
				legend1.Font = originalFont
				legend1.Name = "Legend1"
				chart1.Legends.Add(legend1) 
				#Initialize the chart and its properties
				chart1.BeginInit()
				chart1.Size = Size(panelChart.Width,panelChart.Width)
				chart1.AntiAliasing = AntiAliasingStyles.All
				fontFam = FontFamily("Segoe UI Symbol")
				titleFont = Font(fontFam,10,FontStyle.Bold)
				title = Title()
				title.Text = j.chartname
				title.Alignment = ContentAlignment.TopLeft
				title.Font = titleFont
				chart1.Titles.Add(title)
				#Add a button to push on view
				bt = Button()
				bt.Tag = "Push the chart on a view in Revit"
				bt.Text = "Push on a draft view"
				bt.Height = 20 * yRatio
				bt.Width = 140 * yRatio				
				panelChart.Controls.Add(bt)
				bt.BringToFront()
				bt.Click += form.imageexport
				#Add a checkBox to show/hide legend
				checkBox1 = CheckBox()
				checkBox1.AutoCheck = True
				checkBox1.Name = "checkBox1"
				checkBox1.Text = "Legend"
				panelChart.Controls.Add(checkBox1)
				checkBox1.BringToFront()
				checkBox1.Checked = True
				checkBox1.AutoSize = True
				checkBox1.Click += form.chart_showLegend
				
				#Add a checkBox to show/hide labels
				checkBox2 = CheckBox()
				checkBox2.AutoCheck = True
				checkBox2.Name = "checkBox2"
				checkBox2.Text = "Labels"
				panelChart.Controls.Add(checkBox2)
				checkBox2.BringToFront()
				checkBox2.Checked = True
				checkBox2.Font = originalFont
				checkBox2.AutoSize = True
				checkBox2.Click += form.chart_showLabels
				
				panelChart.Size = Size(panelChart.Width, panelChart.Width + checkBox2.Height + 20)
				#Add chart to panel
				panelChart.Controls.Add(chart1)
				chart1.Location = Point(0,0)
				bt.Location = Point(panelChart.Width - bt.Width, panelChart.Width + 15)
				checkBox1.Location = Point(panelChart.Width - bt.Width - 80, panelChart.Width + 15)
				checkBox2.Location = Point(panelChart.Width - bt.Width - 160, panelChart.Width + 15)
				formbody.Controls.Add(panelChart)
				
				y = panelChart.Bottom + 25 * yRatio
			
			elif j.__class__.__name__ == 'uisplinechart':
				if isinstance(j.labels,list):
					labels = j.labels
				else:
					labels = [j.labels]
				inputcolors = j.inputcolors
				pyList = []
				if isinstance(j.xseries[0],list) and isinstance(j.yseries[0],list):
					nbOfSeries = len(j.xseries)
					xseries = j.xseries
					yseries = j.yseries
				elif isinstance(j.xseries[0],list) == False and isinstance(j.yseries[0],list):
					nbOfSeries = len(j.yseries)
					xseries = []
					i = 1
					while i <= nbOfSeries:
						xseries.append(j.xseries)
						i = i + 1
					yseries = j.yseries
				elif isinstance(j.yseries[0],list) == False and isinstance(j.xseries[0],list):
					nbOfSeries = len(j.xseries)
					yseries = []
					i = 1
					while i <= nbOfSeries:
						yseries.append(j.yseries)
						i = i + 1
					xseries = j.xseries
				else:
					xseries = [j.xseries]
					yseries = [j.yseries]
					nbOfSeries = 1
				if inputcolors is not None:
					colorBool = True
					for color in inputcolors:
						pyList.append(Color.FromArgb(color.Red,color.Green,color.Blue))
					wfColor = Array[Color](pyList)
				else:
					colorBool = False
				#Set a global Font code
				fontFam = FontFamily("Segoe UI Symbol")
				originalFont = Font(fontFam,8)
				#Chart created and Panel to host the chart
				chart1 = Chart()
				panelChart = Panel()
				panelChart.Name = "panelChart"
				#Panels colors
				chart1.BackColor = formbody.BackColor
				panelChart.BackColor = Color.Transparent
				#PanelChart location
				panelChart.Width = formwidth  - rightmargin - xlabel
				panelChart.Location = Point(xlabel,y + 30)				
				#Chart colors palette
				chart1.Palette =  ChartColorPalette.None
				if colorBool:
					chart1.PaletteCustomColors = wfColor
				else:
					chart1.Palette =  ChartColorPalette.None
				chart1.Series.Clear()
				#Series created
				def createSeries(seriesName,_keys,_values):
					srs = Series()
					srs.Name = seriesName
					srs.ChartType = SeriesChartType.Spline
					srs.ToolTip = "Percent: #PERCENT"
					srs.IsValueShownAsLabel = True
					srs.Font = originalFont
					srs.BorderWidth = 4
					for i,j in zip(_keys,_values):
						srs.Points.AddXY(i,j)
					return srs
				#Create series
				series = []
				for i in range(0,nbOfSeries):
					series.append(createSeries(labels[i],xseries[i],yseries[i]))
				#Add series to chart
				for s in series:
					chart1.Series.Add(s)
				#Refresh the Chart
				chart1.Invalidate()
				#Create a ChartArea and add it to the chart
				chartArea1 = ChartArea()
				chartArea1.BackColor = formbody.BackColor
				chartArea1.Name = "ChartArea1"
				chartArea1.AxisX.Title = j.xaxislabel
				chartArea1.AxisY.Title = j.yaxislabel
				chart1.ChartAreas.Add(chartArea1)
				#Create a Legend and add it to the chart
				legend1 = Legend()
				legend1.BackColor = formbody.BackColor
				legend1.Font = originalFont
				legend1.Name = "Legend1"
				chart1.Legends.Add(legend1) 
				#Initialize the chart and its properties
				chart1.BeginInit()
				chart1.Size = Size(panelChart.Width,panelChart.Width)
				chart1.AntiAliasing = AntiAliasingStyles.All
				fontFam = FontFamily("Segoe UI Symbol")
				titleFont = Font(fontFam,10,FontStyle.Bold)
				title = Title()
				title.Text = j.chartname
				title.Alignment = ContentAlignment.TopLeft
				title.Font = titleFont
				chart1.Titles.Add(title)
				#Add a button to push on view
				bt = Button()
				bt.Tag = "Push the chart on a view in Revit"
				bt.Text = "Push on a draft view"
				bt.Height = 20 * yRatio
				bt.Width = 140 * yRatio			
				panelChart.Controls.Add(bt)
				bt.BringToFront()
				bt.Click += form.imageexport
				#Add a checkBox to show/hide legend
				checkBox1 = CheckBox()
				checkBox1.AutoCheck = True
				checkBox1.Name = "checkBox1"
				checkBox1.Text = "Legend"
				panelChart.Controls.Add(checkBox1)
				checkBox1.BringToFront()
				checkBox1.Checked = True
				checkBox1.AutoSize = True
				checkBox1.Click += form.chart_showLegend
				
				#Add a checkBox to show/hide labels
				checkBox2 = CheckBox()
				checkBox2.AutoCheck = True
				checkBox2.Name = "checkBox2"
				checkBox2.Text = "Labels"
				panelChart.Controls.Add(checkBox2)
				checkBox2.BringToFront()
				checkBox2.Checked = True
				checkBox2.Font = originalFont
				checkBox2.AutoSize = True
				checkBox2.Click += form.chart_showLabels
				
				panelChart.Size = Size(panelChart.Width, panelChart.Width + checkBox2.Height + 20)
				#Add chart to panel
				panelChart.Controls.Add(chart1)
				chart1.Location = Point(0,0)
				bt.Location = Point(panelChart.Width - bt.Width, panelChart.Width + 15)
				checkBox1.Location = Point(panelChart.Width - bt.Width - 80, panelChart.Width + 15)
				checkBox2.Location = Point(panelChart.Width - bt.Width - 160, panelChart.Width + 15)
				formbody.Controls.Add(panelChart)
				
				y = panelChart.Bottom + 25 * yRatio
				
			elif j.__class__.__name__ == 'uibubblechart':
				if isinstance(j.labels,list):
					labels = j.labels
				else:
					labels = [j.labels]
				inputcolors = j.inputcolors
				pyList = []
				if isinstance(j.xseries[0],list) and isinstance(j.yseries[0],list):
					nbOfSeries = len(j.xseries)
					xseries = j.xseries
					yseries = j.yseries
				elif isinstance(j.xseries[0],list) == False and isinstance(j.yseries[0],list):
					nbOfSeries = len(j.yseries)
					xseries = []
					i = 1
					while i <= nbOfSeries:
						xseries.append(j.xseries)
						i = i + 1
					yseries = j.yseries
				elif isinstance(j.yseries[0],list) == False and isinstance(j.xseries[0],list):
					nbOfSeries = len(j.xseries)
					yseries = []
					i = 1
					while i <= nbOfSeries:
						yseries.append(j.yseries)
						i = i + 1
					xseries = j.xseries
				else:
					xseries = [j.xseries]
					yseries = [j.yseries]
					nbOfSeries = 1
				if inputcolors is not None:
					colorBool = True
					for color in inputcolors:
						pyList.append(Color.FromArgb(color.Red,color.Green,color.Blue))
					wfColor = Array[Color](pyList)
				else:
					colorBool = False
				#Set a global Font code
				fontFam = FontFamily("Segoe UI Symbol")
				originalFont = Font(fontFam,8)
				#Chart created and Panel to host the chart
				chart1 = Chart()
				panelChart = Panel()
				#panelChart.Padding = Padding(1) To create a black border
				chart1.BackColor = formbody.BackColor
				panelChart.BackColor = Color.Transparent
				#PanelChart location
				panelChart.Width = formwidth  - rightmargin - xlabel
				panelChart.Location = Point(xlabel,y + 30)				
				autoheight = 250 * yRatio			
				panelChart.Height = autoheight + 73 * yRatio
				ratio = (panelChart.Height)/(panelChart.Width)
				h = float(panelChart.Height)
				w = float(panelChart.Width)
				ratio = h/w
				chart_maxsize = formwidth - xlabel - rightmargin
				panelChart.Size = Size(chart_maxsize,chart_maxsize*ratio)				
				#Chart colors palette
				chart1.Palette =  ChartColorPalette.None
				if colorBool:
					chart1.PaletteCustomColors = wfColor
				else:
					chart1.Palette =  ChartColorPalette.None
				chart1.Series.Clear()
				#Series created
				def createSeries(seriesName,_keys,_values):
					srs = Series()
					srs.Name = seriesName
					srs.ChartType = SeriesChartType.Bubble
					srs.ToolTip = "Percent: #PERCENT"
					srs.Font = originalFont
					for i,j in zip(_keys,_values):
						srs.Points.AddXY(i,j)
					return srs
				#Create series
				series = []
				for i in range(0,nbOfSeries):
					series.append(createSeries(labels[i],xseries[i],yseries[i]))
				#Add series to chart
				for s in series:
					chart1.Series.Add(s)
				#Refresh the Chart
				chart1.Invalidate()
				#Create a ChartArea and add it to the chart
				chartArea1 = ChartArea()
				chartArea1.BackColor = formbody.BackColor
				chartArea1.Name = "ChartArea1"
				chartArea1.AxisX.Title = j.xaxislabel
				chartArea1.AxisY.Title = j.yaxislabel
				chart1.ChartAreas.Add(chartArea1)
				#Create a Legend and add it to the chart
				legend1 = Legend()
				legend1.BackColor = formbody.BackColor
				legend1.Font = originalFont
				legend1.Name = "Legend1"
				chart1.Legends.Add(legend1) 
				#Initialize the chart and its properties
				chart1.BeginInit()
				chart1.Dock = DockStyle.Fill
				chart1.AntiAliasing = AntiAliasingStyles.All
				fontFam = FontFamily("Segoe UI Symbol")
				titleFont = Font(fontFam,10,FontStyle.Bold)
				title = Title()
				title.Text = j.chartname
				title.Alignment = ContentAlignment.TopLeft
				title.Font = titleFont
				chart1.Titles.Add(title)
				#Add a button to push on view
				bt = Button()
				bt.Tag = "Push the chart on a view in Revit"
				bt.Text = "Push on a draft view"
				bt.Height = 20 * yRatio
				bt.Width = 140 * yRatio			
				panelChart.Controls.Add(bt)
				bt.BringToFront()
				bt.Click += form.imageexport
				#Add a checkBox to show/hide legend
				checkBox1 = CheckBox()
				checkBox1.AutoCheck = True
				checkBox1.Name = "checkBox1"
				checkBox1.Text = "Show/Hide legend"
				panelChart.Controls.Add(checkBox1)
				checkBox1.BringToFront()
				checkBox1.Checked = True
				checkBox1.Click += form.chart_showLegend
				#Add chart to panel
				panelChart.Size = Size(panelChart.Width, panelChart.Width + checkBox2.Height + 20)
				#Add chart to panel
				panelChart.Controls.Add(chart1)
				chart1.Location = Point(0,0)
				bt.Location = Point(panelChart.Width - bt.Width, panelChart.Width + 15)
				checkBox1.Location = Point(panelChart.Width - bt.Width - 80, panelChart.Width + 15)
				checkBox2.Location = Point(panelChart.Width - bt.Width - 160, panelChart.Width + 15)
				formbody.Controls.Add(panelChart)
				
				y = panelChart.Bottom + 25 * yRatio

			elif j.__class__.__name__ == 'uitreeview':
				tv = TreeView()
				tv.CheckBoxes = True
				titles = j._hastitles
				if j.inputname != "":
					tv.Width = formwidth - rightmargin - xinput
					tv.Location = Point(xinput,y)
				else:
					tv.Width = formwidth - rightmargin - xlabel
					tv.Location = Point(xlabel,y)
				tv.Height = j._height
				def treeIterationTitle(control, input):
					if isinstance(input,list):
						try:
							currentNode = TreeNode(remove_accents(input[0].ToString()))
							currentNode.Tag = ""
							input.pop(0)
						except:
							currentNode = TreeNode(control.Text +"."+ str(len(control.Nodes)+1))
							currentNode.Tag = ""
						control.Nodes.Add(currentNode)
						for i in input:
							treeIterationTitle(currentNode, i)
					else:
						item = TreeNode(remove_accents(input.ToString()))
						item.Tag = input
						control.Nodes.Add(item)	
				def treeIteration(control, input):
					if isinstance(input,list):
						currentNode = TreeNode(control.Text +"."+ str(len(control.Nodes)+1))
						currentNode.Tag = input
						control.Nodes.Add(currentNode)
						for i in input:
							treeIteration(currentNode, i)
					else:
						item = TreeNode(remove_accents(input.ToString()))
						item.Tag = input
						control.Nodes.Add(item)
				currentNode = TreeNode("List1")
				currentNode.Expand()				
				if titles:
					tv.Nodes.Add(currentNode)								
					for dl in j.datalist:
						treeIterationTitle(currentNode,dl)	
				else:
					tv.Nodes.Add(currentNode)								
					for dl in j.datalist:
						treeIteration(currentNode,dl)
				tv.AfterCheck += form.CheckChildren						
				formbody.Controls.Add(tv)
				form.output.append(tv)
				y = tv.Bottom + 25 * yRatio
			elif j.__class__.__name__ == 'listview':
				lvp = Panel()
				if j.inputname != "":
					lvp.Location = Point(xinput,y)
					lvp.Width = formwidth - rightmargin - xinput				
				elif j.inputname == "" and j.element_count != 0:
					lvp.Location = Point(xlabel,y+35*yRatio)
					lvp.Width = formwidth - rightmargin - xlabel
				else : 
					lvp.Location = Point(xlabel,y)
					lvp.Width = formwidth - rightmargin - xlabel				
				lvp.Height = j.height * yRatio + 25 * yRatio
				#Creating the listview box
				lv = mylistview()
				lv.Scrollable = True
				dummyheader = ColumnHeader()
				dummyheader.Text = ""
				dummyheader.Name = ""
				dummyheader.Width = -2 * xRatio
				lv.HeaderStyle = ColumnHeaderStyle.None
				lv.Columns.Add(dummyheader)
				lv.Values = j
				if not j.display_mode:
					lv.CheckBoxes = True
				lv.View = vi.Details
				lvItems =  [i for i in j.keys() if not (i == 'inputname' or i == 'height' or i == 'highlight' or i == 'display_mode' or i == 'element_count' or i == 'default_values' or i == 'sorted' or i == 'showId')]
				if j.sorted :
					lvItems = sorted(lvItems,key = remove_accents)
				else:
					pass
				[lv.Items.Add(i) for i in lvItems]
				lv.Location = Point(0,0)
				if j.inputname != "" and j.element_count != 0:
					lv.Width = formwidth - rightmargin - xinput
				elif j.inputname != "" and j.element_count == 0:
					lv.Width = formwidth - rightmargin - xinput
				else:
					lv.Width = formwidth - rightmargin - xlabel
				lv.Height = j.height * yRatio
				lv.Scrollable = True
				lv.ItemCheck += form.updateallnone
				for i in j.default_values:
					defInd = lvItems.index([x for x in j.keys() if not (x == 'inputname' or x == 'height' or x == 'highlight' or x == 'display_mode' or x == 'element_count' or x == 'default_values' or x == 'sorted' or x == 'showId')][i])
					lv.Items[defInd].Checked = True
				#Click listview items to hilight and center in appropriate view
				if j.highlight :
					lv.MouseDown += form.setviewforelement
					lv.MouseUp += form.zoomcenter
					items = list(lv.Items)
					lv.FullRowSelect = True
					del items[::2]
					for item in items:
						item.BackColor = Color.FromArgb(230,243,255)
				#Creating select all and select none radiobuttons
				if not j.display_mode:
					rball = RadioButton()
					rball.Location = Point(0,(j.height+5)*yRatio)
					rball.Width = 100 * xRatio
					rball.Height = 20 * yRatio
					rball.Font = SystemFonts.DefaultFont
					rball.Text = "Select all"
					rball.Click += form.selectall
					rbnone = RadioButton()
					rbnone.Location = Point(105 * xRatio,(j.height+5)*yRatio)
					rbnone.Width = 100 * xRatio
					rbnone.Height = 20 * yRatio
					rbnone.Font = SystemFonts.DefaultFont
					rbnone.Text = "Select none"			
					rbnone.Click += form.selectnone			
				#Adding controls to panel
				lvp.Controls.Add(lv)
				if not j.display_mode:
					lvp.Controls.Add(rball)
					lvp.Controls.Add(rbnone)
				formbody.Controls.Add(lvp)
				if not j.display_mode:
					form.output.append(lv)
				y = lvp.Bottom + 25 * yRatio
			elif j.__class__.__name__ == 'uitext':
				tb = myTextBox()
				tb.Text = j.defaultvalue
				if j.inputname != "":
					tb.Width = formwidth  - rightmargin - xinput
					tb.Location = Point(xinput,y)
				else:
					tb.Width = formwidth - rightmargin - xlabel
					tb.Location = Point(xlabel,y)
				if j._isnum:
					tb._isNum = True
					tb.KeyPress += form.numsOnly
				formbody.Controls.Add(tb)
				formbody.Controls.Add(label)
				form.output.append(tb)
				y = label.Bottom + 25 * yRatio
			elif j.__class__.__name__ == 'uimultilinetext':
				tb = myTextBox()
				tb.Text = j.defaultvalue
				tb.Multiline  = True
				tb.Height = j._height * yRatio
				if j.inputname != "":
					tb.Width = formwidth  - rightmargin - xinput
					tb.Location = Point(xinput,y)
				else:
					tb.Width = formwidth - rightmargin - xlabel
					tb.Location = Point(xlabel,y)
				if j._isnum:
					tb._isNum = True
					tb.KeyPress += form.numsOnly
				formbody.Controls.Add(tb)
				formbody.Controls.Add(label)
				form.output.append(tb)
				y = tb.Bottom + 25 * yRatio								
			elif j.__class__.__name__ == 'tableview':
				#Creating grouping panel
				tvp = Panel()
				tvp.Location = Point(xlabel,y)
				tvp.Width = formwidth - rightmargin - xlabel
				if (50 + len(j.dataList) * 15) * yRatio > 800 * yRatio:
					autoheight = 800 * yRatio
				else:
					autoheight = (50 + len(j.dataList) * 15	) * yRatio			
				tvp.Height = autoheight + 73 * yRatio
				#Creating title
				titlep = Label()
				titlep.Text = j._tabletitle
				titlep.Width = formwidth - rightmargin - xlabel
				titlep.BackColor = Color.FromArgb(153,180,209)
				titlep.Font = Font("Arial", 11, FontStyle.Bold)
				titlep.TextAlign = ContentAlignment.MiddleLeft
				titlep.BorderStyle = BorderStyle.FixedSingle
				titlep.Location = Point(0,0)
				tvp.Controls.Add(titlep)
				#Creating data structure
				dg = myDataGridView()
				#dg.SelectionMode = DataGridViewSelectionMode.CellSelect
				dg.EnableHeadersVisualStyles = False				
				dt = DataTable()
				dl = j.dataList
				for i in range(len(dl[0])):
					if j._hasTitle:
						dt.Columns.Add(remove_accents(dl[0][i].ToString()))
						rngstart = 1
					else:
						dt.Columns.Add("Column " + str(i))
						rngstart = 0						
				for rindex in range(rngstart,len(dl)):
					row = dt.NewRow()
					for i in range(len(dl[rindex])):
						row[i] = dl[rindex][i]
					dt.Rows.Add(row)						
				dg.Tag = j._hasTitle				
				dg.DataSource = dt
				dg.ClipboardCopyMode = DataGridViewClipboardCopyMode.EnableWithAutoHeaderText
				dg.AutoSizeColumnsMode = DataGridViewAutoSizeColumnsMode.AllCells
				dg.Width = formwidth - rightmargin - xlabel
				dg.Location = Point(0,23 * yRatio)
				dg.Height = autoheight
				#Creatin Excel like drag copy functionalities
				dg.CellMouseDown += form.startCell
				dg.CellMouseUp += form.endCell
				#dg.MouseDown += form.startRowDrag
				#dg.MouseUp = 			
				tvp.Controls.Add(dg)			
				y = tvp.Bottom + 15 * yRatio
				#Adding export to excel button
				ex = Button()
				ex.Tag = [j._hasTitle , j._openExcel , j._showinfo , j._fileInfo]
				try:
					expImage = getImageByName("exp.png")[0]
					ex.BackgroundImage = expImage
				except:
					ex.Text = "Export"					
				ex.Width = 60 * xRatio
				ex.Height = 30 * yRatio
				ex.Location = Point(formwidth - 125 * xRatio ,dg.Bottom + 15 * yRatio)					
				tvp.Controls.Add(ex)
				ex.Click += form.exportToExcel
				#Adding filepath export textbox
				filepathtb = TextBox()
				filepathtb.Text = "ExportFileName"
				filepathtb.Location = Point(0 ,dg.Bottom + 20 * yRatio)
				filepathtb.Width = formwidth - xlabel - 125 * xRatio
				tvp.Controls.Add(filepathtb)
				#Adding copy to clipboard button
				cb = Button()
				#Adding panel to form
				formbody.Controls.Add(tvp)
				form.output.append(dg)
				y = tvp.Bottom + 25 * yRatio
				form.topmost()
			elif j.__class__.__name__ == 'uitextnote':
				gb = GroupBox()
				gb.Text = j.title
				gb.Parent = form
				gb.SendToBack()
				gb.BackColor = Color.Transparent
				gb.Location = Point(xlabel, y)
				tn = Label()
				tn.Location = Point(xlabel,18 * yRatio)
				tn.AutoSize = True
				tn.MaximumSize = Size(formwidth - rightmargin - 50 * xRatio,0)
				tn.Text = j.textnote
				tn.BringToFront()
				gb.Controls.Add(tn)
				gb.Size = Size(formwidth  - rightmargin - 25 * xRatio, tn.Bottom-tn.Top+25 * yRatio)  
				y = gb.Bottom + 25 * xRatio
				formbody.Controls.Add(gb)
			elif j.__class__.__name__ == 'uibool':
				yn = CheckBox()
				yn.Width = formwidth - xinput - rightmargin + 10 * xRatio
				yn.Location = Point(xinput,y)
				yn.Text = j.booltext
				g = yn.CreateGraphics()
				sizetext = g.MeasureString(yn.Text,yn.Font, formwidth - xinput - rightmargin -20 * xRatio)
				heighttext = sizetext.Height
				yn.Height = heighttext + 15 * yRatio
				yn.Checked = j.defaultvalue
				formbody.Controls.Add(yn)
				form.output.append(yn)
				y = yn.Bottom + 25 * yRatio
			elif j.__class__.__name__ == 'uiradio':
				yrb = 20 * yRatio
				rbs = []
				rbgroup = mygroupbox()
				if j.inputname != "":
					rbgroup.Width = formwidth - xinput - rightmargin
					rbgroup.Location = Point(xinput,y)
				else:
					rbgroup.Width = formwidth - xlabel - rightmargin
					rbgroup.Location = Point(xlabel,y)					
				rbgroup.Tag = j
				rbcounter = 0
				for key in j.keys():
					if key != 'inputname' and key != 'defaultvalue':
						rb = RadioButton()
						rb.Text = key 
						if j.inputname != "":
							rb.Width = formwidth - xinput - rightmargin - 35 * xRatio
						else:
							rb.Width = formwidth - xlabel - rightmargin - 35 * xRatio
						rb.Location = Point(20 * xRatio,yrb)
						if rbcounter == j.defaultvalue:
							rb.Checked = True
						rbgroup.Controls.Add(rb)
						g = rb.CreateGraphics()
						sizetext = g.MeasureString(key,rb.Font, formwidth - xinput - 90*xRatio)
						heighttext = sizetext.Height
						rb.Height = heighttext + 15 * yRatio
						ybot = rb.Bottom
						yrb += heighttext + 12 * yRatio
						rbcounter += 1
					else:
						pass
				rbgroup.Height = ybot + 20 * yRatio
				[rbgroup.Controls.Add(rb) for rb in rbs]
				formbody.Controls.Add(rbgroup)
				form.output.append(rbgroup)
				y = rbgroup.Bottom + 25 * yRatio
			elif j.__class__.__name__  == 'uifilepath':
				fp = Button()
				if j.inputname != "":
					fp.Width = formwidth - xinput - rightmargin
					fp.Location = Point(xinput,y)
				else:
					fp.Width = formwidth - xlabel - rightmargin		
					fp.Location = Point(xlabel,y)					
				fp.Tag = j.defaultvalue
				if not j.defaultvalue == "FilePath":
					fp.Tag = j.defaultvalue
					fp.MouseHover += form.showtooltip	
				fp.Text = j.buttontext
				fp.Height = 20 * yRatio				
				formbody.Controls.Add(fp)
				fp.Click += form.openfile
				form.output.append(fp)
				y = label.Bottom + 25 * yRatio
			elif j.__class__.__name__ == 'uidirectorypath':
				dp = Button()
				if j.inputname != "":
					dp.Width = formwidth - xinput - rightmargin
					dp.Location = Point(xinput,y)
				else:
					dp.Width = formwidth - xlabel - rightmargin		
					dp.Location = Point(xlabel,y)				
				dp.Tag = j.defaultvalue
				dp.Text = j.buttontext
				if not j.defaultvalue == "DirectoryPath":
					dp.Tag = j.defaultvalue
					dp.MouseHover += form.showtooltip
				dp.Text = j.buttontext	
				dp.Height = 20 * yRatio				
				formbody.Controls.Add(dp)
				dp.Click += form.opendirectory
				form.output.append(dp)
				y = label.Bottom + 25 * yRatio
			elif j.__class__.__name__ == 'uiselectelements':
				se = Button()
				if j.inputname != "":
					se.Width = formwidth - xinput - rightmargin
					se.Location = Point(xinput,y)
				else:
					se.Width = formwidth - xlabel - rightmargin		
					se.Location = Point(xlabel,y)
				se.Text = j.buttontext
				se.Height = 20 * yRatio
				formbody.Controls.Add(se)
				if j.multi == False:
					se.Click += form.pickobjects
				else:
					se.Click  += form.pickobject
				form.output.append(se)
				y = label.Bottom + 25 * yRatio
			elif j.__class__.__name__ == 'uiselectautocadelements':
				se = Button()
				if j.inputname != "":
					se.Width = formwidth - xinput - rightmargin
					se.Location = Point(xinput,y)
				else:
					se.Width = formwidth - xlabel - rightmargin		
					se.Location = Point(xlabel,y)
				se.Text = j.buttontext
				se.Height = 20 * yRatio
				formbody.Controls.Add(se)
				if j.multi == False:
					se.Click += form.pickautocadobjects
				else:
					se.Click += form.pickautocadobject								
				form.output.append(se)
				y = label.Bottom + 25 * yRatio				
			elif j.__class__.__name__ == 'uiselectOrderedelements':
				se = Button()
				if j.inputname != "":
					se.Width = formwidth - xinput - rightmargin
					se.Location = Point(xinput,y)
				else:
					se.Width = formwidth - xlabel - rightmargin		
					se.Location = Point(xlabel,y)
				se.Text = j.buttontext
				se.Height = 20 * yRatio				
				formbody.Controls.Add(se)
				se.Click  += form.pickobjectsordered
				form.output.append(se)
				y = label.Bottom + 25 * yRatio
			elif j.__class__.__name__ == 'uiselectlinkedelements':
				se = Button()
				if j.inputname != "":
					se.Width = formwidth - xinput - rightmargin
					se.Location = Point(xinput,y)
				else:
					se.Width = formwidth - xlabel - rightmargin		
					se.Location = Point(xlabel,y)
				se.Text = j.buttontext
				se.Height = 20 * yRatio				
				formbody.Controls.Add(se)
				if j.multi == False:
					se.Click += form.picklinkedobjects
				else:
					se.Click  += form.picklinkedobject
				form.output.append(se)

				y = label.Bottom + 25 * yRatio
			elif j.__class__.__name__ == 'uiselectlinkedelementsofcat':
				sec = Button()
				if j.inputname != "":
					sec.Width = formwidth - xinput - rightmargin
					sec.Location = Point(xinput,y)
				else:
					sec.Width = formwidth - xlabel - rightmargin		
					sec.Location = Point(xlabel,y)
				sec.Text = j.buttontext
				sec.Tag = j.category
				sec.Height = 20 * yRatio
				formbody.Controls.Add(sec)
				if j.multi == False:
					sec.Click += form.picklinkedobjectsofcat
				else:
					sec.Click += form.picklinkedobjectofcat
				form.output.append(sec)
				y = label.Bottom + 25 * yRatio
			elif j.__class__.__name__ == 'uiselectelementsofcat':
				sec = Button()
				if j.inputname != "":
					sec.Width = formwidth - xinput - rightmargin
					sec.Location = Point(xinput,y)
				else:
					sec.Width = formwidth - xlabel - rightmargin		
					sec.Location = Point(xlabel,y)
				sec.Text = j.buttontext
				sec.Tag = j.category
				sec.Height = 20 * yRatio
				formbody.Controls.Add(sec)
				if j.multi == False:
					sec.Click += form.pickobjectsofcat
				else:
					sec.Click += form.pickobjectofcat
				form.output.append(sec)
				y = label.Bottom + 25 * yRatio
			elif j.__class__.__name__ == 'uiselectOrderedelementsofcat':
				sec = Button()
				if j.inputname != "":
					sec.Width = formwidth - xinput - rightmargin
					sec.Location = Point(xinput,y)
				else:
					sec.Width = formwidth - xlabel - rightmargin		
					sec.Location = Point(xlabel,y)
				sec.Text = j.buttontext
				sec.Tag = j.category
				sec.Height = 20 * yRatio
				formbody.Controls.Add(sec)
				sec.Click += form.pickobjectsofcatordered
				form.output.append(sec)
				y = label.Bottom + 25 * yRatio
			elif j.__class__.__name__ == 'uiselectfaces':
				sf = Button()
				if j.inputname != "":
					sf.Width = formwidth - xinput - rightmargin
					sf.Location = Point(xinput,y)
				else:
					sf.Width = formwidth - xlabel - rightmargin		
					sf.Location = Point(xlabel,y)
				sf.Text = j.buttontext
				sf.Height = 20 * yRatio
				formbody.Controls.Add(sf)
				sf.Click += form.pickfaces
				form.output.append(sf)
				y = label.Bottom + 25 * yRatio
			elif j.__class__.__name__ == 'uiselectpointsonface':
				spf = Button()
				if j.inputname != "":
					spf.Width = formwidth - xinput - rightmargin
					spf.Location = Point(xinput,y)
				else:
					spf.Width = formwidth - xlabel - rightmargin		
					spf.Location = Point(xlabel,y)
				spf.Text = j.buttontext
				spf.Height = 20 * yRatio
				formbody.Controls.Add(spf)
				spf.Click += form.pickpointsonface
				form.output.append(spf)
				y = label.Bottom + 25 * yRatio
			elif j.__class__.__name__ == 'uiselectedges':
				sed = Button()
				if j.inputname != "":
					sed.Width = formwidth - xinput - rightmargin
					sed.Location = Point(xinput,y)
				else:
					sed.Width = formwidth - xlabel - rightmargin		
					sed.Location = Point(xlabel,y)
				sed.Text = j.buttontext
				sed.Height = 20 * yRatio
				formbody.Controls.Add(sed)
				sed.Click += form.pickedges
				form.output.append(sed)
				y = label.Bottom + 25 * yRatio
				
			elif j.__class__.__name__ == 'uislider':
				gb = Panel()
				if j.defaultvalue == '':
					defval = j.minimum
				else:
					defval = j.defaultvalue
				sl = mytrackbar(j.minimum,j.step)
				if j.inputname != "":
					gb.Width = formwidth - xinput - rightmargin
					gb.Location = Point(xinput,y)
				else:
					gb.Width = formwidth - xlabel - rightmargin		
					gb.Location = Point(xlabel,y)
				gb.Height = 40 * yRatio
				sl.Minimum = 0
				sl.Maximum = (j.maximum-j.minimum)/j.step
				sl.Value = (defval - j.minimum) / j.step
				sl.TickFrequency = (j.maximum-j.minimum)/j.step/10
				sl.Location = Point(40 * xRatio,0)
				if j.inputname != "":
					sl.Width = formwidth - xinput - rightmargin - 35 * xRatio
				else:
					sl.Width = formwidth - xlabel -rightmargin - 35 * xRatio
				gb.Controls.Add(sl)
				form.output.append(sl)
				displabel = Label()
				displabel.Width = 50 * xRatio
				displabel.Location = Point(0,5 * yRatio)
				displabel.Text = str(defval)
				displabel.Height = 30 * yRatio
				displabel.BringToFront()
				gb.Controls.Add(displabel)	
				formbody.Controls.Add(gb)			
				sl.Scroll += form.scroll
				y = label.Bottom + 25 * yRatio
			elif j.__class__.__name__ == 'uiimage':
				pic = Image.FromFile(j.image)
				im = PictureBox()
				if j.showborder:
					im.BorderStyle = BorderStyle.Fixed3D
				else:
					im.BorderStyle = BorderStyle.None
				ratio = (pic.Height)/(pic.Width)
				h = float(pic.Height)
				w = float(pic.Width)
				ratio = h/w
				image_maxsize = formwidth - xlabel - rightmargin
				im.Size = Size(image_maxsize,image_maxsize*ratio)
				scaledimage = Bitmap(image_maxsize,image_maxsize*ratio)
				gr = Graphics.FromImage(scaledimage)
				gr.DrawImage(pic,0,0,image_maxsize,image_maxsize*ratio)
				im.Image = pic
				im.SizeMode = PictureBoxSizeMode.Zoom
				formbody.Controls.Add(im)
				im.Location = Point(25 * xRatio,y+25*yRatio)
				y = im.Bottom + 25 * yRatio
		
			elif j.__class__.__name__ == 'uicolorpick' and importcolorselection == 0:
				cp = Button()
				if j.inputname != "":
					cp.Width = formwidth - xinput - rightmargin
					cp.Location = Point(xinput,y)
				else:
					cp.Width = formwidth - xlabel - rightmargin		
					cp.Location = Point(xlabel,y)
				cp.Text = j.buttontext
				cp.Height = 30 * yRatio
				formbody.Controls.Add(cp)
				cp.Click += form.colorpicker
				form.output.append(cp)
				y = label.Bottom + 25 * yRatio	
			elif j.__class__.__name__ == 'uicolorpick' and importcolorselection == 1:
				importcolorselection = 2
			elif j.__class__.__name__ == 'uigroup':
				grouppanel = GroupBox()
				grouppanel.Text = j.groupname
				grouppanel.Location = Point(xlabel,y)
				grouppanel.Width = formwidth - 65 * xRatio
				#recursive implementation of the definition to process grouped inputs
				addinput(grouppanel,j.inputgroup,25*yRatio,xinput-25*xRatio,80 * xRatio,90 * xRatio,importcolorselection)
				formbody.Controls.Add(grouppanel)
				y = grouppanel.Bottom + 25 * yRatio
			elif j.__class__.__name__ == 'uiconditional':
				grouppanelcond = GroupBox()
				grouppanelcond.Location = Point(xlabel,y)
				grouppanelcond.Width = formwidth - 65 * xRatio	
				form.output.append(grouppanelcond)				
				#recursive implementation of the definition to process conditional groups of inputs
				panlist = []
				rblist = []
				yp = 25 * yRatio
				xrb = 25 * xRatio
				for i,d in zip(j._Conditions,j._GroupedInputs):	
					rb = RadioButton()
					rb.CheckedChanged += form.ActivateOption
					rb.Text = i
					rb.Location	= Point(xrb,10*yRatio)
					rb.Width = 95 * xRatio
					rblist.append(rb)					
					grouppanelcond.Controls.Add(rb)				
					condition_pannel = Panel()
					condition_pannel.Name = i
					condition_pannel.Top = yp
					condition_pannel.Width = formwidth - 65 * xRatio
					condition_pannel.BackColor = Color.Transparent
					condition_pannel.BringToFront()					
					addinput(condition_pannel,d,25*yRatio,xinput-25*xRatio,80*xRatio,90*xRatio,importcolorselection)
					panlist.append(condition_pannel)
					yp = condition_pannel.Bottom - 25*yRatio
					xrb += 100 * xRatio
				for pan in panlist:
					grouppanelcond.Controls.Add(pan)
				for e,pan in enumerate(panlist):
					if e != j._defaultOptionIndex:
						pan.Enabled = False
					else:
						continue
				rblist[j._defaultOptionIndex].Checked = True
				grouppanelcond.Height = sum([p.Height for p in panlist]) - (len(panlist)-2)*25 * yRatio
				grouppanelcond.BackColor = Color.Transparent				
				formbody.Controls.Add(grouppanelcond)
				form.output.append([grouppanelcond.Tag])				
				y = grouppanelcond.Bottom + 25*yRatio
			formbody.Height = y


	# process input lists 
	addinput(body,inputtypes,0,IN[9],40 * xRatio ,IN[9] * xRatio,importcolorselection)
	
	#add the formbody panel to the form
	form.Controls.Add(body)		
	

	if IN[6] != None:
		if IN[8] > 400 * yRatio:
			formy += 50 * yRatio
			xinput = 270 * yRatio
		else:
			formy = logo.Bottom + 20 * yRatio
	else:
		formy += 50 * yRatio



	#Adding validation button
	
	button = Button()
	button.Text = IN[1]
	button.Width = formwidth - xinput - 40 * xRatio
	button.Height = 20 * yRatio
	button.Location = Point (xinput,formy)
	button.Click += form.setclose
	form.Controls.Add(button)
	form.MaximizeBox = False
	form.MinimizeBox = False
	form.FormBorderStyle = FormBorderStyle.FixedSingle
	
	#Adding Cancel button
	if IN[6] != None:
		cancelbutton = Button()
		cancelbutton.Text = IN[6]
		cancelbutton.Width = 120 * xRatio
		cancelbutton.Height = 20 * xRatio
		cancelbutton.Name = "Cancel"
		cancelbutton.Location = Point (xinput -120 * xRatio ,formy)
		cancelbutton.Click += form.setclose
		form.Controls.Add(cancelbutton)
		form.CancelButton = cancelbutton
	
	#Adding link to help
	
	if IN[5] != None :
		helplink = LinkLabel()
		helplink.Text = "Open Power BI"
		helplink.Tag = IN[5]
		helplink.Click += form.openurl
		helplink.Location = Point(formwidth - 200 * xRatio ,formy+30 * yRatio)
		form.Controls.Add(helplink)
	else:
		pass	
			
	form.ShowIcon = True
	form.Width = formwidth
	form.Height = formy + 120 * yRatio
	formfooterheight = form.Height - formheaderheight
	
	# Make formbody scrollable
	
	# if the form is longer than its maximum height, do the following:
	# modify the form height
	# make the formbody panel scrollable
	if form.Height + body.Height > IN[7] * yRatio and IN[7] * yRatio > 0:
		formbody_calculatedheight = IN[7] * yRatio - form.Height
		# make sure the formbody is at least 100 px high
		if formbody_calculatedheight < 100 * yRatio: formbody_calculatedheight = 100 * yRatio
		body.Height = formbody_calculatedheight
		form.Height = form.Height + formbody_calculatedheight
		# this (and apparently only this) will implement a vertical AutoScroll *only*
		# http://stackoverflow.com/a/28583501
		body.HorizontalScroll.Maximum = 0
		body.AutoScroll = False
		body.VerticalScroll.Visible = False
		body.AutoScroll = True
		body.BorderStyle = BorderStyle.Fixed3D
	else:
		form.Height = form.Height + body.Height
	# Move footer elements
	logo.Location = Point(logo.Location.X, logo.Location.Y + body.Height)
	button.Location = Point(button.Location.X, button.Location.Y + body.Height)
	if IN[6] != None: cancelbutton.Location = Point(cancelbutton.Location.X, cancelbutton.Location.Y + body.Height)
	if IN[5] != None: helplink.Location = Point(helplink.Location.X, helplink.Location.Y + body.Height)

	#Positionning the form at top left of current view
	#In The revit environment
	try:
		uiviews = uidoc.GetOpenUIViews()
		if doc.ActiveView.IsValidType(doc.ActiveView.GetTypeId()):
			activeviewid = doc.ActiveView.Id
			activeUIView = [v for v in uiviews if v.ViewId == activeviewid][0]
		else:
			activeUIView = uiviews[0]
		rect = activeUIView.GetWindowRectangle()
		form.StartPosition = FormStartPosition.Manual
		form.Location = Point(rect.Left-7 * xRatio,rect.Top)
	except:
		pass
	
		
	if IN[2]:
		if importcolorselection != 2:
			Application.Run(form)
			result = form.values
			OUT = result,True, form.cancelled 
		else:
			OUT = ['ColorSelection input is only available With Revit 2017'] , False, False
	else :
		OUT = ['Set toggle to true!'] , False, False
except:
	import traceback
	OUT = traceback.format_exc() , "error", "error"
# ----------------------------------------
string_9 = StringInput("\\hm\filestore\")
watch = Watch(code_block_7.t3)
