# Dynamo graph HML_Audit_DeleteImportedLinePatterns_script.dyn (Dynamo 2.3.1.11775)

python_script = Python()  # graph input
# ---------- python_script.python (13 lines) ----------
import clr
clr.AddReference('RevitAPI')
from Autodesk.Revit.DB import *
import Autodesk
clr.AddReference('RevitNodes')
import Revit
clr.ImportExtensions(Revit.Elements)
import System.Reflection
import System.AppDomain

rAssembly = [x for x in System.AppDomain.CurrentDomain.GetAssemblies() if x.GetName().Name == 'RevitAPI'][0]
rElement = [x for x in rAssembly.GetTypes() if x.Name == 'Element' and x.Namespace == 'Autodesk.Revit.DB'][0]
OUT = [x for x in rAssembly.GetTypes() if x.IsClass and x.Namespace == 'Autodesk.Revit.DB' and x.IsSubclassOf(rElement)]
# ----------------------------------------
string_from_object = FromObject(obj=python_script)
code_block = CodeBlock { "LinePatternElement"; }
contains = String.Contains(str=string_from_object, searchFor=code_block)
filterByBoolMask = List.FilterByBoolMask(list=python_script, mask=contains)
all_elements_of_type = ElementsOfType(element_type=filterByBoolMask.in)
code_block_2 = CodeBlock(x=all_elements_of_type) { List.Flatten(x); }
name = Element.Name(element=code_block_2)
code_block_3 = CodeBlock { "HML"; true; }
contains_2 = String.Contains(str=name, searchFor=code_block_3.out0, ignoreCase=code_block_3.out1)
filterByBoolMask_2 = List.FilterByBoolMask(list=code_block_2, mask=contains_2)
python_script_2 = Python(IN[0]=filterByBoolMask_2.out)
# ---------- python_script_2.python (47 lines) ----------
#Copyright(c) 2014, Konrad Sobon
# @arch_laboratory, http://archi-lab.net

import clr
clr.AddReference('ProtoGeometry')
from Autodesk.DesignScript.Geometry import *

# Import DocumentManager and TransactionManager
clr.AddReference("RevitServices")
import RevitServices
from RevitServices.Persistence import DocumentManager
from RevitServices.Transactions import TransactionManager

# Import RevitAPI
clr.AddReference("RevitAPI")
import Autodesk
from Autodesk.Revit.DB import *

doc = DocumentManager.Instance.CurrentDBDocument
uiapp = DocumentManager.Instance.CurrentUIApplication
app = uiapp.Application

from System.Collections.Generic import *

#The inputs to this node will be stored as a list in the IN variable.
dataEnteringNode = IN

#unwrap all elements to use with API
elements = []
for i in IN[0]:
	elements.append(UnwrapElement(i))

idsToDelete = List[Autodesk.Revit.DB.ElementId]()
for i in elements:
	idsToDelete.Add(i.Id)

# "Start" the transaction
TransactionManager.Instance.EnsureInTransaction(doc)

doc.Delete(idsToDelete)

# "End" the transaction
TransactionManager.Instance.TransactionTaskDone()

message = "You have successfully deleted n " + str(idsToDelete.Count) + " elements from Revit model."

OUT = 'n'.join('{:^35}'.format(s) for s in message.split('n'))
# ----------------------------------------
code_block_4 = CodeBlock { true; }
python_script_3 = Python(IN[0]=code_block_4)
# ---------- python_script_3.python (36 lines) ----------
# Boilerplate text
import clr
import os
import datetime

clr.AddReference("RevitServices")
import RevitServices
from RevitServices.Persistence import DocumentManager 

clr.AddReference('DynamoRevitDS')
import Dynamo

# Current doc and title
doc = DocumentManager.Instance.CurrentDBDocument
docTitle = doc.Title

# Check Dynamo workspace properties
dynamoRevit = Dynamo.Applications.DynamoRevit()
currentWorkspace = dynamoRevit.RevitDynamoModel.CurrentWorkspace
script = currentWorkspace.Name

# Get properties for writing the log file
dateStamp   = datetime.datetime.today().strftime("%d/%m/%y")
userName    = os.environ.get('USERNAME')

# Generate data to write
myLog   = "\\\\hm\\filestore\\Resource\\Revit\\HM Audit\\DynamoLogs\\Data\\DynamoLog.csv"
dataRow = dateStamp + "," + userName + "," + script +".dyn" + "," + docTitle + ".rvt"

# Adds new line to log file or creates one if doesn't exist
try:
	with open(myLog, "a") as file:
		file.writelines(dataRow + "\n")
	result = True
except:
	result = False
# ----------------------------------------
