# Dynamo graph HML_Audit_DeleteNonStandardLineStyles_script.dyn (Dynamo 2.3.1.11775)

boolean = BoolSelector(true)  # graph input
get_line_style_categories_and = Python(IN[0]=boolean)  # "Get Line style Categories and Names"
# ---------- get_line_style_categories_and.python (43 lines) ----------
#python nodes in dynamo 1.0
#proposed by Julien Benoit @jbenoit44 
#http://aecuandme.wordpress.com/
import clr
clr.AddReference('ProtoGeometry')
from Autodesk.DesignScript.Geometry import *
# Import ToDSType(bool) extension method
clr.AddReference("RevitNodes")
import Revit
clr.ImportExtensions(Revit.Elements)
# Import geometry conversion extension methods
clr.ImportExtensions(Revit.GeometryConversion)
# Import DocumentManager and TransactionManager
clr.AddReference("RevitServices")
import RevitServices
from RevitServices.Persistence import DocumentManager
from RevitServices.Transactions import TransactionManager
from System.Collections.Generic import *
# Import RevitAPI
clr.AddReference("RevitAPI")
import Autodesk
from Autodesk.Revit.DB import *

doc = DocumentManager.Instance.CurrentDBDocument
uiapp = DocumentManager.Instance.CurrentUIApplication
app = uiapp.Application
uidoc=DocumentManager.Instance.CurrentUIApplication.ActiveUIDocument
TransactionManager.Instance.EnsureInTransaction(doc)

elt = []
list=[]
a=UnwrapElement(IN[0])
a=doc.Settings.Categories.get_Item(BuiltInCategory.OST_Lines)
b=a.SubCategories

for i in b:
	c=i.Name.ToString()
	list.append(c)
	
# End Transaction
TransactionManager.Instance.TransactionTaskDone()

OUT = b,list
# ----------------------------------------
filter_to_not_containing_hml = CodeBlock(x=get_line_style_categories_and, t3=boolean)
# ---------- filter_to_not_containing_hml.designscript (4 lines) ----------
x;
t4 = DSCore.String.Contains(x[1],"HML", t3);
t5=DSCore.List.FilterByBoolMask(x[0],t4);
DesignScript.Dictionary.ValueAtKey(t5,"out");
# ----------------------------------------
delete = Python(IN[0]=filter_to_not_containing_hml.out3, IN[1]=boolean)  # "Element.Delete"
# ---------- delete.python (31 lines) ----------
#Copyright(c) 2016, Dimitar Venkov
# @5devene, dimitar.ven@gmail.com

import clr

clr.AddReference("RevitServices")
import RevitServices
from RevitServices.Persistence import DocumentManager
from RevitServices.Transactions import TransactionManager
doc = DocumentManager.Instance.CurrentDBDocument

def tolist(obj1):
	if hasattr(obj1,"__iter__"): return obj1
	else: return [obj1]

ids = [e.Id for e in UnwrapElement(tolist(IN[0]) )]

if IN[1]:
	deleted, failed = [], []
	TransactionManager.Instance.EnsureInTransaction(doc)
	for id in ids:
		try:
			del_id = doc.Delete(id)
			deleted.extend([d.ToString() for d in del_id])
		except : failed.append(id.ToString() )
	TransactionManager.Instance.TransactionTaskDone()
	s = set(deleted)
	failed1 = [x for x in failed if x not in s]
	OUT = len(deleted), ';'.join(deleted), ';'.join(failed1)
else:
	OUT = "Set confirm to True", "", ""
# ----------------------------------------
code_block = CodeBlock { true; }
python_script = Python(IN[0]=code_block)
# ---------- python_script.python (36 lines) ----------
# Boilerplate text
import clr
import os
import datetime

clr.AddReference("RevitServices")
import RevitServices
from RevitServices.Persistence import DocumentManager 

clr.AddReference('DynamoRevitDS')
import Dynamo

# Current doc and title
doc = DocumentManager.Instance.CurrentDBDocument
docTitle = doc.Title

# Check Dynamo workspace properties
dynamoRevit = Dynamo.Applications.DynamoRevit()
currentWorkspace = dynamoRevit.RevitDynamoModel.CurrentWorkspace
script = currentWorkspace.Name

# Get properties for writing the log file
dateStamp   = datetime.datetime.today().strftime("%d/%m/%y")
userName    = os.environ.get('USERNAME')

# Generate data to write
myLog   = "\\\\hm\\filestore\\Resource\\Revit\\HM Audit\\DynamoLogs\\Data\\DynamoLog.csv"
dataRow = dateStamp + "," + userName + "," + script +".dyn" + "," + docTitle + ".rvt"

# Adds new line to log file or creates one if doesn't exist
try:
	with open(myLog, "a") as file:
		file.writelines(dataRow + "\n")
	result = True
except:
	result = False
# ----------------------------------------
