# Dynamo graph HML_Audit_OpenDashboard_script.dyn "Open Powerbi" (Dynamo 2.3.1.11775)

string = StringInput("\\hm\filestore\")
code_block = CodeBlock { "Sheets"; }
byName = Category.ByName(name=code_block)
all_elements_of_category = ElementsOfCategory(Category=byName)
code_block_2 = CodeBlock { "Sheet Name"; }
getParameterValueByName = Element.GetParameterValueByName(element=all_elements_of_category, parameterName=code_block_2)
code_block_3 = CodeBlock(a=getParameterValueByName) { a=="Project Information"; null; }
filterByBoolMask = List.FilterByBoolMask(list=all_elements_of_category, mask=code_block_3.out0)
python_script = Python(IN[0]=code_block_3.out1)
# ---------- python_script.python (36 lines) ----------
# Made by Gavin Crump
# Free for use
# BIM Guru, www.bimguru.com.au

# Boilerplate text
import clr

clr.AddReference("RevitServices")
import RevitServices
from RevitServices.Persistence import DocumentManager 

clr.AddReference("RevitAPI")
import Autodesk 
from Autodesk.Revit.DB import *

#Inputdoc by Andreas Dieckmann
if isinstance(IN[0], list):
	inputdoc = UnwrapElement(IN[0])
else:
	inputdoc = [UnwrapElement(IN[0])]

if inputdoc[0] == None:
	doc = DocumentManager.Instance.CurrentDBDocument
	test = "No input detected"
elif inputdoc[0].GetType().ToString() == "Autodesk.Revit.DB.Document":
	doc = inputdoc[0]
	test = "A document was provided."
elif inputdoc[0].GetType().ToString() == "Autodesk.Revit.DB.RevitLinkInstance":
	doc = inputdoc[0].GetLinkDocument()
	test = "From linked instance."
else:
	doc = DocumentManager.Instance.CurrentDBDocument
	test = "Invalid input, current document used."

# Preparing output to Dynamo
OUT = doc,test
# ----------------------------------------
code_block_4 = CodeBlock(x=python_script) { x[0]; }
python_script_2 = Python(IN[0]=filterByBoolMask.in, IN[1]=code_block_4)
# ---------- python_script_2.python (49 lines) ----------
# Made by Gavin Crump
# Free for use
# BIM Guru, www.bimguru.com.au

# Boilerplate text
import clr

clr.AddReference("RevitAPI")
import Autodesk 
from Autodesk.Revit.DB import *

# Current doc/app/ui
doc = IN[1]

# Define list/unwrap list functions
def tolist(input):
    result = input if isinstance(input, list) else [input]
    return result

# Preparing input from dynamo to revit
sheet_list = tolist(IN[0])
sheet_ttbs, has_ttbs = [], []

# Collect all titleblocks in the project
tblocks = FilteredElementCollector(doc).OfCategory(BuiltInCategory.OST_TitleBlocks).ToElements()

# Get ttbs on sheets
for s in sheet_list:
	
	ttbs = []
	sid = s.Id
	
	# For each ttb check if it is on this sheet
	for tb in tblocks:
		if tb.OwnerViewId.IntegerValue == sid:
			ttbs.append(tb)
		else:
			continue
	
	sheet_ttbs.append(ttbs)
	
	# Check if there is at least 1 TTB
	if len(ttbs) > 0:
		has_ttbs.append(True)
	else:
		has_ttbs.append(False)

# Preparing output to Dynamo
OUT = [sheet_ttbs, has_ttbs]
# ----------------------------------------
code_block_5 = CodeBlock(x=python_script_2) { x[0][0][0]; }
code_block_6 = CodeBlock { "LondonOffice"; }
getParameterValueByName_2 = Element.GetParameterValueByName(element=code_block_5, parameterName=code_block_6)
code_block_7 = CodeBlock(a=getParameterValueByName_2) { a==1?"L":"G"; }
string_2 = StringInput("Projects\")
code_block_8 = CodeBlock { elements=Revit.Elements.Category.ByName("Project Information"); ElementQueries.OfCategory(elements); }
code_block_9 = CodeBlock { "Project Number"; }
getParameterValueByName_3 = Element.GetParameterValueByName(element=code_block_8.out1, parameterName=code_block_9)
code_block_10 = CodeBlock(a=getParameterValueByName_3) { t1=a+""; t2=DSCore.String.Substring(t1,0,2)+"00"; }
string_3 = StringInput("\")
string_4 = StringInput("\1-Cad\BIM\07-Audit\AutomatedAudit\")
code_block_11 = CodeBlock(a=string, x=code_block_7, y=string_2, b=code_block_10.t2, c=string_3, d=code_block_10.t1, e=string_4) { a+x+y+b+c+d+e; }
directory_from_path = DirectoryObject(path=code_block_11)
string_5 = StringInput("*.pbix")
code_block_12 = CodeBlock { true; }
getDirectoryContents = FileSystem.GetDirectoryContents(directory=directory_from_path, searchString=string_5, includeSubdirectories=code_block_12)
code_block_13 = CodeBlock(x=getDirectoryContents.files) { x[0][0]; }
string_6 = StringInput("\\hm\filestore\Resource\Revit\HM Audit\AutomatedAudit\Project\3541_RevitAudit.pbit")
code_block_14 = CodeBlock(a=code_block_13, b=string_6) { a==null?b:a; }
python_script_3 = Python(IN[0]=code_block_14)
# ---------- python_script_3.python (19 lines) ----------
# Made by Gavin Crump
# Free for use
# BIM Guru, www.bimguru.com.au

# Boilerplate text
import clr
import os

# Define list/unwrap list functions
partPath = IN[0]

# Try to open path
dirPath = partPath + "\\"

try:
	os.startfile(dirPath)
	OUT = True
except:
	OUT = False
# ----------------------------------------
