# Dynamo graph HML_Utility_Coordinates_SyncSplashScreen_script.dyn (Dynamo 2.3.1.11775)
# packages: Genius Loci 2021.1.12

code_block = CodeBlock { elements=Revit.Elements.Category.ByName("Project Information"); ElementQueries.OfCategory(elements); }
code_block_2 = CodeBlock { "IO-East"; "IO-North"; "IO-Elev"; }
code_block_3 = CodeBlock { null; }
get_project_origin_basepoint_and = Python(IN[0]=code_block_3)  # "Get Project Origin, BasePoint and SurveyPoint"
# ---------- get_project_origin_basepoint_and.python (66 lines) ----------
#Alban de Chasteigner 2018
#twitter : @geniusloci_bim
#geniusloci.bim@gmail.com
#https://github.com/albandechasteigner/GeniusLociForDynamo

import clr
import math
clr.AddReference("RevitServices")
import RevitServices 
from RevitServices.Persistence import DocumentManager
uiapp = DocumentManager.Instance.CurrentUIApplication
app = uiapp.Application
version=int(app.VersionNumber)

clr.AddReference("RevitNodes")
import Revit
clr.ImportExtensions(Revit.GeometryConversion)

clr.AddReference("RevitAPI")
import Autodesk
from Autodesk.Revit.DB import *

inputdoc = UnwrapElement(IN[0]) if isinstance(IN[0],list) else [UnwrapElement(IN[0])]

#Inputdoc : Part of script by Andreas Dieckmann
if inputdoc[0] == None:
    doc = DocumentManager.Instance.CurrentDBDocument
elif isinstance(inputdoc[0],Document):
    doc = inputdoc[0]
elif isinstance(inputdoc[0],RevitLinkInstance):
    doc = inputdoc[0].GetLinkDocument()
else: doc = DocumentManager.Instance.CurrentDBDocument

angleUnit = Document.GetUnits(doc).GetFormatOptions(UnitType.UT_Angle).DisplayUnits

outProjBasePt, outProjSurvPt, outProjLoc = [],[],[]

pbp = FilteredElementCollector(doc).OfCategory(BuiltInCategory.OST_ProjectBasePoint).ToElements()
sbp = FilteredElementCollector(doc).OfCategory(BuiltInCategory.OST_SharedBasePoint).ToElements()

if version < 2018:
	projPos = doc.ActiveProjectLocation.get_ProjectPosition(XYZ(0,0,0))
else :
	projPos = doc.ActiveProjectLocation.GetProjectPosition(XYZ(0,0,0))
	
if version > 2019 and inputdoc != None :
	outProjBasePt = [pbp[0].SharedPosition.ToPoint(),abs(round(Autodesk.Revit.DB.UnitUtils.ConvertFromInternalUnits(projPos.Angle,angleUnit),6))]
	outProjSurvPt = sbp[0].SharedPosition.ToPoint()
else :
	pbpEW = pbp[0].get_Parameter(BuiltInParameter.BASEPOINT_EASTWEST_PARAM).AsDouble()
	pbpNS = pbp[0].get_Parameter(BuiltInParameter.BASEPOINT_NORTHSOUTH_PARAM).AsDouble()
	pbpElev = pbp[0].get_Parameter(BuiltInParameter.BASEPOINT_ELEVATION_PARAM).AsDouble()
	pbpAngle = pbp[0].get_Parameter(BuiltInParameter.BASEPOINT_ANGLETON_PARAM).AsDouble()*180/math.pi    
	outProjBasePt=[(XYZ(pbpEW,pbpNS,pbpElev)).ToPoint(),round(pbpAngle,6)]

	pspEW = sbp[0].get_Parameter(BuiltInParameter.BASEPOINT_EASTWEST_PARAM).AsDouble()
	pspNS = sbp[0].get_Parameter(BuiltInParameter.BASEPOINT_NORTHSOUTH_PARAM).AsDouble()
	pspElev = sbp[0].get_Parameter(BuiltInParameter.BASEPOINT_ELEVATION_PARAM).AsDouble()
	outProjSurvPt = XYZ(pspEW,pspNS,pspElev).ToPoint()
    	
if projPos == None:
	outProjLoc.append("No Project Position at origin point")
else:
	outProjLoc = XYZ(projPos.EastWest,projPos.NorthSouth,0).ToPoint()
	
OUT = outProjLoc, outProjBasePt, outProjSurvPt, doc.ActiveProjectLocation.Name
# ----------------------------------------
code_block_4 = CodeBlock(x=get_project_origin_basepoint_and)
# ---------- code_block_4.designscript (5 lines) ----------
t1=DSCore.List.Transpose([[x[0]],x[1],[x[2]]])[0];
t2=DSCore.List.Transpose([DesignScript.Geometry.Point.X(t1),DesignScript.Geometry.Point.Y(t1),DesignScript.Geometry.Point.Z(t1)]);
io=t2[0];
pb=t2[1];
sp=t2[2];
# ----------------------------------------
IO = Watch(code_block_4.io)
code_block_5 = CodeBlock(x=IO) { EW=x[0]; NS=x[1]; }
setParameterByName = Element.SetParameterByName(element=code_block.out1, parameterName=code_block_2.out0, value=code_block_5.EW)
setParameterByName_2 = Element.SetParameterByName(element=code_block.out1, parameterName=code_block_2.out1, value=code_block_5.NS)
surveyPoint = Coordinates.SurveyPoint()

# group: Location
code_block_6 = CodeBlock()
# ---------- code_block_6.designscript (4 lines) ----------
b1=Revit.Elements.Category.ByName("Site - Project Base Point");
b2=Revit.Elements.Category.ByName("Site - Survey Point");
b3=[b1,b2];
elements=ElementQueries.OfCategory(b3);
# ----------------------------------------

code_block_7 = CodeBlock(x=code_block_6.elements) { Revit.Elements.Element.GetParameterValueByName(x<1L>,["Elev"]<1L>); }
code_block_8 = CodeBlock(x=code_block_7) { x[1]; }
code_block_9 = CodeBlock(point1=surveyPoint, a=code_block_8) { z = DesignScript.Geometry.Point.Z(point1); a-z; }
setParameterByName_3 = Element.SetParameterByName(element=code_block.out1, parameterName=code_block_2.out2, value=code_block_9.out1)
code_block_10 = CodeBlock { "SP-East"; "SP-North"; "SP-Elev"; }
survey_point = Watch(code_block_4.sp)
code_block_11 = CodeBlock(x=survey_point) { EW=x[0]; NS=x[1]; }
setParameterByName_4 = Element.SetParameterByName(element=code_block.out1, parameterName=code_block_10.out1, value=code_block_11.NS)
setParameterByName_5 = Element.SetParameterByName(element=code_block.out1, parameterName=code_block_10.out0, value=code_block_11.EW)
setParameterByName_6 = Element.SetParameterByName(element=code_block.out1, parameterName=code_block_10.out2, value=code_block_8)
code_block_12 = CodeBlock { "PBP-East"; "PBP-North"; "PBP-Elv"; "PBP-Rot"; }
PBP = Watch(code_block_4.pb)
code_block_13 = CodeBlock(x=PBP) { EW=x[0]; NS=x[1]; }
setParameterByName_7 = Element.SetParameterByName(element=code_block.out1, parameterName=code_block_12.out1, value=code_block_13.NS)
code_block_14 = CodeBlock(x=code_block_7) { x[0]; }
setParameterByName_8 = Element.SetParameterByName(element=code_block.out1, parameterName=code_block_12.out2, value=code_block_14)
setParameterByName_9 = Element.SetParameterByName(element=code_block.out1, parameterName=code_block_12.out0, value=code_block_13.EW)
code_block_15 = CodeBlock(x=code_block_6.elements) { Revit.Elements.Element.GetParameterValueByName(x<1L>,["Angle to True North"]<1L>); }
code_block_16 = CodeBlock(x=code_block_15) { x[0]; }
setParameterByName_10 = Element.SetParameterByName(element=code_block.out1, parameterName=code_block_12.out3, value=code_block_16)
origin = Point.Origin()
get_project_locations = Custom[Get Project Locations]()  # package Genius Loci; Works only in Revit 2018 and later. Retrieves the project positions with the survey point of the given document as the origin. (Coordinates of Internal origin, project base point and survey point)
code_block_17 = CodeBlock { true; }
python_script = Python(IN[0]=code_block_17)
# ---------- python_script.python (36 lines) ----------
# Boilerplate text
import clr
import os
import datetime

clr.AddReference("RevitServices")
import RevitServices
from RevitServices.Persistence import DocumentManager 

clr.AddReference('DynamoRevitDS')
import Dynamo

# Current doc and title
doc = DocumentManager.Instance.CurrentDBDocument
docTitle = doc.Title

# Check Dynamo workspace properties
dynamoRevit = Dynamo.Applications.DynamoRevit()
currentWorkspace = dynamoRevit.RevitDynamoModel.CurrentWorkspace
script = currentWorkspace.Name

# Get properties for writing the log file
dateStamp   = datetime.datetime.today().strftime("%d/%m/%y")
userName    = os.environ.get('USERNAME')

# Generate data to write
myLog   = "\\\\hm\\filestore\\Resource\\Revit\\HM Audit\\DynamoLogs\\Data\\DynamoLog.csv"
dataRow = dateStamp + "," + userName + "," + script +".dyn" + "," + docTitle + ".rvt"

# Adds new line to log file or creates one if doesn't exist
try:
	with open(myLog, "a") as file:
		file.writelines(dataRow + "\n")
	result = True
except:
	result = False
# ----------------------------------------
