# Dynamo graph HML_Utility_CentreAllRooms_script.dyn (Dynamo 2.3.1.11775)

code_block = CodeBlock { "Rooms"; }
byName = Category.ByName(name=code_block)
all_elements_of_category = ElementsOfCategory(Category=byName)
code_block_2 = CodeBlock { "Area"; }
getParameterValueByName = Element.GetParameterValueByName(element=all_elements_of_category, parameterName=code_block_2)
code_block_3 = CodeBlock(a=getParameterValueByName) { a==null||a==""; }
filterByBoolMask = List.FilterByBoolMask(list=all_elements_of_category, mask=code_block_3)
finishBoundary = Room.FinishBoundary(room=filterByBoolMask.out)
byJoinedCurves = PolyCurve.ByJoinedCurves(curves=finishBoundary)
code_block_4 = CodeBlock { 1; }
extrudeAsSolid = Curve.ExtrudeAsSolid(curve=byJoinedCurves, distance=code_block_4)
centroid = Solid.Centroid(solid=extrudeAsSolid)
X = Point.X(point=centroid)
Y = Point.Y(point=centroid)
pointAtParameter = Curve.PointAtParameter(curve=byJoinedCurves, param=code_block_4)
Z = Point.Z(point=pointAtParameter)
byCoordinates = Point.ByCoordinates(x=X, y=Y, z=Z)
code_block_5 = CodeBlock(x=byCoordinates) { DSCore.List.Flatten(x); }
isInsideRoom = Room.IsInsideRoom(room=filterByBoolMask.out, point=code_block_5)
filterByBoolMask_2 = List.FilterByBoolMask(list=filterByBoolMask.out, mask=isInsideRoom)
end = Revit.Transaction.Transaction.End(input=filterByBoolMask_2.in)
filterByBoolMask_3 = List.FilterByBoolMask(list=code_block_5, mask=isInsideRoom)
end_2 = Revit.Transaction.Transaction.End(input=filterByBoolMask_3.in)
python_script = Python(IN[0]=end, IN[1]=end_2)
# ---------- python_script.python (42 lines) ----------
#Copyright(c) 2017
#BVN, http://www.bvn.com.au/
#Licence: http://creativecommons.org/licenses/by-sa/4.0/

import clr
clr.AddReference('ProtoGeometry')
from Autodesk.DesignScript.Geometry import *

import clr
clr.AddReference('RevitAPI') 
clr.AddReference('RevitAPIUI') 
from Autodesk.Revit.DB import *

clr.AddReference("RevitServices")
import RevitServices
from RevitServices.Persistence import DocumentManager

clr.AddReference("RevitNodes")
import Revit
clr.ImportExtensions(Revit.GeometryConversion)

doc = DocumentManager.Instance.CurrentDBDocument
 
#The inputs to this node will be stored as a list in the IN variables.
rooms = UnwrapElement(IN[0])
points = [x.ToXyz() for x in IN[1]]
locations = []
count = 0


t = Transaction(doc, 'MoveRoomLocation')
t.Start()
	
for r in rooms:
	P = points[count] - r.Location.Point
	r.Location.Move(P)
	count = count + 1

t.Commit()

#Assign your output to the OUT variable.
OUT = rooms
# ----------------------------------------
code_block_6 = CodeBlock { true; }
python_script_2 = Python(IN[0]=code_block_6)
# ---------- python_script_2.python (36 lines) ----------
# Boilerplate text
import clr
import os
import datetime

clr.AddReference("RevitServices")
import RevitServices
from RevitServices.Persistence import DocumentManager 

clr.AddReference('DynamoRevitDS')
import Dynamo

# Current doc and title
doc = DocumentManager.Instance.CurrentDBDocument
docTitle = doc.Title

# Check Dynamo workspace properties
dynamoRevit = Dynamo.Applications.DynamoRevit()
currentWorkspace = dynamoRevit.RevitDynamoModel.CurrentWorkspace
script = currentWorkspace.Name

# Get properties for writing the log file
dateStamp   = datetime.datetime.today().strftime("%d/%m/%y")
userName    = os.environ.get('USERNAME')

# Generate data to write
myLog   = "\\\\hm\\filestore\\Resource\\Revit\\HM Audit\\DynamoLogs\\Data\\DynamoLog.csv"
dataRow = dateStamp + "," + userName + "," + script +".dyn" + "," + docTitle + ".rvt"

# Adds new line to log file or creates one if doesn't exist
try:
	with open(myLog, "a") as file:
		file.writelines(dataRow + "\n")
	result = True
except:
	result = False
# ----------------------------------------
code_block_7 = CodeBlock { true; }
python_script_3 = Python(IN[0]=code_block_7)  # same code as python_script_2
