# Dynamo graph HML_Sheet_ScaleUpdate_script.dyn (Dynamo 2.3.1.11775)

code_block = CodeBlock { "Sheets"; }
byName = Category.ByName(name=code_block)
all_elements_of_category = ElementsOfCategory(Category=byName)
code_block_2 = CodeBlock { "Scale"; "Sheet Number"; }
getParameterValueByName = Element.GetParameterValueByName(element=all_elements_of_category, parameterName=code_block_2.out1)
sortByKey = List.SortByKey(list=all_elements_of_category, keys=getParameterValueByName)
getParameterValueByName_2 = Element.GetParameterValueByName(element=sortByKey.sorted_list, parameterName=code_block_2.out0)
code_block_3 = CodeBlock { "Title Blocks"; }
byName_2 = Category.ByName(name=code_block_3)
all_elements_of_category_2 = ElementsOfCategory(Category=byName_2)
getParameterValueByName_3 = Element.GetParameterValueByName(element=all_elements_of_category_2, parameterName=code_block_2.out1)
sortByKey_2 = List.SortByKey(list=all_elements_of_category_2, keys=getParameterValueByName_3)
code_block_4 = CodeBlock(list=getParameterValueByName_2, sheets=sortByKey.sorted_list, titleblocks=sortByKey_2.sorted_list)
# ---------- code_block_4.designscript (9 lines) ----------
t1=list=="NTS";
t2=list=="As indicated";
t3=list==" ";
t4=!(t1||t2||t3);
t5=[t1,t2,t3,t4];
t6=DSCore.List.FilterByBoolMask(sheets, t5<1L>);
sortedsheets=Dictionary.ValueAtKey(t6, "in");
t7=DSCore.List.FilterByBoolMask(titleblocks, t5<1L>);
sortedtitleblocks=Dictionary.ValueAtKey(t7, "in");
# ----------------------------------------
code_block_5 = CodeBlock(x=code_block_4.sortedtitleblocks) { x[0]; x[1]; x[2]; }
code_block_6 = CodeBlock { "ScaleNotToScale"; "ScaleAsIndicated"; }
code_block_7 = CodeBlock { true; false; }
setParameterByName = Element.SetParameterByName(element=code_block_5.out0, parameterName=code_block_6.out0, value=code_block_7.out0)
setParameterByName_2 = Element.SetParameterByName(element=code_block_5.out0, parameterName=code_block_6.out1, value=code_block_7.out1)
setParameterByName_3 = Element.SetParameterByName(element=code_block_5.out1, parameterName=code_block_6.out1, value=code_block_7.out0)
setParameterByName_4 = Element.SetParameterByName(element=code_block_5.out1, parameterName=code_block_6.out0, value=code_block_7.out1)
setParameterByName_5 = Element.SetParameterByName(element=code_block_5.out2, parameterName=code_block_6.out0, value=code_block_7.out0)
setParameterByName_6 = Element.SetParameterByName(element=code_block_5.out2, parameterName=code_block_6.out1, value=code_block_7.out0)
code_block_8 = CodeBlock(titleblock=code_block_4.sortedtitleblocks) { titleblock[3]; }
code_block_9 = CodeBlock { "Scale"; }
code_block_10 = CodeBlock(sheet=code_block_4.sortedsheets) { sheet[3]; }
code_block_11 = CodeBlock { "Scale"; }
getParameterValueByName_4 = Element.GetParameterValueByName(element=code_block_10, parameterName=code_block_11)
code_block_12 = CodeBlock { " : "; }
split = String.Split(str=getParameterValueByName_4, separator0=code_block_12)
code_block_13 = CodeBlock(x=split) { DSCore.List.Transpose(x)[1]; }
toNumber = String.ToNumber(str=code_block_13)
setParameterByName_7 = Element.SetParameterByName(element=code_block_8, parameterName=code_block_9, value=toNumber)
setParameterByName_8 = Element.SetParameterByName(element=code_block_8, parameterName=code_block_6.out1, value=code_block_7.out1)
setParameterByName_9 = Element.SetParameterByName(element=code_block_8, parameterName=code_block_6.out0, value=code_block_7.out1)
code_block_14 = CodeBlock { true; }
python_script = Python(IN[0]=code_block_14)
# ---------- python_script.python (36 lines) ----------
# Boilerplate text
import clr
import os
import datetime

clr.AddReference("RevitServices")
import RevitServices
from RevitServices.Persistence import DocumentManager 

clr.AddReference('DynamoRevitDS')
import Dynamo

# Current doc and title
doc = DocumentManager.Instance.CurrentDBDocument
docTitle = doc.Title

# Check Dynamo workspace properties
dynamoRevit = Dynamo.Applications.DynamoRevit()
currentWorkspace = dynamoRevit.RevitDynamoModel.CurrentWorkspace
script = currentWorkspace.Name

# Get properties for writing the log file
dateStamp   = datetime.datetime.today().strftime("%d/%m/%y")
userName    = os.environ.get('USERNAME')

# Generate data to write
myLog   = "\\\\hm\\filestore\\Resource\\Revit\\HM Audit\\DynamoLogs\\Data\\DynamoLog.csv"
dataRow = dateStamp + "," + userName + "," + script +".dyn" + "," + docTitle + ".rvt"

# Adds new line to log file or creates one if doesn't exist
try:
	with open(myLog, "a") as file:
		file.writelines(dataRow + "\n")
	result = True
except:
	result = False
# ----------------------------------------
